# Grasshopper definition Swedge_RockBoltingOptim_template.gh (Grasshopper 1.0.7)
# plug-ins: Volvox, MetaHopper, Pufferfish, LunchBox, Tunny, Opossum2_0_Proto_A, CockroachGH, Pancake

point_in_wedge_for_block_id_3 = Point(Point(343.3529968, 498.8859863, 55.84799957))
force_transfer_vector = Panel("{0,0,0}")

# ----
# Step 4: Bake geometry
wedge_id_integer_only_start_with_0 = Panel("1")
view_wedge = BooleanToggle(True)
bake_to_sublayers_single_click = Button()
top_trim_domain_end = Slider(1, range=0..1)

# ----
# Step 2: Right click and select one point in the wedge
point_in_wedge = Point(Point(350.4370117, 506.4119873, 55.10800171))

# ----
# Step 7 (Optional): Read to SWedge
# 
# First, open SWedge, set up a project.
# Then generate and save a copy of the SWedge automation Excel template.
write_to_swedge_excel_template_single_cl = Button()  # "Write to SWedge Excel Template? (single click)"
scale_wedge_with_volume = BooleanToggle(False)
swedge_excel_template_file_path = FilePath("C:\Users\kyc\Downloads\SWedge\SWedge Automation Template_Deterministic.xlsx")
check_path = Panel(swedge_excel_template_file_path)

top_trim_domain_start = Slider(0, range=0..1)

output_numeric = ColourSwatch(SwatchColor=RGBA(48, 217, 138, 50))
# Results
script_wrapper = ColourSwatch(SwatchColor=RGBA(204, 204, 204, 91))
body_wrapper = ColourSwatch(SwatchColor=RGBA(217, 127, 48, 50))
output_viz = ColourSwatch(SwatchColor=RGBA(217, 115, 178, 50))
user_input = ColourSwatch(SwatchColor=RGB(255, 0, 255))
titleblock = ColourSwatch(SwatchColor=RGBA(204, 204, 204, 194))
results = ColourSwatch(SwatchColor=RGB(48, 217, 138))
input = ColourSwatch(SwatchColor=RGB(115, 190, 255))
selobj = GetSelectedObjects()  # -> ComponentObjects, ParamObjects, OtherObjects
setgroup = SetGroupProperties(Group=selobj.OtherObjects)
wiredisplay = ControlWireDisplay(WireDisplay=1)

# ---- group: Display of wedge block and cutter breps
hide_show_object_preview = HideShowObjectPreview(Visible=view_wedge, AllObjects_Object=[custom_preview, custom_preview_3, custom_preview_2, custom_preview_5])

# ---- group: CO2
co2_ø3mm = Panel("""14.43
16.17
18.23
20.28""")
co2_ø20mm = Panel("""5.35
5.80
6.60
7.85""")
co2_ø24mm = Panel("""8.59
9.59
10.89
12.62""")

# ---- group: Time
minute_per_meter = Panel("0.5")
minute_per_point = Panel("2")

# ----
edge_clearance_m = Slider(1, range=0..1)
angle_tolerance_deg = Slider(10, range=0..20)
minimum_spacing_m = Panel("1")

joint_2_friction_angle = Slider(27.084, range=0..38.542)

# ---- group: Force Transfer
# Variables on Sliders
bolt_horizontal_rotation_deg = Slider(0, range=-20..20)
bolt_2_num = Slider(1, range=0..1)
bolt_vertical_rotation_deg = Slider(0, range=-20..20)
bolt_8_num = Slider(1, range=0..1)
bolt_3_num = Slider(1, range=0..1)
bolt_7_num = Slider(1, range=0..1)
bolt_5_num = Slider(1, range=0..1)
bolt_4_num = Slider(1, range=0..1)
bolt_6_num = Slider(1, range=0..1)
bolt_min_spacing_m = Slider(1, range=1..5)
bolt_diameter_class = Slider(2, range=0..2)

# ---- group: Bolt forces / Yield load / Partial factor (1.25) (MN)
ø20mm = Panel("0.126")
ø33mm = Panel("0.333")
ø24mm = Panel("0.197")
stream_filter = StreamFilter(Gate=bolt_7_num, Stream0=ø20mm, Stream1=ø24mm, Stream2=ø33mm)

# ---- group: Variables
relay = Relay([bolt_vertical_rotation_deg, bolt_horizontal_rotation_deg, bolt_2_num, bolt_3_num, bolt_4_num, bolt_5_num, bolt_6_num, bolt_7_num, bolt_8_num, bolt_diameter_class, bolt_min_spacing_m])

# ----
# 1. Lock the trigger before computing the optimisation!
trigger = Trigger(Interval=-1000, TimerInterval=1000, Target=set_slider_properties_5)

# ---- group: 2024-03-21
larvik_mc_0_pareto = Fish([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])
# Internalise optimisation iterations and Pareto Solutions as Fish components
larvik_mc_0 = Fish([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])

# ----
# 8. RESULT VISUALISATION
re_read_csv = TrueOnlyButton(LastSaveLocalization="neutral,N")

# ---- group: 2024-03-22
# No difference in NSGA-II & NSGA-III?
larvik_gp_1_pareto = Fish([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])
larvik_gp_1 = Fish([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])
larvik_tpe_0_pareto = Fish([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])
larvik_tpe_0 = Fish([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])
larvik_ngsa_ii_3_pareto = Fish([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])
larvik_ngsa_ii_3 = Fish([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])
larvik_ngsa_iii_4 = Fish([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])
larvik_ngsa_iii_4_pareto = Fish([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])

# ----
# Step 5: Create Swedge model
# All blocks: inner bench height =
# Keyblock-group: inner bench height = 23.7 m
# Block ID 3 inner bench height = 15.0 m
fit_upper_face_bench_width_with_model = Button()
view_swedge_model_wedge_height_and_orien = BooleanToggle(False)  # "View Swedge model wedge height and orientations?"
crest_left_control_point = Point(Point(341.0710144, 497.0870056, 59.46500015))
crest_right_control_point = Point(Point(354.79599, 514.1630249, 70.58300018))
move_swedge_bottom_point_x_m_below_model = Slider(0, range=0..20)  # "Move SWedge bottom point X m below model along line of intersection"
inner_bench_height_m = Slider(23.7, range=0..50)

hide_show_object_preview_2 = HideShowObjectPreview(Visible=view_swedge_model_wedge_height_and_orien, AllObjects_Object=[marker_dimension, line_dimension, custom_preview_6])

# ----
# Single Block Rockbolting Optimisation with Tunny
# Developed by: Jessica Ka Yi Chiu
# Last revision date: 2024-07-08
# 1. Prepare single block to be supported by rockbolting
# 2. Variables
# 3. Objectives
# 4. Attributes
# 5. Formula
# 6. Tunny optimisation components
# 7. Saving & exporting results
# 8. Result visualisation
# Colour code:
# User input
# 1. PREPARE SINGLE BLOCK TO BE SUPPORTED BY ROCKBOLTING
# Step 1: Import Point Cloud and cutters
# Recommended for a more realistic wedge geometry and volume calculation
# if wedge does not daylights.
# NB! Will result in an incorrect Swedge model geometry
point_cloud = Cloud(<cloud referenced from the Rhino model>)
clip_lower_boundary_from_cutters_geometr = BooleanToggle(False)  # "Clip lower boundary from cutters' geometry?"
view_cutter_planes = BooleanToggle(False)
_1_left_sliding_plane_from_surface = Surface()
_2_left_sliding_plane_from_obj_mesh = Mesh()
_0_left_sliding_plane_from_curve_s = Curve(<curve referenced from the Rhino model>)
# Pre-defined values
_3_tension_crack_from_one_curve_to_verti = Curve()  # "3: Tension crack from one curve to vertical cutter"
_4_tension_crack_plane_surface = Surface()
_5_tension_crack_from_obj_mesh = Mesh()
_7_right_sliding_plane_from_plane_surfac = Surface()  # "7: Right sliding plane from plane surface"
_6_right_sliding_plane_from_curves = Curve(<curve referenced from the Rhino model>)
_8_right_sliding_plane_from_obj_mesh = Mesh()
_10_other_cutting_planar_surface_s_to_cu = Surface()  # "10. Other cutting planar surface(s) to cutters"
_11_other_plannar_surface_s_from_obj_mes = Mesh(<mesh referenced from the Rhino model>)  # "11.Other plannar surface(s) from OBJ MESH to cutter(s)"
_9_other_cutting_planes_from_curve_s_to = Curve(<curve referenced from the Rhino model>)  # "9: Other cutting planes from curve(s) to cutter(s)"

# ---- group: Create mesh for entire pointcloud
# Create poisson mesh from pointcloud
deconstruct_cloud = DeconstructCloud(Cloud=point_cloud)  # -> Points, Normals, Colors
cloudcreate = CloudCreate(Points=deconstruct_cloud.Points, Normals=deconstruct_cloud.Normals)
downsample = Downsample(PointCloud=cloudcreate, N="5000")
cloudnormals = CloudNormals(PointCloud=downsample, Radius="0.3", Iter=30, Neigbhours=10, D=1, Erase=True)
cloudmesh = CloudMesh(PointCloud=cloudnormals, Max=8, Min=0, Scale=1.1, Linear=False, Color=invert(False), Open3dCGAL=True)  # -> Mesh, Density
mesh = Mesh(cloudmesh.Mesh)

# ----
# Step 6: Input parameters for FS calculations
# Reset slider values in Tunny
# Generate bolting positions (takes some seconds!!)
wedge_volume_for_stability_calculation = ValueList({"3D model": 0, "SWedge model": 1, "Manual input": 2}, selected="3D model")
joint_plane_area_input = ValueList({"Use 3D model joint planes": 0, "Use SWedge model joint planes": 1}, selected="Use 3D model joint planes")
generate_all_possible_bolting_positions = BooleanToggle(True)
view_all_available_bolt_lines_at_minimum = BooleanToggle(True)  # "View all available bolt lines at minimum spacing"
bolt_through_left_joint = BooleanToggle(True)
bolt_through_right_joint = BooleanToggle(False)
bolt_through_tension_crack_joint = BooleanToggle(False)
bolt_through_other_joints = BooleanToggle(False)
minimum_anchoring_length_m = Slider(1, range=0..3)
manual_input_volume_m3 = Panel("118.11")
manual_joint_1_phi_leave_empty_if_optimi = Panel("")  # "Manual Joint 1 phi (leave empty if optimised value to be used)"
force_transfer_vector_2 = Panel("{0.025634,-0.038637,-0.059384}")
rock_unit_weight_mn_m3 = Panel("0.0279")
manual_joint_2_phi_leave_empty_if_optimi = Panel("")  # "Manual Joint 2 phi (leave empty if optimised value to be used)"

enable_disable_object = EnableDisableObject(Enabled=generate_all_possible_bolting_positions, AllObjects_Object=bolting_point_options)
force_transfer_vector_3 = Vector(force_transfer_vector_2)

# ---- group: Create patch surface from poisson mesh boundary and filtered points
# Create patch surface from mesh
meshrepair = MeshRepair(Mesh=mesh)
mesh_edges = MeshEdges(Mesh=meshrepair)  # -> NakedEdges, InteriorEdges, NonManifoldEdges
join_curves = JoinCurves(Curves=mesh_edges.NakedEdges, Preserve=False)

# ---- group: Find optimum count UV of rebuild surface
mesh_2 = Mesh(meshrepair)
area = Area(Geometry=mesh_2)  # -> Area, Centroid
deconstruct_mesh = DeconstructMesh(Mesh=mesh_2)  # -> Vertices, Faces, Colours, Normals
list_length = ListLength(List=deconstruct_mesh.Vertices)
expression = Expression(A=area.Area, V=list_length, Expression="A/V")
expression_2 = Expression(V=list_length, Expression="sqrt(V)")

# ---- group: Create patch surface from poisson mesh boundary and filtered points (continued)
patch = Patch(Curves=join_curves, Points=deconstruct_mesh.Vertices, Spans=20, Flexibility="1", Trim=True)

# ---- group: Point deform of a rebuilt surface
rebuild_surface = RebuildSurface(Surface=patch, CountU=expression_2, CountV=expression_2)
surface_points = SurfacePoints(Surface=rebuild_surface)  # -> Points, Weights, Greville, UCount, VCount
mesh_closest_point = MeshClosestPoint(Point=surface_points.Points, Mesh=meshrepair)  # -> Point, Index, Parameter
vector_2pt = Vector2Pt(PointA=surface_points.Points, PointB=mesh_closest_point.Point, Unitize=False)  # -> Vector, Length
point_deform = PointDeform(Geometry=rebuild_surface, Points=surface_points.Points, Motion=vector_2pt.Vector)
patch_surface = Brep(point_deform)

# ----
volume_calculation = VolumeCalculation(
    patch_surface=patch_surface,
    point_cloud=point_cloud,
    _0_left_sliding_plane_from_curve_s=_0_left_sliding_plane_from_curve_s,
    _1_left_sliding_plane_from_surface=_1_left_sliding_plane_from_surface,
    _2_left_sliding_plane_from_obj_mesh=_2_left_sliding_plane_from_obj_mesh,
    _3_tension_crack_from_one_curve_to_verti=_3_tension_crack_from_one_curve_to_verti,
    _4_tension_crack_plane_surface=_4_tension_crack_plane_surface,
    _5_tension_crack_from_obj_mesh=_5_tension_crack_from_obj_mesh,
    _6_right_sliding_plane_from_curves=_6_right_sliding_plane_from_curves,
    _7_right_sliding_plane_from_plane_surfac=_7_right_sliding_plane_from_plane_surfac,
    _8_right_sliding_plane_from_obj_mesh=_8_right_sliding_plane_from_obj_mesh,
    _9_other_cutting_planes_from_curve_s_to=_9_other_cutting_planes_from_curve_s_to,
    _10_other_cutting_planar_surface_s_to_cu=_10_other_cutting_planar_surface_s_to_cu,
    _11_other_plannar_surface_s_from_obj_mes=_11_other_plannar_surface_s_from_obj_mes,
    point_in_wedge=point_in_wedge,
    clip_lower_boundary=clip_lower_boundary_from_cutters_geometr,
    top_trim_domain_start=top_trim_domain_start,
    top_trim_domain_end=top_trim_domain_end)  # -> check_number_of_left_sliding_plane_geome_2, check_tension_crack_geometry_2, check_number_of_right_sliding_plane_geom_2, check_number_of_other_cutting_plane_geom_2, brep_2_volume_2, left_joint_trimmed_cutter_brep_2, right_joint_trimmed_cutter_brep_2, tension_crack_trimmed_cutter_brep_2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
swedge_model_and_geometries = SwedgeModelAndGeometries(
    left_joint_trimmed_cutter_brep=volume_calculation.left_joint_trimmed_cutter_brep_2,
    right_joint_trimmed_cutter_brep=volume_calculation.right_joint_trimmed_cutter_brep_2,
    crest_left_control_point=crest_left_control_point,
    crest_right_control_point=crest_right_control_point,
    inner_bench_height=inner_bench_height_m,
    fit_top_face_bench_width_to_model=fit_upper_face_bench_width_with_model,
    swedge_bottom_point_adjustment_m=move_swedge_bottom_point_x_m_below_model)  # -> swedge_model_mesh, upper_face_mesh_2, slope_face_mesh_2, left_joint_face_mesh_2, right_joint_face_mesh_2, wedge_height_line_2, wedge_height_m_2, inner_bench_height_m_2
volume = Volume(Geometry=swedge_model_and_geometries.swedge_model_mesh)  # -> Volume, Centroid
bake_wedgeto_sublayers = BakeWedgetoSublayers(
    wedge_id_integer=wedge_id_integer_only_start_with_0,
    bake_to_sublayers=bake_to_sublayers_single_click,
    brep_2_volume=volume_calculation.brep_2_volume_2,
    volume_m3=volume_calculation.volume_m3_2,
    block_left_sliding_mesh=volume_calculation.left_joint_trimmed_cutter_brep_2,
    block_right_sliding_mesh=volume_calculation.right_joint_trimmed_cutter_brep_2,
    block_slope_surface=volume_calculation.block_slope_surface_2,
    block_tension_crack_mesh=volume_calculation.tension_crack_trimmed_cutter_brep_2)

# ----
# Step 3: Calculate volume
volume_m3 = Panel(volume_calculation.volume_m3_2)

check_number_of_left_sliding_plane_geome = Panel(volume_calculation.check_number_of_left_sliding_plane_geome_2)  # "Check: number of left sliding plane geometry"
check_tension_crack_geometry = Panel(volume_calculation.check_tension_crack_geometry_2)
check_number_of_right_sliding_plane_geom = Panel(volume_calculation.check_number_of_right_sliding_plane_geom_2)  # "Check: Number of right sliding plane geometry"
check_other_cutter_plane_geometry = Panel(volume_calculation.check_number_of_other_cutting_plane_geom_2)

swedge_wedge_height_m = Panel(swedge_model_and_geometries.wedge_height_m_2)

swedge_model_volume_m3 = Panel(volume.Volume)

pick_n_choose = PickNChoose(
    Pattern=wedge_volume_for_stability_calculation,
    Stream0=volume_m3,
    Stream1=swedge_model_volume_m3,
    Stream2=manual_input_volume_m3)
input_volume_m3 = Panel(pick_n_choose)

# ---- group: Wedge Height adjustment
get_selected_objects = GetSelectedObjects(AllObjects_Object=inner_bench_height_m)  # -> ComponentObjects, ParamObjects, OtherObjects
set_slider_properties = SetSliderProperties(
    Slider=get_selected_objects.ParamObjects,
    Value=swedge_model_and_geometries.inner_bench_height_m_2,
    Range="0 to 50",
    Type=0)

# ---- group: Display Slope Faces Dip/Dip Direction
panel = Panel("True")
panel_2 = Panel("0")
entwine = Entwine(
    Branch00=swedge_model_and_geometries.upper_face_mesh_2,
    Branch01=swedge_model_and_geometries.slope_face_mesh_2,
    FlattenInputs=True)
mesh_dip_dipdirection = MeshDipDipDirection_2(mesh=entwine, round_to_nearest=panel, no_of_decimal_place=panel_2)  # -> dip_deg_2, dip_direction_deg_2, dip_dipdirection_2
face_normals = FaceNormals(Mesh=entwine)  # -> Centers, Normals
line_sdl = LineSDL(Start=face_normals.Centers, Direction=face_normals.Normals, Length="2")  # -> flatten(Line)
explode_tree = ExplodeTree(Data=graft(mesh_dip_dipdirection.dip_deg_2))  # -> Branch0, Branch1
explode_tree_2 = ExplodeTree(Data=graft(mesh_dip_dipdirection.dip_direction_deg_2))  # -> Branch0, Branch1
marker_dimension = MarkerDimension(Line=line_sdl, Text=mesh_dip_dipdirection.dip_dipdirection_2, Size=1)

# ---- group: Joint 1
mesh_dip_dipdirection_2 = MeshDipDipDirection_2(mesh=volume_calculation.left_joint_trimmed_cutter_brep_2, round_to_nearest=panel, no_of_decimal_place=panel_2)  # -> dip_deg_2, dip_direction_deg_2, dip_dipdirection_2

# ---- group: Joint 2
mesh_dip_dipdirection_3 = MeshDipDipDirection_2(mesh=volume_calculation.right_joint_trimmed_cutter_brep_2, round_to_nearest=panel, no_of_decimal_place=panel_2)  # -> dip_deg_2, dip_direction_deg_2, dip_dipdirection_2

# ---- group: Tension Crack
mesh_dip_dipdirection_4 = MeshDipDipDirection_2(mesh=volume_calculation.tension_crack_trimmed_cutter_brep_2, round_to_nearest=panel, no_of_decimal_place=panel_2)  # -> dip_deg_2, dip_direction_deg_2, dip_dipdirection_2

# ---- group: Wedge slope surface
colour_picker = ColourPicker(PickedColour=RGBA(0, 170, 0, 135))
custom_preview = CustomPreview(Geometry=volume_calculation.block_slope_surface_2, Material=colour_picker)

# ---- group: Right Joint Trimmed Cutter Brep
colour_picker_2 = ColourPicker(PickedColour=RGBA(0, 0, 255, 135))
custom_preview_2 = CustomPreview(Geometry=volume_calculation.tension_crack_trimmed_cutter_brep_2, Material=colour_picker_2)

# ---- group: Left Joint Trimmed Cutter Brep
colour_picker_3 = ColourPicker(PickedColour=RGBA(255, 0, 0, 135))
custom_preview_3 = CustomPreview(Geometry=volume_calculation.left_joint_trimmed_cutter_brep_2, Material=colour_picker_3)

# ---- group: Cutter planes
colour_picker_4 = ColourPicker(PickedColour=RGB(255, 255, 255))
custom_preview_4 = CustomPreview(Geometry=volume_calculation.cutter_planes_brep_2, Material=colour_picker_4)
hide_show_object_preview_3 = HideShowObjectPreview(Visible=view_cutter_planes, AllObjects_Object=custom_preview_4)

# ---- group: Tension Crack Joint Trimmed Cutter Brep
colour_picker_5 = ColourPicker(PickedColour=RGBA(255, 255, 0, 135))
custom_preview_5 = CustomPreview(Geometry=volume_calculation.right_joint_trimmed_cutter_brep_2, Material=colour_picker_5)

# ---- group: Swedge model
colour_picker_6 = ColourPicker(PickedColour=RGB(255, 0, 0))
mesh_edges_2 = MeshEdges(Mesh=swedge_model_and_geometries.swedge_model_mesh)  # -> NakedEdges, InteriorEdges, NonManifoldEdges
custom_preview_6 = CustomPreview(Geometry=mesh_edges_2.InteriorEdges, Material=colour_picker_6)

# ---- group: Display Wedge Height
round_to_decimal_place = RoundToDecimalPlace(NumberX=swedge_model_and_geometries.wedge_height_m_2, DecimalPlace="1", RoundType=0)  # -> Rounded, Difference
line_dimension = LineDimension(Line=swedge_model_and_geometries.wedge_height_line_2, Text=round_to_decimal_place.Rounded, Size=Slider(0.8, range=0..1))

# ---- group: Collect all joint breps to be bolted through
stream_filter_2 = StreamFilter(Gate=bolt_through_other_joints, Stream1=volume_calculation.other_joints_trimmed_cutter_brep_2)  # -> flatten(Stream)
stream_filter_3 = StreamFilter(Gate=bolt_through_tension_crack_joint, Stream1=volume_calculation.tension_crack_trimmed_cutter_brep_2)  # -> flatten(Stream)
stream_filter_4 = StreamFilter(Gate=bolt_through_right_joint, Stream1=volume_calculation.right_joint_trimmed_cutter_brep_2)  # -> flatten(Stream)
stream_filter_5 = StreamFilter(Gate=bolt_through_left_joint, Stream1=volume_calculation.left_joint_trimmed_cutter_brep_2)  # -> flatten(Stream)
merge = Merge(Data1=stream_filter_5, Data2=stream_filter_4, Data3=stream_filter_3, Data4=stream_filter_2)  # -> flatten(Result)

# ---- group: Get Trend/Plunge after bolt rotation
bolt_rotation = BoltRotation(
    slope_face_dip_deg=explode_tree.Branch1,
    slope_face_dip_direction_deg=explode_tree_2.Branch1,
    base=volume_calculation.wedge_bottom_point_2,
    bolt_plunge_rotation_deg=bolt_vertical_rotation_deg,
    bolt_trend_rotation_deg=bolt_horizontal_rotation_deg)  # -> bolt_direction_2, plunge_2, trend_2
bolt_trend = Panel(bolt_rotation.trend_2)
bolt_plunge = Panel(bolt_rotation.plunge_2)

# ----
# 2. Get available bolting points depending on block geometry and Point Cloud
library_of_bolt_length_m = Panel("""2.4
3
4
5
6
7
8""")
cloudnormals_2 = CloudNormals(PointCloud=cloudcreate, Radius="0.3", Iter=30, Neigbhours=10, D=1, Erase=True)
pointcloud_subparallel_to_swedge_slope_s = PointCloudSubparallelToSWedgeSlopeSurface(
    pointcloud_with_normals=cloudnormals_2,
    swedge_slope_face_mesh=swedge_model_and_geometries.slope_face_mesh_2,
    block_slope_surface=volume_calculation.block_slope_surface_2,
    angle_tolerance_deg=angle_tolerance_deg)  # "PointCloud Subparallel to SWedge Slope Surface"
bolting_point_options = AvailableBoltPointsAndLines(
    points_subparallel_with_swedge_slope_fac=pointcloud_subparallel_to_swedge_slope_s,
    edge_clearance_m=edge_clearance_m,
    block_slope_face=volume_calculation.block_slope_surface_2,
    swedge_model_slope_face_mesh=swedge_model_and_geometries.slope_face_mesh_2,
    swedge_model_centroid=volume.Centroid,
    bolting_point_minimum_spacing_m=minimum_spacing_m)
available_bolt_lines = AvailableBoltPointsAndLines_2(
    minimum_anchoring_length_m=minimum_anchoring_length_m,
    sorted_bolting_point_options=bolting_point_options,
    brep_for_bolt_projection=merge,
    library_of_bolt_lengths_m=library_of_bolt_length_m,
    bolting_point_spacing_m=bolt_8_num,
    bolt_direction=bolt_rotation.bolt_direction_2)  # -> available_bolt_points_numbers_grouped_by_2, available_bolt_lines_2
available_bolt_points_numbers_grouped_by = Panel(available_bolt_lines.available_bolt_points_numbers_grouped_by_2)  # "Available bolt points numbers grouped by lengths"

point = Point(bolting_point_options)
available_bolt_lines_2 = Panel(available_bolt_lines.available_bolt_points_numbers_grouped_by_2)

# ---- group: Choose joint plane for FS calculations / 3D model
entwine_2 = Entwine(
    Branch00=volume_calculation.left_joint_trimmed_cutter_brep_2,
    Branch01=volume_calculation.right_joint_trimmed_cutter_brep_2,
    FlattenInputs=True)
mesh_brep = MeshBrep(
    Brep=entwine_2,
    Settings={GridMaxCount=0, GridMinCount=16, JaggedSeams=False, MaxEdgeLength=0, MinEdgeLength=0.0001, MinTolerance=0, Refine=True, RefineAngle=0, RelativeTolerance=0.65, SimplePlanes=True, Tolerance=0})  # -> simplify(Mesh)

# ---- group: Choose joint plane for FS calculations / SWedge moel
entwine_3 = Entwine(
    Branch00=swedge_model_and_geometries.left_joint_face_mesh_2,
    Branch01=swedge_model_and_geometries.right_joint_face_mesh_2,
    FlattenInputs=True)  # -> simplify(Result)

# ---- group: Choose joint plane for FS calculations
pick_n_choose_2 = PickNChoose(Pattern=joint_plane_area_input, Stream0=mesh_brep, Stream1=entwine_3)
joint_tree = Geometry(pick_n_choose_2)

# ---- group: Available bolt lines
colour_picker_7 = ColourPicker(PickedColour=RGB(0, 0, 255))
custom_preview_7 = CustomPreview(Geometry=available_bolt_lines.available_bolt_lines_2, Material=colour_picker_7)
hide_show_object_preview_4 = HideShowObjectPreview(Visible=view_all_available_bolt_lines_at_minimum, AllObjects_Object=custom_preview_7)

# ---- group: Force Transfer / Constructing sliders for variables
bolt_rotation_angle_range_deg = Slider(20, range=0..100)
max_bolt_diameter_class = Slider(2, range=0..10)
max_allowed_bolt_spacing_m = Slider(5, range=0..10)
min_allowed_bolt_spacing_m = Slider(1, range=0..10)
negative = Negative(Value=bolt_rotation_angle_range_deg)
construct_domain = ConstructDomain(DomainStart=negative, DomainEnd=bolt_rotation_angle_range_deg)
construct_domain_2 = ConstructDomain(DomainStart=min_allowed_bolt_spacing_m, DomainEnd=max_allowed_bolt_spacing_m)
float = Panel("0")
integer = Panel("1")
entwine_4 = Entwine(
    Branch00=float,
    Branch01=float,
    Branch02=float,
    Branch03=float,
    Branch04=float,
    Branch05=float,
    Branch06=float,
    Branch07=float,
    Branch08=float,
    Branch09=integer,
    Branch010=float,
    FlattenInputs=True)  # -> flatten(Result)
get_selected_objects_2 = GetSelectedObjects(AllObjects_Object=[bolt_vertical_rotation_deg, bolt_horizontal_rotation_deg, bolt_2_num, bolt_3_num, bolt_4_num, bolt_5_num, bolt_7_num, bolt_8_num, bolt_6_num, bolt_diameter_class, bolt_min_spacing_m])  # -> ComponentObjects, ParamObjects, OtherObjects

# ---- group: FS
# 3. OBJECTIVES
# 1. Factor of Safety
fs_min = Slider(1.5, range=0..4)

# ---- group: Time
# 3. Time
bolt_lines = Line()
length = Length(Curve=bolt_lines)
mass_addition = MassAddition(Input=flatten(length))  # -> Result, PartialResults
minute_per_meter_2 = Number(minute_per_meter)
minute_per_point_2 = Number(minute_per_point)

# ---- group: Time / Set to L=0 if not bolt can be drawn
null_item = NullItem(Item=mass_addition.Result)  # -> NullFlags, InvalidFlags, Description
stream_filter_6 = StreamFilter(Gate=null_item.NullFlags, Stream0=mass_addition.Result, Stream1="0")

# ---- group: Calculate embedment length
brep_join = BrepJoin(Breps=flatten(merge))  # -> Breps, Closed

# ---- group: Calculated convex hull 2D area from bolting start points
swedge_slope_face_mesh = Mesh(swedge_model_and_geometries.slope_face_mesh_2)
mesh_to_polysurface = MeshToPolysurface(Mesh=swedge_slope_face_mesh, Triangles=False, FaceMerge=False)
is_planar = IsPlanar(Surface=mesh_to_polysurface, Interior=True)  # -> Planar, Plane

# ---- group: FS / Minimum FS (>/= FS_min)
# 1. Alternative 1: minimum FS (at least 1)
panel_3 = Panel("0")

# ---- group: CO2
# 2. CO2
stream_filter_7 = StreamFilter(Gate=bolt_7_num, Stream0=co2_ø20mm, Stream1=co2_ø24mm, Stream2=co2_ø3mm)

# ---- group: Force Transfer
# 2. VARIABLES
panel_4 = Panel("1")
panel_5 = Panel("0")
panel_6 = Panel("0")

# ---- group: Force Transfer / Constructing sliders for variables (continued)
construct_domain_3 = ConstructDomain(DomainStart=panel_5, DomainEnd=max_bolt_diameter_class)
construct_domain_4 = ConstructDomain(DomainStart=panel_6, DomainEnd=panel_4)
entwine_5 = Entwine(
    Branch00=construct_domain,
    Branch01=construct_domain,
    Branch02=construct_domain_4,
    Branch03=construct_domain_4,
    Branch04=construct_domain_4,
    Branch05=construct_domain_4,
    Branch06=construct_domain_4,
    Branch07=construct_domain_4,
    Branch08=construct_domain_4,
    Branch09=construct_domain_3,
    Branch010=construct_domain_2,
    FlattenInputs=True)  # -> flatten(Result)
domains = Panel(entwine_5)

# ---- group: Force Transfer
_1st_slider_values = Panel("""0
0
1
1
1
1
1
1
1
2
1""")

# ----
# 1. Set minimum FS, then run the optimisation
opossum = Opossum(
    OpossumData_OptimizationType=2,
    OpossumData_ResultSerializationStatus=0,
    OpossumData_objective=fs_proxy,
    OpossumData_variable=[cohesion, joint_1_friction_angle])
# 5. FORMULA
fs_min_2 = Slider(1, range=0..4)
joint_1_friction_angle = Slider(37, range=0..38.295)

# ---- group: Choose friction angles based on inputs
entwine_6 = Entwine(Branch00=manual_joint_1_phi_leave_empty_if_optimi, Branch01=manual_joint_2_phi_leave_empty_if_optimi, FlattenInputs=True)  # -> simplify(Result)
entwine_7 = Entwine(Branch00=joint_1_friction_angle, Branch01=joint_2_friction_angle, FlattenInputs=True)  # -> simplify(Result)
text_length = TextLength(Text=entwine_6)
equality = Equality(FirstNumber=text_length, SecondNumber="0")  # -> flatten(Equality), Inequality
pick_n_choose_3 = PickNChoose(Pattern=equality.Equality, Stream0=flatten(entwine_6), Stream1=flatten(entwine_7))

# ---- group: Determine whether joint friction will be different between sliding planes
explode_tree_3 = ExplodeTree(Data=simplify(graft(pick_n_choose_3)))  # -> Branch0, Branch1
phi_1 = Number(explode_tree_3.Branch0)
phi_2 = Number(explode_tree_3.Branch0)

# ---- group: Joint friction angle: Optimisation within 0 and minimum joint dip angle; then update the slider automatically
brep_brep = BrepBrep(BrepA=volume_calculation.left_joint_trimmed_cutter_brep_2, BrepB=volume_calculation.right_joint_trimmed_cutter_brep_2)  # -> Curves, Points
find_vector_plunge_trend = Cluster(vector=brep_brep.Curves)  # -> trend_2, plunge_2
absolute = Absolute(Value=find_vector_plunge_trend.plunge_2)
construct_domain_5 = ConstructDomain(DomainStart="0", DomainEnd=absolute)
joint_friction_angles_before_partial_fac = Panel([phi_1, phi_2])  # "Joint friction angles (before partial factor)"

# ----
get_selected_objects_3 = GetSelectedObjects(AllObjects_Object=joint_1_friction_angle)  # -> ComponentObjects, ParamObjects, OtherObjects
cohesion = Slider(0.02, range=0..2)
set_slider_properties_2 = SetSliderProperties(Slider=get_selected_objects_3.ParamObjects, Range=construct_domain_5, Type=0)

end_points = EndPoints(Curve=brep_brep.Curves)  # -> Start, End
deconstruct = Deconstruct(Point=end_points.End)  # -> XComponent, YComponent, ZComponent
deconstruct_2 = Deconstruct(Point=end_points.Start)  # -> XComponent, YComponent, ZComponent
subtraction = Subtraction(A=deconstruct_2.ZComponent, B=deconstruct.ZComponent)

# ---- group: Calculate residual friction angle. Assuming 3 degrees smaller.
subtraction_2 = Subtraction(A=phi_1, B="3")
subtraction_3 = Subtraction(A=phi_2, B="3")

# ---- group: Force Transfer (continued)
wedge_new_fs_system_basal = WedgeNewFSSystemBasal(
    gamma_r=rock_unit_weight_mn_m3,
    h_w=subtraction,
    a_t=0,
    joint=joint_tree,
    wedge_slope_face_mesh=swedge_model_and_geometries.slope_face_mesh_2,
    wedge_upper_face_mesh=swedge_model_and_geometries.upper_face_mesh_2,
    block_brep=volume_calculation.brep_2_volume_2,
    volume=pick_n_choose,
    slope_dip=explode_tree.Branch1,
    slope_dip_direction=explode_tree_2.Branch1,
    c_1=cohesion,
    phi_1=phi_1,
    phi_1_r=subtraction_2,
    phi_2_r=subtraction_3,
    k=0,
    e_cap_seismic="{0,0,0}",
    c_i=force_transfer_vector_3,
    joint_water_pressure="2",
    percentage_fill="100",
    c_active=0,
    e_cap_bolt_active="{0,0,0}",
    c_passive=0,
    e_cap_bolt_passive="{0,0,0}")  # -> fs_system_2, fs_s_2, fs_c_2, sliding_direction_number_2, sliding_joint_index_2, driving_force_2, resisting_force_2, sliding_direction_unit_vector_2, normal_force_on_joints_mn_2, shear_resistance_on_joints_mn_2

# ----
expression_3 = Expression(FS=wedge_new_fs_system_basal.fs_system_2, FS_min=fs_min_2, Expression="Abs(FS-FS_min)")
fs_proxy = Number(expression_3)
panel_7 = Panel(wedge_new_fs_system_basal.fs_system_2)

apply_material_partial_factor = ApplyMaterialPartialFactor(c_1=cohesion, phi_1=phi_1, phi_1_r=subtraction_2, c_2=cohesion, phi_2=phi_2, phi_2_r=subtraction_3)  # -> c_1_4, phi_1_4, phi_1_r_4, c_2_4, phi_2_4, phi_2_r_4

write_to_swedge = WriteToSWedge(
    scale_wedge_with_volume=scale_wedge_with_volume,
    write_to_excel_template=write_to_swedge_excel_template_single_cl,
    file_path=swedge_excel_template_file_path,
    wedgeid=wedge_id_integer_only_start_with_0,
    joint1_dip=mesh_dip_dipdirection_2.dip_deg_2,
    joint1_dip_direction=mesh_dip_dipdirection_2.dip_direction_deg_2,
    joint_1_phi=apply_material_partial_factor.phi_1_4,
    joint_2_phi=apply_material_partial_factor.phi_2_4,
    slope_dip=explode_tree.Branch1,
    slope_dip_direction=explode_tree_2.Branch1,
    joint2_dip=mesh_dip_dipdirection_3.dip_deg_2,
    wedge_height=swedge_model_and_geometries.wedge_height_m_2,
    joint2_dip_direction=mesh_dip_dipdirection_3.dip_direction_deg_2,
    upper_face_dip=explode_tree.Branch0,
    upper_face_dip_direction=explode_tree_2.Branch0,
    volume=pick_n_choose,
    tension_crack_dip=mesh_dip_dipdirection_4.dip_deg_2,
    tension_crack_dipdirection=mesh_dip_dipdirection_4.dip_direction_deg_2,
    rock_unit_weight=rock_unit_weight_mn_m3)

# ----
# 3. Rockbolting calculations - orientation; lengths; forces
available_bolt_points_grouped_by_lengths = Integer(available_bolt_lines.available_bolt_points_numbers_grouped_by_2)

# ---- group: Number of bolts for different lengths
entwine_8 = Entwine(
    Branch00=bolt_2_num,
    Branch01=bolt_3_num,
    Branch02=bolt_4_num,
    Branch03=bolt_5_num,
    Branch04=bolt_6_num,
    Branch05=bolt_7_num,
    Branch06=bolt_8_num,
    FlattenInputs=True)  # -> simplify(Result)
remap_numbers = RemapNumbers(Value=entwine_8, Source=Domain(0, 1), Target=available_bolt_points_grouped_by_lengths)  # -> Mapped, Clipped
round = Round(Number=remap_numbers.Mapped)  # -> Nearest, Floor, Ceiling

# ----
# 4. ATTRIBUTES
explode_tree_4 = ExplodeTree(Data=round.Nearest)  # -> Branch0, Branch1, Branch2, Branch3, Branch4, Branch5, Branch6

num = Integer(round.Nearest)

# ---- group: CO2 (continued)
expression_4 = Expression(num=num, CO2=graft(stream_filter_7), Expression="(num*CO2)")
mass_addition_2 = MassAddition(Input=flatten(expression_4))  # -> Result, PartialResults

co2 = Number(mass_addition_2.Result)
panel_8 = Panel(co2)

# ---- group: Number of bolts for different lengths (continued)
mass_addition_3 = MassAddition(Input=flatten(num))  # -> Result, PartialResults
number_of_bolts_for_each_length = Panel(num)

# ---- group: Time (continued)
expression_5 = Expression(
    num=mass_addition_3.Result,
    L=stream_filter_6,
    Drill_time=minute_per_meter_2,
    Point_time=minute_per_point_2,
    Expression="(num*Point_time+L*Drill_time)/60")

# ----
hours = Number(expression_5)
panel_9 = Panel(hours)

# ---- group: Bolt forces
expression_6 = Expression(num=mass_addition_3.Result, bolt_capacity=stream_filter, Expression="num*bolt_capacity")
of_yield_load_for_pretensioning = Panel("0.6")
multiplication = Multiplication(A=expression_6, B=of_yield_load_for_pretensioning)
passive_bolt_force_mn = Panel(expression_6)
active_bolt_force_mn = Panel(multiplication)

# ----
# 4. Calculate Fator of Safety of Wedge
wedge_new_fs_system_basal_2 = WedgeNewFSSystemBasal(
    gamma_r=rock_unit_weight_mn_m3,
    h_w=subtraction,
    a_t=0,
    joint=joint_tree,
    wedge_slope_face_mesh=swedge_model_and_geometries.slope_face_mesh_2,
    wedge_upper_face_mesh=swedge_model_and_geometries.upper_face_mesh_2,
    block_brep=volume_calculation.brep_2_volume_2,
    volume=pick_n_choose,
    slope_dip=explode_tree.Branch1,
    slope_dip_direction=explode_tree_2.Branch1,
    c_1=apply_material_partial_factor.c_1_4,
    phi_1=apply_material_partial_factor.phi_1_4,
    phi_1_r=apply_material_partial_factor.phi_1_r_4,
    phi_2_r=apply_material_partial_factor.phi_2_r_4,
    k=0,
    e_cap_seismic="{0,0,0}",
    c_i=force_transfer_vector_3,
    joint_water_pressure="2",
    percentage_fill="100",
    c_active=multiplication,
    e_cap_bolt_active=bolt_rotation.bolt_direction_2,
    c_passive=expression_6,
    e_cap_bolt_passive=bolt_rotation.bolt_direction_2)  # -> fs_system_2, fs_s_2, fs_c_2, sliding_direction_number_2, sliding_joint_index_2, driving_force_2, resisting_force_2, sliding_direction_unit_vector_2, normal_force_on_joints_mn_2, shear_resistance_on_joints_mn_2
fs_system = Panel(wedge_new_fs_system_basal_2.fs_system_2)

# ---- group: FS (continued)
fs_system_2 = Number(wedge_new_fs_system_basal_2.fs_system_2)

# ---- group: FS / Minimum FS (>/= FS_min) (continued)
subtraction_4 = Subtraction(A=fs_system_2, B=fs_min)
smaller_than = SmallerThan(FirstNumber=subtraction_4, SecondNumber=panel_3)  # -> SmallerThan, OrEqualTo
expression_7 = Expression(FS=subtraction_4, Expression="Abs(FS)*1000")
pick_n_choose_4 = PickNChoose(Pattern=smaller_than.OrEqualTo, Stream0=subtraction_4, Stream1=expression_7)
minfs = Number(pick_n_choose_4)

# ---- group: Calculate constraints (>0 means constraint violated)
subtraction_5 = Subtraction(FS_min=fs_min, FS_system=wedge_new_fs_system_basal_2.fs_system_2)

# ---- group: Objectives min positive FS
relay_2 = Relay([minfs, co2, hours])

# ----
# 6. TUNNY OPTIMISATION COMPONENTS
# 2. Reset Slider values
# 3. Clear Eggs
# 4. Lay Eggs
# 5. Double click Tunny component to set up and start the optimisation
clear_egg = Button()
reset_slider_values = Button()
lay_egg = Button()
construct_fish_egg = ConstructFishEgg(
    Variables=[bolt_vertical_rotation_deg, bolt_horizontal_rotation_deg, bolt_2_num, bolt_3_num, bolt_4_num, bolt_5_num, bolt_6_num, bolt_7_num, bolt_8_num, bolt_diameter_class, bolt_min_spacing_m],
    LayEgg=lay_egg,
    Clear=clear_egg)
fishegg = Panel(construct_fish_egg)

# ---- group: Force Transfer (continued)
pick_n_choose_5 = PickNChoose(Pattern=reset_slider_values, Stream1=graft(_1st_slider_values))  # -> flatten(Result)

# ---- group: Force Transfer / Constructing sliders for variables (continued)
set_slider_properties_3 = SetSliderProperties(Slider=get_selected_objects_2.ParamObjects, Value=pick_n_choose_5, Range=entwine_5, Type=entwine_4)

# ---- group: Exporting Fish data to .csv
# 1. Export results to Fish in Tunny
# Source:
# https://github.com/jhorikawa/GrasshopperProgrammingTutorials/blob/master/0012%20Export%20CSV%20with%20C%23%20for%20Grasshopper/CSVExport.gh
# 2. Select folder directory and write file name
# 3. click the button to save the csv file (NB!! Overwritable!)
# 4. Export Pareto results to Fish in Tunny,
# Then click button
panel_10 = Panel("C:\Users\KYC\Downloads\")
save_pareto_solutions_to_csv = Button()
save_to_csv = Button()
file_path = FilePath(panel_10)
file_name = Panel("test.csv")
concatenate = Concatenate(FragmentA=file_path, FragmentB=file_name)

# ---- group: From CSV file to correct sliders values / Get variable names in CSV file order
read_file = ReadFile(File=concatenate, PerLineParse=True)
enable_disable_object_2 = EnableDisableObject(Enabled=re_read_csv, AllObjects_Object=read_file)
read_csv = ReadCSV(CSVString=read_file, Delimiter=",")  # -> Headers, Values
panel_11 = Panel("""4
5
6
7
8
9
10
11""")
list_item = ListItem(List=read_csv.Headers, Index=panel_11, Wrap=True)
text_fragment = TextFragment(Text=list_item, Start="4")

# ---- group: Update slider range for visualisation
get_selected_objects_4 = GetSelectedObjects(AllObjects_Object=trial_no)  # -> ComponentObjects, ParamObjects, OtherObjects
flip_matrix = FlipMatrix(Data=read_csv.Values)
tree_statistics = TreeStatistics(Tree=flip_matrix)  # -> Paths, Length, Count
last_index = LastIndex(List=tree_statistics.Paths)
construct_domain_6 = ConstructDomain(DomainStart=0, DomainEnd=last_index)
set_slider_properties_4 = SetSliderProperties(Slider=get_selected_objects_4.ParamObjects, Range=construct_domain_6, Type=1)

# ---- group: From CSV file to correct sliders values / Match with variable names in Sliders' order
get_slider_properties = GetSliderProperties(Slider=get_selected_objects_2.ParamObjects)  # -> NickName, Value, Range, Type, DecimalPlaces
match_text = MatchText(Text=text_fragment, Pattern=graft(get_slider_properties.NickName), Case=True)

# ---- group: From CSV file to correct sliders values / Order of CSV index as in Sliders
list_indices = ListIndices(List=match_text)
cull_pattern = CullPattern(List=list_indices, CullPattern=match_text)  # -> flatten(List)

# ----
# Unlock the trigger for updating the slider values
trial_no = Slider(91, range=0..119)
view_bolts = BooleanToggle(True)
hide_show_object_preview_5 = HideShowObjectPreview(Visible=view_bolts, AllObjects_Object=[custom_preview_8, text_tag])

# ---- group: From CSV file to correct sliders values / Retrieve from Trial ID
list_item_2 = ListItem(List=read_csv.Values, Index=trial_no, Wrap=True)  # -> flatten(Item)

# ---- group: From CSV file to correct sliders values / Reorder variable values
list_item_3 = ListItem(List=list_item_2, Index=panel_11, Wrap=True)
list_item_4 = ListItem(List=list_item_3, Index=cull_pattern, Wrap=True)

# ----
set_slider_properties_5 = SetSliderProperties(Slider=get_selected_objects_2.ParamObjects, Value=list_item_4, Range=entwine_5, Type=entwine_4)  # disabled

# ----
# Bolt placement closest to block centroid or spreaded and visualisation:
filter_bolts_by_number = FilterBoltsByNumber(
    available_bolt_lines=available_bolt_lines.available_bolt_lines_2,
    swedge_slope_face_mesh=swedge_model_and_geometries.slope_face_mesh_2,
    number_of_bolts_each_length=num)  # -> bolt_lines_2, bolt_shank_2, bolt_plates_2, bolt_length_label_text_2, bolt_start_points_2
colour_picker_8 = ColourPicker(PickedColour=RGB(0, 0, 0))
text_tag = TextTag(
    Location=filter_bolts_by_number.bolt_start_points_2,
    Text=filter_bolts_by_number.bolt_length_label_text_2,
    Colour="White")

# ---- group: Calculated convex hull 2D area from bolting start points (continued)
bolt_start_points = Point(filter_bolts_by_number.bolt_start_points_2)
convex_hull = ConvexHull(Points=flatten(bolt_start_points), Plane=is_planar.Plane)  # -> Hull, HullZ, Indices
brep = Brep(convex_hull.Hull)
area_2 = Area(Geometry=brep)  # -> Area, Centroid
convex_hull_2d_area = Number(area_2.Area)

# ---- group: Calculate embedment length (continued)
bolt_lines_2 = Line(filter_bolts_by_number.bolt_lines_2)
brep_line = BrepLine(Brep=brep_join.Breps, Line=flatten(bolt_lines_2), LimitToFirst=False)  # -> Curves, flatten(Points)
end_points_2 = EndPoints(Curve=flatten(bolt_lines_2))  # -> Start, End
line = Line(StartPoint=brep_line.Points, EndPoint=end_points_2.End)
length_2 = Length(Curve=line)
larger_than = LargerThan(FirstNumber=length_2, SecondNumber="1")  # -> LargerThan, OrEqualTo
mass_multiplication = MassMultiplication(Input=larger_than.OrEqualTo)  # -> Result, PartialResults
mass_addition_4 = MassAddition(Input=length_2)  # -> Result, PartialResults
check_embedment_length_1_m = Integer(mass_multiplication.Result)
total_anchoring_length = Number(mass_addition_4.Result)
division = Division(A=total_anchoring_length, B=mass_addition_3.Result)
effective_anchoring_length = Number(division)

# ----
construct_fish_attribute = ConstructFishAttribute(
    Constraint=subtraction_5,
    FS=wedge_new_fs_system_basal_2.fs_system_2,
    Bolt_plunge=bolt_rotation.plunge_2,
    Bolt_trend=bolt_rotation.trend_2,
    Bolt_2_num=explode_tree_4.Branch0,
    Bolt_3_num=explode_tree_4.Branch1,
    Bolt_4_num=explode_tree_4.Branch2,
    Bolt_5_num=explode_tree_4.Branch3,
    Bolt_6_num=explode_tree_4.Branch4,
    Bolt_7_num=explode_tree_4.Branch5,
    Bolt_8_num=explode_tree_4.Branch6,
    Tot_bolt_num=mass_addition_3.Result,
    Tot_anchoring_length=total_anchoring_length,
    Eff_anchoring_length=effective_anchoring_length,
    Anchoring_length_passed=check_embedment_length_1_m,
    Convex_hull_area=convex_hull_2d_area)
panel_12 = Panel(construct_fish_attribute)

tunny = Tunny(
    Variables=[bolt_vertical_rotation_deg, bolt_horizontal_rotation_deg, bolt_2_num, bolt_3_num, bolt_4_num, bolt_5_num, bolt_6_num, bolt_7_num, bolt_8_num, bolt_diameter_class, bolt_min_spacing_m],
    Objectives=[minfs, co2, hours],
    Attributes=construct_fish_attribute)

# ----
# 7. SAVING & EXPORTING RESULTS
fish = Fish(tunny)

# ---- group: Exporting Fish data to .csv (continued)
fish_to_csv = FishToCSV(fish=fish)  # -> flatten(csv_string_2)
c_write_to_csv = CSharpScript(save=save_to_csv, path=concatenate, data=fish_to_csv)  # inputs save: Boolean, path: String, data: list of String; same code as c_write_to_csv
update_csv_fie_with_pareto_booleans = UpdateCSVFieWithParetoBooleans(fish_paretosolutions=tunny, csv_file_path=concatenate, update_csv_with_pareto_booleans=save_pareto_solutions_to_csv)

# ----
mesh_3 = Mesh([filter_bolts_by_number.bolt_shank_2, filter_bolts_by_number.bolt_plates_2])

custom_preview_8 = CustomPreview(Geometry=mesh_3, Material=colour_picker_8)

# ==== cluster VolumeCalculation
patch_surface = ClusterInput()
point_cloud = ClusterInput()
_1_left_sliding_plane_from_surface = ClusterInput()
_2_left_sliding_plane_from_obj_mesh = ClusterInput()
_0_left_sliding_plane_from_curve_s = ClusterInput()
clip_lower_boundary = ClusterInput()
point_in_wedge = ClusterInput()
top_trim_domain_start = ClusterInput()
top_trim_domain_end = ClusterInput()
clip_lower_boundary_2 = Boolean(clip_lower_boundary)
point_in_wedge_2 = Point(point_in_wedge)
_3_tension_crack_from_one_curve_to_verti = ClusterInput()  # "3: Tension crack from one curve to vertical cutter"
top_trim_domain_start_2 = Number(top_trim_domain_start)
_4_tension_crack_plane_surface = ClusterInput()
top_trim_domain_end_2 = Number(top_trim_domain_end)
_5_tension_crack_from_obj_mesh = ClusterInput()
_7_right_sliding_plane_from_plane_surfac = ClusterInput()  # "7: Right sliding plane from plane surface"
_8_right_sliding_plane_from_obj_mesh = ClusterInput()
_6_right_sliding_plane_from_curves = ClusterInput()
_9_other_cutting_planes_from_curve_s_to = ClusterInput()  # "9: Other cutting planes from curve(s) to cutter(s)"
_10_other_cutting_planar_surface_s_to_cu = ClusterInput()  # "10. Other cutting planar surface(s) to cutters"
_11_other_plannar_surface_s_from_obj_mes = ClusterInput()  # "11.Other plannar surface(s) from OBJ MESH to cutter(s)"
patch_surface_2 = Brep(patch_surface)

# ----
# Step 1: Import Point Cloud and cutters and select
# Only one type of geometry
point_cloud_2 = Cloud(point_cloud)
# Only one type of geometry
_0_left_sliding_plane_from_curve_s_2 = Curve(_0_left_sliding_plane_from_curve_s)
_1_left_sliding_plane_from_surface_2 = Surface(_1_left_sliding_plane_from_surface)
_2_left_sliding_plane_from_obj_mesh_2 = Mesh(_2_left_sliding_plane_from_obj_mesh)
# Only one type of geometry
_3_tension_crack_from_one_curve_to_verti_2 = Curve(_3_tension_crack_from_one_curve_to_verti)  # "3: Tension crack from one curve to vertical cutter"
_4_tension_crack_plane_surface_2 = Surface(_4_tension_crack_plane_surface)
_5_tension_crack_from_obj_mesh_2 = Mesh(_5_tension_crack_from_obj_mesh)
_7_right_sliding_plane_from_plane_surfac_2 = Surface(_7_right_sliding_plane_from_plane_surfac)  # "7: Right sliding plane from plane surface"
_8_right_sliding_plane_from_obj_mesh_2 = Mesh(_8_right_sliding_plane_from_obj_mesh)
# Only one type of geometry
_6_right_sliding_plane_from_curves_2 = Curve(_6_right_sliding_plane_from_curves)
_10_other_cutting_planar_surface_s_to_cu_2 = Surface(_10_other_cutting_planar_surface_s_to_cu)  # "10. Other cutting planar surface(s) to cutters"
_11_other_plannar_surface_s_from_obj_mes_2 = Mesh(_11_other_plannar_surface_s_from_obj_mes)  # "11.Other plannar surface(s) from OBJ MESH to cutter(s)"
_9_other_cutting_planes_from_curve_s_to_2 = Curve(_9_other_cutting_planes_from_curve_s_to)  # "9: Other cutting planes from curve(s) to cutter(s)"

# ---- group: Get lower bounding XY plane from cutters' geometry
bounding_rectangle = BoundingRectangle(
    Geometry=flatten([_0_left_sliding_plane_from_curve_s_2, _1_left_sliding_plane_from_surface_2, _2_left_sliding_plane_from_obj_mesh_2, _3_tension_crack_from_one_curve_to_verti_2, _4_tension_crack_plane_surface_2, _5_tension_crack_from_obj_mesh_2, _6_right_sliding_plane_from_curves_2, _7_right_sliding_plane_from_plane_surfac_2, _8_right_sliding_plane_from_obj_mesh_2]),
    Plane=PlaneXY(0, 0, 0),
    Axis=0,
    Slide=0,
    Union=True)  # -> Bounding, DimensionX, DimensionY
lower_bounding_xy_plane = Plane(bounding_rectangle.Bounding)

# ----
# 2. Left sliding plane OBJ MESH to cutter
_2_left_sliding_plane_from_obj_mesh_3 = Mesh(_2_left_sliding_plane_from_obj_mesh_2)
face_normals = FaceNormals(Mesh=_2_left_sliding_plane_from_obj_mesh_3)  # -> Centers, Normals
list_item = ListItem(List=face_normals.Centers, Index="0", Wrap=True)
list_item_2 = ListItem(List=face_normals.Normals, Index="0", Wrap=True)
plane_normal = PlaneNormal(Origin=list_item, ZAxis=list_item_2)  # -> simplify(flatten(Plane))
sliding_plane = Plane(plane_normal)
bounding_rectangle_2 = BoundingRectangle(Geometry=graft(_2_left_sliding_plane_from_obj_mesh_3), Plane=graft(sliding_plane), Axis=0, Slide=0, Union=True)  # -> flatten(Bounding), DimensionX, DimensionY
deconstruct_brep = DeconstructBrep(Brep=bounding_rectangle_2.Bounding)  # -> Faces, Edges, Vertices
graft_tree = GraftTree(Tree=deconstruct_brep.Vertices, IncludeEmptyLists=True, IncludeNullItems=True)
split_tree = SplitTree(Data=graft_tree, Masks=flatten("{?;?;1}"))  # -> Positive, Negative
split_tree_2 = SplitTree(Data=graft_tree, Masks=flatten("{?;?;0}"))  # -> Positive, Negative
split_tree_3 = SplitTree(Data=graft_tree, Masks=flatten("{?;?;2}"))  # -> Positive, Negative
split_tree_4 = SplitTree(Data=graft_tree, Masks=flatten("{?;?;3}"))  # -> Positive, Negative
_4point_surface = _4PointSurface(CornerA=split_tree_2.Positive, CornerB=split_tree.Positive, CornerC=split_tree_3.Positive, CornerD=split_tree_4.Positive)  # -> flatten(Surface)
area = Area(Geometry=_4point_surface)  # -> Area, Centroid
scale = Scale(Geometry=_4point_surface, Center=area.Centroid, Factor=Slider(100, range=0..100))  # -> Geometry, Transform
left_sliding_plane_cutter_from_obj_mesh = Surface(scale.Geometry)

# ----
# 1. Left sliding plane surface to cutter
_1_left_sliding_plane_from_surface_3 = Surface(_1_left_sliding_plane_from_surface_2)
area_2 = Area(Geometry=_1_left_sliding_plane_from_surface_3)  # -> Area, Centroid
scale_2 = Scale(Geometry=_1_left_sliding_plane_from_surface_3, Center=area_2.Centroid, Factor=Slider(100, range=0..100))  # -> Geometry, Transform
left_sliding_plane_cutter_from_plane_sur = Surface(scale_2.Geometry)  # "Left sliding plane cutter from plane surfaces"

# ----
# 5. Tension crack from OBJ MESH to cutter
_5_tension_crack_from_obj_mesh_3 = Mesh(_5_tension_crack_from_obj_mesh_2)
face_normals_2 = FaceNormals(Mesh=_5_tension_crack_from_obj_mesh_3)  # -> Centers, Normals
list_item_3 = ListItem(List=face_normals_2.Centers, Index="0", Wrap=True)
list_item_4 = ListItem(List=face_normals_2.Normals, Index="0", Wrap=True)
plane_normal_2 = PlaneNormal(Origin=list_item_3, ZAxis=list_item_4)  # -> simplify(flatten(Plane))
sliding_plane_2 = Plane(plane_normal_2)
bounding_rectangle_3 = BoundingRectangle(Geometry=graft(_5_tension_crack_from_obj_mesh_3), Plane=graft(sliding_plane_2), Axis=0, Slide=0, Union=True)  # -> flatten(Bounding), DimensionX, DimensionY
deconstruct_brep_2 = DeconstructBrep(Brep=bounding_rectangle_3.Bounding)  # -> Faces, Edges, Vertices
graft_tree_2 = GraftTree(Tree=deconstruct_brep_2.Vertices, IncludeEmptyLists=True, IncludeNullItems=True)
split_tree_5 = SplitTree(Data=graft_tree_2, Masks=flatten("{?;?;1}"))  # -> Positive, Negative
split_tree_6 = SplitTree(Data=graft_tree_2, Masks=flatten("{?;?;0}"))  # -> Positive, Negative
split_tree_7 = SplitTree(Data=graft_tree_2, Masks=flatten("{?;?;2}"))  # -> Positive, Negative
split_tree_8 = SplitTree(Data=graft_tree_2, Masks=flatten("{?;?;3}"))  # -> Positive, Negative
_4point_surface_2 = _4PointSurface(
    CornerA=split_tree_6.Positive,
    CornerB=split_tree_5.Positive,
    CornerC=split_tree_7.Positive,
    CornerD=split_tree_8.Positive)  # -> flatten(Surface)
area_3 = Area(Geometry=_4point_surface_2)  # -> Area, Centroid
scale_3 = Scale(Geometry=_4point_surface_2, Center=area_3.Centroid, Factor=Slider(100, range=0..100))  # -> Geometry, Transform
tension_crack_cutter_from_obj_mesh = Surface(scale_3.Geometry)

# ----
# 3: Vertical tension crack to be defined by a curve
_3_curve_to_vertical_surface = Curve(_3_tension_crack_from_one_curve_to_verti_2)
number_slider = Slider(100, range=0..100)
extend_curve = ExtendCurve(Curve=_3_curve_to_vertical_surface, Type="0", Start=number_slider, End=number_slider)
unit_z = UnitZ(Factor=number_slider)
curve = Curve(extend_curve)
negative = Negative(Value=unit_z)
move = Move(Geometry=curve, Motion=unit_z)  # -> Geometry, Transform
move_2 = Move(Geometry=curve, Motion=negative)  # -> Geometry, Transform
merge = Merge(Data1=move.Geometry, Data2=move_2.Geometry)
loft = Loft(Curves=merge, Options={Adjust=False, Closed=False, LoftEnds=0, LoftSimp=0, LoftType=0, Rebuild=10, Refit=0.01})
tension_crack_cutter_from_curve = Surface(loft)

# ----
# 4. Tension crack plane surface to cutter
_4_tension_crack_plane_surface_3 = Surface(_4_tension_crack_plane_surface_2)
area_4 = Area(Geometry=_4_tension_crack_plane_surface_3)  # -> Area, Centroid
scale_4 = Scale(Geometry=_4_tension_crack_plane_surface_3, Center=area_4.Centroid, Factor=Slider(100, range=0..100))  # -> Geometry, Transform
tension_crack_cutters_from_plane_surface = Surface(scale_4.Geometry)

# ----
# 8.Right sliding plane from OBJ MESH to cutter
_8_right_sliding_plane_from_obj_mesh_3 = Mesh(_8_right_sliding_plane_from_obj_mesh_2)
face_normals_3 = FaceNormals(Mesh=_8_right_sliding_plane_from_obj_mesh_3)  # -> Centers, Normals
list_item_5 = ListItem(List=face_normals_3.Centers, Index="0", Wrap=True)
list_item_6 = ListItem(List=face_normals_3.Normals, Index="0", Wrap=True)
plane_normal_3 = PlaneNormal(Origin=list_item_5, ZAxis=list_item_6)  # -> simplify(flatten(Plane))
sliding_plane_3 = Plane(plane_normal_3)
bounding_rectangle_4 = BoundingRectangle(Geometry=graft(_8_right_sliding_plane_from_obj_mesh_3), Plane=graft(sliding_plane_3), Axis=0, Slide=0, Union=True)  # -> flatten(Bounding), DimensionX, DimensionY
deconstruct_brep_3 = DeconstructBrep(Brep=bounding_rectangle_4.Bounding)  # -> Faces, Edges, Vertices
graft_tree_3 = GraftTree(Tree=deconstruct_brep_3.Vertices, IncludeEmptyLists=True, IncludeNullItems=True)
split_tree_9 = SplitTree(Data=graft_tree_3, Masks=flatten("{?;?;1}"))  # -> Positive, Negative
split_tree_10 = SplitTree(Data=graft_tree_3, Masks=flatten("{?;?;0}"))  # -> Positive, Negative
split_tree_11 = SplitTree(Data=graft_tree_3, Masks=flatten("{?;?;2}"))  # -> Positive, Negative
split_tree_12 = SplitTree(Data=graft_tree_3, Masks=flatten("{?;?;3}"))  # -> Positive, Negative
_4point_surface_3 = _4PointSurface(
    CornerA=split_tree_10.Positive,
    CornerB=split_tree_9.Positive,
    CornerC=split_tree_11.Positive,
    CornerD=split_tree_12.Positive)  # -> flatten(Surface)
area_5 = Area(Geometry=_4point_surface_3)  # -> Area, Centroid
scale_5 = Scale(Geometry=_4point_surface_3, Center=area_5.Centroid, Factor=Slider(100, range=0..100))  # -> Geometry, Transform
other_cutter_s_from_obj_mesh = Surface(scale_5.Geometry)

# ----
# 7. Right sliding plane surface to cutter
_7_right_sliding_plane_from_plane_surfac_3 = Surface(_7_right_sliding_plane_from_plane_surfac_2)  # "7. Right sliding plane from plane surface"
area_6 = Area(Geometry=_7_right_sliding_plane_from_plane_surfac_3)  # -> Area, Centroid
scale_6 = Scale(Geometry=_7_right_sliding_plane_from_plane_surfac_3, Center=area_6.Centroid, Factor=Slider(100, range=0..100))  # -> Geometry, Transform
other_cutters_from_plane_surface_s = Surface(scale_6.Geometry)

# ----
# 11.Other plannar surface(s) from OBJ MESH to cutter(s)
_11_other_plannar_surface_s_from_obj_mes_3 = Mesh(_11_other_plannar_surface_s_from_obj_mes_2)  # "11.Other plannar surface(s) from OBJ MESH to cutter(s)"
face_normals_4 = FaceNormals(Mesh=_11_other_plannar_surface_s_from_obj_mes_3)  # -> Centers, Normals
list_item_7 = ListItem(List=face_normals_4.Centers, Index="0", Wrap=True)
list_item_8 = ListItem(List=face_normals_4.Normals, Index="0", Wrap=True)
plane_normal_4 = PlaneNormal(Origin=list_item_7, ZAxis=list_item_8)  # -> simplify(flatten(Plane))
sliding_plane_4 = Plane(plane_normal_4)
bounding_rectangle_5 = BoundingRectangle(Geometry=graft(_11_other_plannar_surface_s_from_obj_mes_3), Plane=graft(sliding_plane_4), Axis=0, Slide=0, Union=True)  # -> flatten(Bounding), DimensionX, DimensionY
deconstruct_brep_4 = DeconstructBrep(Brep=bounding_rectangle_5.Bounding)  # -> Faces, Edges, Vertices
graft_tree_4 = GraftTree(Tree=deconstruct_brep_4.Vertices, IncludeEmptyLists=True, IncludeNullItems=True)
split_tree_13 = SplitTree(Data=graft_tree_4, Masks=flatten("{?;?;1}"))  # -> Positive, Negative
split_tree_14 = SplitTree(Data=graft_tree_4, Masks=flatten("{?;?;0}"))  # -> Positive, Negative
split_tree_15 = SplitTree(Data=graft_tree_4, Masks=flatten("{?;?;2}"))  # -> Positive, Negative
split_tree_16 = SplitTree(Data=graft_tree_4, Masks=flatten("{?;?;3}"))  # -> Positive, Negative
_4point_surface_4 = _4PointSurface(
    CornerA=split_tree_14.Positive,
    CornerB=split_tree_13.Positive,
    CornerC=split_tree_15.Positive,
    CornerD=split_tree_16.Positive)  # -> flatten(Surface)
area_7 = Area(Geometry=_4point_surface_4)  # -> Area, Centroid
scale_7 = Scale(Geometry=_4point_surface_4, Center=area_7.Centroid, Factor=Slider(100, range=0..100))  # -> Geometry, Transform
other_cutter_s_from_obj_mesh_2 = Surface(scale_7.Geometry)

# ----
# 10. Other cutting planar surface(s) to cutters
_10_other_cutting_planar_surface_s_to_cu_3 = Surface(_10_other_cutting_planar_surface_s_to_cu_2)  # "10. Other cutting planar surface(s) to cutters"
area_8 = Area(Geometry=_10_other_cutting_planar_surface_s_to_cu_3)  # -> Area, Centroid
scale_8 = Scale(Geometry=_10_other_cutting_planar_surface_s_to_cu_3, Center=area_8.Centroid, Factor=Slider(100, range=0..100))  # -> Geometry, Transform
other_cutters_from_plane_surface_s_2 = Surface(scale_8.Geometry)

# ----
# 0-1. Input data Warnings
# Input left sliding plane geometry data warnings
# Input tension crack geometry data warnings
# Input right sliding plane geometry data warnings
# Input tension crack geometry data warnings
null_item = NullItem(Item=_1_left_sliding_plane_from_surface_2)  # -> NullFlags, InvalidFlags, Description
null_item_2 = NullItem(Item=_0_left_sliding_plane_from_curve_s_2)  # -> NullFlags, InvalidFlags, Description
null_item_3 = NullItem(Item=_2_left_sliding_plane_from_obj_mesh_2)  # -> NullFlags, InvalidFlags, Description
null_item_4 = NullItem(Item=_4_tension_crack_plane_surface_2)  # -> NullFlags, InvalidFlags, Description
null_item_5 = NullItem(Item=_3_tension_crack_from_one_curve_to_verti_2)  # -> NullFlags, InvalidFlags, Description
null_item_6 = NullItem(Item=_5_tension_crack_from_obj_mesh_2)  # -> NullFlags, InvalidFlags, Description
null_item_7 = NullItem(Item=_10_other_cutting_planar_surface_s_to_cu_2)  # -> NullFlags, InvalidFlags, Description
null_item_8 = NullItem(Item=_9_other_cutting_planes_from_curve_s_to_2)  # -> NullFlags, InvalidFlags, Description
null_item_9 = NullItem(Item=_11_other_plannar_surface_s_from_obj_mes_2)  # -> NullFlags, InvalidFlags, Description
null_item_10 = NullItem(Item=_7_right_sliding_plane_from_plane_surfac_2)  # -> NullFlags, InvalidFlags, Description
null_item_11 = NullItem(Item=_6_right_sliding_plane_from_curves_2)  # -> NullFlags, InvalidFlags, Description
null_item_12 = NullItem(Item=_8_right_sliding_plane_from_obj_mesh_2)  # -> NullFlags, InvalidFlags, Description

first_last = FirstLast(List=null_item_2.NullFlags)  # -> FirstValue, LastValue
first_last_2 = FirstLast(List=null_item_5.NullFlags)  # -> FirstValue, LastValue
first_last_3 = FirstLast(List=null_item_4.NullFlags)  # -> FirstValue, LastValue
first_last_4 = FirstLast(List=null_item.NullFlags)  # -> FirstValue, LastValue
first_last_5 = FirstLast(List=null_item_6.NullFlags)  # -> FirstValue, LastValue
first_last_6 = FirstLast(List=null_item_3.NullFlags)  # -> FirstValue, LastValue
first_last_7 = FirstLast(List=null_item_8.NullFlags)  # -> FirstValue, LastValue
first_last_8 = FirstLast(List=null_item_7.NullFlags)  # -> FirstValue, LastValue
first_last_9 = FirstLast(List=null_item_9.NullFlags)  # -> FirstValue, LastValue
first_last_10 = FirstLast(List=null_item_11.NullFlags)  # -> FirstValue, LastValue
first_last_11 = FirstLast(List=null_item_10.NullFlags)  # -> FirstValue, LastValue
first_last_12 = FirstLast(List=null_item_12.NullFlags)  # -> FirstValue, LastValue
merge_2 = Merge(Data1=first_last_2.FirstValue, Data2=first_last_3.FirstValue, Data3=first_last_5.FirstValue)
merge_3 = Merge(Data1=first_last_7.FirstValue, Data2=first_last_8.FirstValue, Data3=first_last_9.FirstValue)
merge_4 = Merge(Data1=first_last_10.FirstValue, Data2=first_last_11.FirstValue, Data3=first_last_12.FirstValue)
text = Text("Select one type of geometry")
text_2 = Text("Select one type of geometry if applicable")
text_3 = Text("OK!")
text_4 = Text("Set only one type of geometry")

merge_5 = Merge(Data1=first_last.FirstValue, Data2=first_last_4.FirstValue, Data3=first_last_6.FirstValue)
invert_boolean = InvertBoolean(Boolean=merge_3)  # -> Inverted, Number
invert_boolean_2 = InvertBoolean(Boolean=merge_5)  # -> Inverted, Number
invert_boolean_3 = InvertBoolean(Boolean=merge_2)  # -> Inverted, Number
invert_boolean_4 = InvertBoolean(Boolean=merge_4)  # -> Inverted, Number
mass_addition = MassAddition(Input=invert_boolean_2.Inverted)  # -> Result, PartialResults
mass_addition_2 = MassAddition(Input=invert_boolean_3.Inverted)  # -> Result, PartialResults
mass_addition_3 = MassAddition(Input=invert_boolean.Inverted)  # -> Result, PartialResults
mass_addition_4 = MassAddition(Input=invert_boolean_4.Inverted)  # -> Result, PartialResults
stream_filter = StreamFilter(Gate=mass_addition_2.Result, Stream0=text_2, Stream1=text_3, Stream2=text_4, Stream3=text_4)
stream_filter_2 = StreamFilter(Gate=mass_addition.Result, Stream0=text, Stream1=text_3, Stream2=text_4, Stream3=text_4)
stream_filter_3 = StreamFilter(Gate=mass_addition_3.Result, Stream0=text_2, Stream1=text_3, Stream2=text_4, Stream3=text_4)
stream_filter_4 = StreamFilter(Gate=mass_addition_4.Result, Stream0=text, Stream1=text_3, Stream2=text_4, Stream3=text_4)
number_of_tension_crack_input_geometries = Integer(mass_addition_2.Result)
tension_crack_geometry = Panel(stream_filter)
other_cutter_plane_geometry = Panel(stream_filter_3)
sliding_plane_geometry = Panel(stream_filter_2)
sliding_plane_geometry_2 = Panel(stream_filter_4)

number_of_right_sliding_plane_geometry = Panel(sliding_plane_geometry_2)
other_cutter_plane_geometry_2 = Panel(other_cutter_plane_geometry)

check_number_of_other_cutting_plane_geom = Text(stream_filter_3)  # "Check: Number of other cutting plane geometry"

check_number_of_left_sliding_plane_geome = Text(stream_filter_2)  # "Check: number of left sliding plane geometry"
check_number_of_right_sliding_plane_geom = Text(stream_filter_4)  # "Check: Number of right sliding plane geometry"
check_tension_crack_geometry = Text(stream_filter)
check_number_of_right_sliding_plane_geom_2 = ClusterOutput(check_number_of_right_sliding_plane_geom)  # "Check: Number of right sliding plane geometry"
check_number_of_left_sliding_plane_geome_2 = ClusterOutput(check_number_of_left_sliding_plane_geome)  # "Check: number of left sliding plane geometry"
check_tension_crack_geometry_2 = ClusterOutput(check_tension_crack_geometry)
check_number_of_other_cutting_plane_geom_2 = ClusterOutput(check_number_of_other_cutting_plane_geom)  # "Check: Number of other cutting plane geometry"

# ----
# 0: Left sliding plane from curve(s) to one cutter
_0_left_sliding_plane_from_curve_s_3 = Curve(_0_left_sliding_plane_from_curve_s_2)
divide_curve = DivideCurve(Curve=_0_left_sliding_plane_from_curve_s_3, Count=Slider(50, range=0..100), Kinks=False)  # -> Points, Tangents, Parameters

# ----
# Flattened curve points to form only one cutter
plane_fit = PlaneFit(Points=flatten(divide_curve.Points))  # -> Plane, Deviation

bounding_box = BoundingBox(Content=divide_curve.Points, Plane=plane_fit.Plane, UnionBox=True)  # -> Box, Box_2
box_properties = BoxProperties(Box=bounding_box.Box)  # -> Center, Diagonal, Area, Volume, Degeneracy
square_root = SquareRoot(Value=box_properties.Area)
deconstruct_plane = DeconstructPlane(Plane=plane_fit.Plane)  # -> Origin, XAxis, YAxis, ZAxis
move_to_point = MoveToPoint(Geometry=plane_fit.Plane, PointA=deconstruct_plane.Origin, PointB=box_properties.Center)  # -> Moved, Vector, Transform
negative_2 = Negative(Value=square_root)
construct_domain = ConstructDomain(DomainStart=negative_2, DomainEnd=square_root)
plane_surface = PlaneSurface(Plane=move_to_point.Moved, XSize=construct_domain, YSize=construct_domain)
surface = Surface(flatten(plane_surface))
area_9 = Area(Geometry=surface)  # -> Area, Centroid
scale_9 = Scale(Geometry=surface, Center=area_9.Centroid, Factor=Slider(100, range=0..100))  # -> Geometry, Transform
left_sliding_plane_cutter_from_curve_s = Surface(flatten(scale_9.Geometry))

# ----
# 6: Right sliding plane from curve(s) to one cutter
_6_right_sliding_plane_from_curve_s = Curve(_6_right_sliding_plane_from_curves_2)
divide_curve_2 = DivideCurve(Curve=_6_right_sliding_plane_from_curve_s, Count=Slider(50, range=0..100), Kinks=False)  # -> Points, Tangents, Parameters

# ----
# Flattened curve points to form only one cutter
plane_fit_2 = PlaneFit(Points=flatten(divide_curve_2.Points))  # -> Plane, Deviation

bounding_box_2 = BoundingBox(Content=divide_curve_2.Points, Plane=plane_fit_2.Plane, UnionBox=True)  # -> Box, Box_2
box_properties_2 = BoxProperties(Box=bounding_box_2.Box)  # -> Center, Diagonal, Area, Volume, Degeneracy
deconstruct_plane_2 = DeconstructPlane(Plane=plane_fit_2.Plane)  # -> Origin, XAxis, YAxis, ZAxis
move_to_point_2 = MoveToPoint(Geometry=plane_fit_2.Plane, PointA=deconstruct_plane_2.Origin, PointB=box_properties_2.Center)  # -> Moved, Vector, Transform
square_root_2 = SquareRoot(Value=box_properties_2.Area)
negative_3 = Negative(Value=square_root_2)
construct_domain_2 = ConstructDomain(DomainStart=negative_3, DomainEnd=square_root_2)
plane_surface_2 = PlaneSurface(Plane=move_to_point_2.Moved, XSize=construct_domain_2, YSize=construct_domain_2)
surface_2 = Surface(flatten(plane_surface_2))
area_10 = Area(Geometry=surface_2)  # -> Area, Centroid
scale_10 = Scale(Geometry=surface_2, Center=area_10.Centroid, Factor=Slider(100, range=0..100))  # -> Geometry, Transform
other_cutters_from_curve_s = Surface(flatten(scale_10.Geometry))

# ----
# 9: Other cutting planes from curve(s) to cutter(s)
number_slider_2 = Slider(50, range=0..100)
_9_other_cutting_planes_from_curve_s_to_3 = Curve(_9_other_cutting_planes_from_curve_s_to_2)  # "9: Other cutting planes from curve(s) to cutter(s)"
divide_curve_3 = DivideCurve(Curve=_9_other_cutting_planes_from_curve_s_to_3, Count=number_slider_2, Kinks=False)  # -> Points, Tangents, Parameters

# ----
# Flattened curve points to form only one cutter
plane_fit_3 = PlaneFit(Points=divide_curve_3.Points)  # -> Plane, Deviation

bounding_box_3 = BoundingBox(Content=divide_curve_3.Points, Plane=plane_fit_3.Plane, UnionBox=True)  # -> Box, Box_2
box_properties_3 = BoxProperties(Box=bounding_box_3.Box)  # -> Center, Diagonal, Area, Volume, Degeneracy
deconstruct_plane_3 = DeconstructPlane(Plane=plane_fit_3.Plane)  # -> Origin, XAxis, YAxis, ZAxis
move_to_point_3 = MoveToPoint(Geometry=plane_fit_3.Plane, PointA=deconstruct_plane_3.Origin, PointB=box_properties_3.Center)  # -> Moved, Vector, Transform
square_root_3 = SquareRoot(Value=box_properties_3.Area)
negative_4 = Negative(Value=square_root_3)
construct_domain_3 = ConstructDomain(DomainStart=negative_4, DomainEnd=square_root_3)
plane_surface_3 = PlaneSurface(Plane=move_to_point_3.Moved, XSize=construct_domain_3, YSize=construct_domain_3)
surface_3 = Surface(flatten(plane_surface_3))
area_11 = Area(Geometry=surface_3)  # -> Area, Centroid
scale_11 = Scale(Geometry=surface_3, Center=area_11.Centroid, Factor=Slider(100, range=0..100))  # -> Geometry, Transform
other_cutters_from_curve_s_2 = Surface(flatten(scale_11.Geometry))

# ----
# - Box 0 = 6 = 9
# - Box 3 is unique since it is set to form a vertical curve by default.
# - Box 1 = 4=7
# - Box 10 different curves to form different surfaces
# - Box 2=5=8=11
# 1-2. Creating cutter surfaces
merge_6 = Merge(
    Data1=left_sliding_plane_cutter_from_curve_s,
    Data2=left_sliding_plane_cutter_from_plane_sur,
    Data3=left_sliding_plane_cutter_from_obj_mesh)
merge_7 = Merge(
    Data1=tension_crack_cutter_from_curve,
    Data2=tension_crack_cutters_from_plane_surface,
    Data3=tension_crack_cutter_from_obj_mesh)
merge_8 = Merge(Data1=other_cutters_from_curve_s_2, Data2=other_cutters_from_plane_surface_s_2, Data3=other_cutter_s_from_obj_mesh_2)
merge_9 = Merge(Data1=other_cutters_from_curve_s, Data2=other_cutters_from_plane_surface_s, Data3=other_cutter_s_from_obj_mesh)
tension_crack_plane_brep = Brep(merge_7)
right_sliding_plane_brep = Brep(merge_9)
left_sliding_plane_brep = Brep(merge_6)
other_cutter_planes_brep = Brep(merge_8)

wedgevolume_cloud_cuttersurface2brep = WedgeVolume_Cloud_CutterSurface2Brep(
    patch_surface=patch_surface_2,
    cloud=point_cloud_2,
    point_in_wedge=point_in_wedge_2,
    leftjointsurface=left_sliding_plane_brep,
    rightjointsurface=right_sliding_plane_brep,
    tensioncracksurface=tension_crack_plane_brep,
    othertrimmingsurface_s=other_cutter_planes_brep,
    lower_bounding_xy_plane=lower_bounding_xy_plane,
    clip_lower_boundary=clip_lower_boundary_2,
    top_trim_domain_start=top_trim_domain_start_2,
    top_trim_domain_end=top_trim_domain_end_2)  # -> wedge_brep_3, left_joint_trimmed_cutter_brep_2, right_joint_trimmed_cutter_brep_2, tension_crack_trimmed_cutter_brep_2, other_joints_trimmed_cutter_brep_2, block_slope_surface_3

# ---- group: Get wedge bottom point
deconstruct_brep_5 = DeconstructBrep(Brep=wedgevolume_cloud_cuttersurface2brep.block_slope_surface_3)  # -> Faces, Edges, Vertices
deconstruct = Deconstruct(Point=deconstruct_brep_5.Vertices)  # -> XComponent, YComponent, ZComponent
sort_list = SortList(Keys=deconstruct.ZComponent, ValuesValuesA=deconstruct_brep_5.Vertices)  # -> Keys, ValuesValuesA
# Consider only the largest surfaces, dependent on number of geometry
# (if tension crack present = 4; if tension crack not present = 3).
first_last_13 = FirstLast(List=sort_list.ValuesValuesA)  # -> FirstValue, LastValue

# ----
brep_2_volume = Brep(wedgevolume_cloud_cuttersurface2brep.wedge_brep_3)
left_joint_trimmed_cutter_brep = Brep(wedgevolume_cloud_cuttersurface2brep.left_joint_trimmed_cutter_brep_2)
right_joint_trimmed_cutter_brep = Brep(wedgevolume_cloud_cuttersurface2brep.right_joint_trimmed_cutter_brep_2)
tension_crack_trimmed_cutter_brep = Brep(wedgevolume_cloud_cuttersurface2brep.tension_crack_trimmed_cutter_brep_2)
other_joints_trimmed_cutter_brep = Brep(wedgevolume_cloud_cuttersurface2brep.other_joints_trimmed_cutter_brep_2)
block_slope_surface = Surface(wedgevolume_cloud_cuttersurface2brep.block_slope_surface_3)
wedge_bottom_point = Point(first_last_13.FirstValue)
merge_10 = Merge(
    Data1=left_sliding_plane_brep,
    Data2=tension_crack_plane_brep,
    Data3=right_sliding_plane_brep,
    Data4=other_cutter_planes_brep)  # -> flatten(Result)
cutter_planes_brep = Brep(merge_10)
brep_2_volume_2 = ClusterOutput(brep_2_volume)
left_joint_trimmed_cutter_brep_2 = ClusterOutput(left_joint_trimmed_cutter_brep)
right_joint_trimmed_cutter_brep_2 = ClusterOutput(right_joint_trimmed_cutter_brep)
tension_crack_trimmed_cutter_brep_2 = ClusterOutput(tension_crack_trimmed_cutter_brep)
block_slope_surface_2 = ClusterOutput(block_slope_surface)
other_joints_trimmed_cutter_brep_2 = ClusterOutput(other_joints_trimmed_cutter_brep)
wedge_bottom_point_2 = ClusterOutput(wedge_bottom_point)
cutter_planes_brep_2 = ClusterOutput(cutter_planes_brep)

# ----
# 2-1. Calculate volume
brep_2_volume_3 = Brep(brep_2_volume)
volume = Volume(Geometry=brep_2_volume_3)  # -> Volume, Centroid
round_to_decimal_place = RoundToDecimalPlace(NumberX=volume.Volume, DecimalPlace="1", RoundType=0)  # -> Rounded, Difference

# ----
# Step 2: Calculate volume
volume_2 = Panel(volume.Volume)

volume_m3 = Number(round_to_decimal_place.Rounded)
wedge_centroid = Point(volume.Centroid)
volume_m3_2 = ClusterOutput(volume_m3)

wedge_centroid_2 = ClusterOutput(wedge_centroid)

# ==== cluster BakeWedgetoSublayers
wedge_id_integer = ClusterInput()
bake_to_sublayers = ClusterInput()
volume_m3 = ClusterInput()
block_slope_surface = ClusterInput()
block_right_sliding_mesh = ClusterInput()
block_left_sliding_mesh = ClusterInput()
brep_2_volume = ClusterInput()
block_tension_crack_mesh = ClusterInput()
bake_to_sublayers_2 = Boolean(bake_to_sublayers)
wedge_id_integer_2 = Integer(wedge_id_integer)
block_right_sliding_mesh_2 = Mesh(block_right_sliding_mesh)
block_left_sliding_mesh_2 = Mesh(block_left_sliding_mesh)
volume_m3_2 = Number(volume_m3)
brep_2_volume_2 = Brep(brep_2_volume)
block_tension_crack_mesh_2 = Mesh(block_tension_crack_mesh)

# ---- group: Dip/Dip Direction of joint surfaces
# Dip/Dip Directions
mesh_dip_dipdirection = MeshDipDipDirection(mesh=block_tension_crack_mesh_2)  # -> dip_deg_3, dip_direction_deg_2, dip_dipdirection_2
mesh_dip_dipdirection_2 = MeshDipDipDirection(mesh=block_right_sliding_mesh_2)  # -> dip_deg_3, dip_direction_deg_2, dip_dipdirection_2
mesh_dip_dipdirection_3 = MeshDipDipDirection(mesh=block_left_sliding_mesh_2)  # -> dip_deg_3, dip_direction_deg_2, dip_dipdirection_2
null_item = NullItem(Item=mesh_dip_dipdirection.dip_deg_3)  # -> NullFlags, InvalidFlags, Description
stream_filter = StreamFilter(Gate=null_item.NullFlags, Stream0=mesh_dip_dipdirection.dip_dipdirection_2)

# ----
rightjoint_dip_dipdirection = Text(mesh_dip_dipdirection_2.dip_dipdirection_2)
leftjoint_dip_dipdirection = Text(mesh_dip_dipdirection_3.dip_dipdirection_2)
block_slope_surface_2 = Surface(block_slope_surface)

# ----
# Bake to sublayers
bake_to_layer_wedgeblock_bake = Boolean(bake_to_sublayers_2)
concatenate = Concatenate(FragmentA=volume_m3_2, FragmentB="m3")
panel = Panel("""Solid 
LeftJoint 
RightJoint 
TensionCrack 
SlopeSurface 
SlopeCrestPoint """)
entwine = Entwine(
    Branch00=concatenate,
    Branch01=leftjoint_dip_dipdirection,
    Branch02=rightjoint_dip_dipdirection,
    Branch03=stream_filter,
    FlattenInputs=True)
concatenate_2 = Concatenate(FragmentA="Wedge", FragmentB=wedge_id_integer_2)
concatenate_3 = Concatenate(FragmentA=graft(panel), FragmentB=graft(entwine))  # -> flatten(Result)
concatenate_4 = Concatenate(B="Wedge", Fragment_A=wedge_id_integer_2, Fragment_B="::", A=concatenate_3)
stream_filter_2 = StreamFilter(Gate=bake_to_layer_wedgeblock_bake, Stream1=concatenate_4)
explode_tree = ExplodeTree(Data=graft(concatenate_3))  # -> Branch0, Branch1, Branch2, Branch3, Branch4, Branch5
create_modify_layers = CreateModifyLayers(LayerName=stream_filter_2, DeleteLayer=False, enableFullPath=True)  # -> LayerNames, LayerFullPath
explode_tree_2 = ExplodeTree(Data=graft(create_modify_layers.LayerFullPath))  # -> Branch0, Branch1, Branch2, Branch3, Branch4, Branch5
createattributes = CreateAttributes(Name=explode_tree.Branch3, LayerName=explode_tree_2.Branch2, Color=explode_tree_2.Branch3, enableFullPath=True)
createattributes_2 = CreateAttributes(Name=explode_tree.Branch4, LayerName=explode_tree_2.Branch4, enableFullPath=True)
createattributes_3 = CreateAttributes(Name=explode_tree.Branch0, LayerName=explode_tree_2.Branch0, enableFullPath=True)
createattributes_4 = CreateAttributes(Name=explode_tree.Branch2, LayerName=explode_tree_2.Branch2, enableFullPath=True)
createattributes_5 = CreateAttributes(Name=explode_tree.Branch5, LayerName=explode_tree_2.Branch5, enableFullPath=True)
createattributes_6 = CreateAttributes(Name=explode_tree.Branch1, LayerName=explode_tree_2.Branch1, enableFullPath=True)
bake_geometry = BakeGeometry(
    Bake=bake_to_layer_wedgeblock_bake,
    Geometry=block_tension_crack_mesh_2,
    Attributes=createattributes,
    DeleteOldBakes=False,
    PreserveTrees=False)
bake_geometry_2 = BakeGeometry(
    Bake=bake_to_layer_wedgeblock_bake,
    Geometry=brep_2_volume_2,
    Attributes=createattributes_3,
    DeleteOldBakes=False,
    PreserveTrees=False)
bake_geometry_3 = BakeGeometry(
    Bake=bake_to_layer_wedgeblock_bake,
    Geometry=block_left_sliding_mesh_2,
    Attributes=createattributes_6,
    DeleteOldBakes=False,
    PreserveTrees=False)
bake_geometry_4 = BakeGeometry(
    Bake=bake_to_layer_wedgeblock_bake,
    Geometry=block_right_sliding_mesh_2,
    Attributes=createattributes_4,
    DeleteOldBakes=False,
    PreserveTrees=False)
bake_geometry_5 = BakeGeometry(Bake=bake_to_layer_wedgeblock_bake, Attributes=createattributes_5, DeleteOldBakes=False, PreserveTrees=False)
bake_geometry_6 = BakeGeometry(
    Bake=bake_to_layer_wedgeblock_bake,
    Geometry=block_slope_surface_2,
    Attributes=createattributes_2,
    DeleteOldBakes=False,
    PreserveTrees=False)

# ==== cluster WriteToSWedge
scale_wedge_with_volume = ClusterInput()
write_to_excel_template = ClusterInput()
file_path = ClusterInput()
wedgeid = ClusterInput()
file_path_2 = FilePath(file_path)
write_to_excel_template_2 = Boolean(write_to_excel_template)
wedgeid_2 = Integer(wedgeid)
scale_wedge_with_volume_2 = Boolean(scale_wedge_with_volume)
addition = Addition(A=wedgeid_2, B="5")

# ----
# SLOPE
tension_crack_dipdirection = ClusterInput()
upper_face_dip_direction = ClusterInput()
tension_crack_dip = ClusterInput()
rock_unit_weight = ClusterInput()
upper_face_dip = ClusterInput()
slope_dip = ClusterInput()
slope_dip_direction = ClusterInput()
wedge_height = ClusterInput()
tension_crack_dip_2 = Data(tension_crack_dip)
tension_crack_dipdirection_2 = Data(tension_crack_dipdirection)
column_start_position = Panel("1")
null_values = NullValues(LastSaveLocalization="neutral,N")  # -> Null, NaN, Infinity, Infinity_2
wedge_height_2 = Data(wedge_height)
upper_face_dip_direction_2 = Data(upper_face_dip_direction)
upper_face_dip_2 = Data(upper_face_dip)
slope_dip_direction_2 = Data(slope_dip_direction)
excel_worksheet = Panel("2")
slope_dip_2 = Data(slope_dip)
rock_unit_weight_2 = Number(rock_unit_weight)
concatenate = Concatenate(FragmentA="Wedge", FragmentB=wedgeid_2)
# TO find the solution for writing to several worksheet!
entwine = Entwine(
    Branch00=concatenate,
    Branch01=slope_dip_2,
    Branch02=slope_dip_direction_2,
    Branch03=wedge_height_2,
    Branch04=null_values.Null,
    Branch05=upper_face_dip_2,
    Branch06=upper_face_dip_direction_2,
    Branch07=null_values.Null,
    Branch08=tension_crack_dip_2,
    Branch09=tension_crack_dipdirection_2,
    Branch010=null_values.Null,
    Branch011=rock_unit_weight_2,
    FlattenInputs=True)  # -> flatten(Result)
true_rows = BooleanToggle(True)
write_options = WriteOptions(
    FilePath=file_path_2,
    ClearDataOverwrite=Toggle(False),
    SaveAfterWrite=Toggle(True),
    CloseAfterWrite=Toggle(False),
    ColumnStartPosition=column_start_position,
    RowStartPosition=addition)  # -> UserMessages, WriteOptions
write_to_excel = WriteToExcel(
    Run=write_to_excel_template_2,
    ExcelWorksheet=excel_worksheet,
    WriteOptions=write_options.WriteOptions,
    ColumnnsOrRows=true_rows,
    DataToWriteIntoColumns=entwine)

# ----
# SCALE WEDGE
volume = ClusterInput()
null_values_2 = NullValues(LastSaveLocalization="neutral,N")  # -> Null, NaN, Infinity, Infinity_2
excel_worksheet_2 = Panel("7")
volume_2 = Data(volume)
null_values_3 = NullValues(LastSaveLocalization="neutral,N")  # -> Null, NaN, Infinity, Infinity_2
stream_filter = StreamFilter(Gate=scale_wedge_with_volume_2, Stream0=null_values_2.Null, Stream1=volume_2)
entwine_2 = Entwine(
    Branch00=concatenate,
    Branch01=null_values_3.Null,
    Branch02=null_values_3.Null,
    Branch03=null_values_3.Null,
    Branch04=null_values_3.Null,
    Branch05=null_values_3.Null,
    Branch06=null_values_3.Null,
    Branch07=null_values_3.Null,
    Branch08=null_values_3.Null,
    Branch09=stream_filter,
    FlattenInputs=True)  # -> flatten(Result)
write_to_excel_2 = WriteToExcel(
    Run=write_to_excel_template_2,
    ExcelWorksheet=excel_worksheet_2,
    WriteOptions=write_options.WriteOptions,
    ColumnnsOrRows=true_rows,
    DataToWriteIntoColumns=entwine_2)

# ----
# JOINTS
joint2_dip_direction = ClusterInput()
joint2_dip = ClusterInput()
excel_worksheet_3 = Panel("3")
joint_1_phi = ClusterInput()
joint1_dip_direction = ClusterInput()
joint1_dip = ClusterInput()
joint_2_phi = ClusterInput()
joint_1_phi_2 = Number(joint_1_phi)
joint_2_phi_2 = Number(joint_2_phi)
joint1_dip_direction_2 = Data(joint1_dip_direction)
joint2_dip_2 = Data(joint2_dip)
joint2_dip_direction_2 = Data(joint2_dip_direction)
null_values_4 = NullValues(LastSaveLocalization="neutral,N")  # -> Null, NaN, Infinity, Infinity_2
joint1_dip_2 = Data(joint1_dip)
entwine_3 = Entwine(
    Branch00=concatenate,
    Branch01=joint1_dip_2,
    Branch02=joint1_dip_direction_2,
    Branch03="0",
    Branch04="0",
    Branch05=joint_1_phi_2,
    Branch06=null_values_4.Null,
    Branch07=null_values_4.Null,
    Branch08=null_values_4.Null,
    Branch09=null_values_4.Null,
    Branch010=null_values_4.Null,
    Branch011=null_values_4.Null,
    Branch012=null_values_4.Null,
    Branch013=joint2_dip_2,
    Branch014=joint2_dip_direction_2,
    Branch015="0",
    Branch016="0",
    Branch017=joint_2_phi_2,
    FlattenInputs=True)  # -> flatten(Result)
write_to_excel_3 = WriteToExcel(
    Run=write_to_excel_template_2,
    ExcelWorksheet=excel_worksheet_3,
    WriteOptions=write_options.WriteOptions,
    ColumnnsOrRows=true_rows,
    DataToWriteIntoColumns=entwine_3)

# ==== cluster MeshDipDipDirection_2: Calculate dip and direction of mesh

# ---- group: Inputs
mesh = ClusterInput()
round_to_nearest = ClusterInput()
no_of_decimal_place = ClusterInput()
round_to_nearest_2 = Boolean(round_to_nearest)
no_of_decimal_place_2 = Integer(no_of_decimal_place)
mesh_2 = Mesh(mesh)

# ---- group: Get arithmetic mean of normal for each mesh
face_normals = FaceNormals(Mesh=mesh_2)  # -> Centers, Normals
average = Average(Input=face_normals.Normals)  # -> flatten(ArithmeticMean)

# ---- group: Obtain horisontal components; ensure vector length greater than zero
deconstruct_vector = DeconstructVector(Vector=average)  # -> XComponent, YComponent, ZComponent
vector_xyz = VectorXYZ(XComponent=deconstruct_vector.XComponent, YComponent=deconstruct_vector.YComponent, ZComponent=0)  # -> Vector, Length
vector_length = VectorLength(Vector=vector_xyz.Vector)
dup = DuplicateDataMatch(SourceDataTree=vector_xyz.Vector, SecondaryDataSecondaryData1="{0,1,0}")  # -> SourceData, SecondaryDataSecondaryData1
equality = Equality(FirstNumber=vector_length, SecondNumber="0")  # -> Equality, Inequality
pick_n_choose = PickNChoose(Pattern=equality.Equality, Stream0=vector_xyz.Vector, Stream1=<missing>)

# ---- group: Dip direction calculation
larger_than = LargerThan(FirstNumber=deconstruct_vector.ZComponent, SecondNumber="0")  # -> LargerThan, OrEqualTo
reverse = Reverse(Vector=pick_n_choose)
pick_n_choose_2 = PickNChoose(Pattern=larger_than.LargerThan, Stream0=reverse, Stream1=pick_n_choose)
unit_y = UnitY(Factor=1)
deconstruct_vector_2 = DeconstructVector(Vector=pick_n_choose_2)  # -> XComponent, YComponent, ZComponent
larger_than_2 = LargerThan(FirstNumber=deconstruct_vector_2.XComponent, SecondNumber="0")  # -> LargerThan, OrEqualTo
angle = Angle(VectorA=unit_y, VectorB=pick_n_choose_2)  # -> Angle, Reflex
pick_n_choose_3 = PickNChoose(Pattern=larger_than_2.LargerThan, Stream0=angle.Reflex, Stream1=angle.Angle)
degrees = Degrees(Radians=pick_n_choose_3)
addition = Addition(A=degrees)

# ---- group: Dip angle calculation
angle_2 = Angle(VectorA=pick_n_choose, VectorB=average)  # -> Angle, Reflex
degrees_2 = Degrees(Radians=angle_2.Angle)
subtraction = Subtraction(A="90", B=degrees_2)
absolute = Absolute(Value=subtraction)

# ---- group: Dip: Replace with null if null; rounding
null_item = NullItem(Item=degrees_2)  # -> NullFlags, InvalidFlags, Description
round_to_decimal_place = RoundToDecimalPlace(NumberX=absolute, DecimalPlace=no_of_decimal_place_2, RoundType=0)  # -> Rounded, Difference
list_indices = ListIndices(List=null_item.NullFlags)
cull_pattern = CullPattern(List=list_indices, CullPattern=null_item.NullFlags)
replace_items = ReplaceItems(List=absolute, Indices=cull_pattern, Wrap=False)
replace_items_2 = ReplaceItems(List=round_to_decimal_place.Rounded, Indices=cull_pattern, Wrap=False)
stream_filter = StreamFilter(Gate=round_to_nearest_2, Stream0=replace_items, Stream1=replace_items_2)

# ---- group: Dip Direction: Replace with null if null; rounding
null_item_2 = NullItem(Item=degrees_2)  # -> NullFlags, InvalidFlags, Description
round_to_decimal_place_2 = RoundToDecimalPlace(NumberX=addition, DecimalPlace=no_of_decimal_place_2, RoundType=0)  # -> Rounded, Difference
list_indices_2 = ListIndices(List=null_item_2.NullFlags)
cull_pattern_2 = CullPattern(List=list_indices_2, CullPattern=null_item_2.NullFlags)
replace_items_3 = ReplaceItems(List=round_to_decimal_place_2.Rounded, Indices=cull_pattern_2, Wrap=False)
replace_items_4 = ReplaceItems(List=degrees, Indices=cull_pattern_2, Wrap=False)
stream_filter_2 = StreamFilter(Gate=round_to_nearest_2, Stream0=replace_items_4, Stream1=replace_items_3)

# ---- group: Output-numeric
dip_deg = Number(stream_filter)
dip_direction_deg = Number(stream_filter_2)
dip_deg_2 = ClusterOutput(dip_deg)
dip_direction_deg_2 = ClusterOutput(dip_direction_deg)

# ---- group: Output-text
concatenate = Concatenate(Fragment_A=dip_deg, A="/", Fragment_B=dip_direction_deg)
dip_dipdirection = Text(concatenate)
dip_dipdirection_2 = ClusterOutput(dip_dipdirection)

# ==== cluster SwedgeModelAndGeometries

left_joint_trimmed_cutter_brep = ClusterInput()
swedge_bottom_point_adjustment_m = ClusterInput()
fit_top_face_bench_width_to_model = ClusterInput()
right_joint_trimmed_cutter_brep = ClusterInput()
crest_left_control_point = ClusterInput()
crest_right_control_point = ClusterInput()
inner_bench_height = ClusterInput()
left_joint_trimmed_cutter_brep_2 = Brep(left_joint_trimmed_cutter_brep)
right_joint_trimmed_cutter_brep_2 = Brep(right_joint_trimmed_cutter_brep)
crest_right_control_point_2 = Point(crest_right_control_point)
crest_left_control_point_2 = Point(crest_left_control_point)
fit_top_face_bench_width_to_model_2 = Boolean(fit_top_face_bench_width_to_model)
swedge_bottom_point_adjustment_m_2 = Number(swedge_bottom_point_adjustment_m)
inner_bench_height_2 = Number(inner_bench_height)

# ---- group: Left Joint round to integer
mesh_dip_dipdirection = MeshDipDipDirection_2(mesh=left_joint_trimmed_cutter_brep_2, round_to_nearest=True, no_of_decimal_place=0)  # -> dip_deg_2, dip_direction_deg_2, dip_dipdirection_2
area = Area(Geometry=left_joint_trimmed_cutter_brep_2)  # -> Area, Centroid
dip_dipdirection_to_plane = DipDipDirectionToPlane(
    dip_deg=mesh_dip_dipdirection.dip_deg_2,
    dip_direction_deg=mesh_dip_dipdirection.dip_direction_deg_2,
    origin=area.Centroid)  # -> plane_2, plane_normal_2

# ----
area_2 = Area(Geometry=right_joint_trimmed_cutter_brep_2)  # -> Area, Centroid

# ---- group: Creating Swedge model / Right Joint round to integer
mesh_dip_dipdirection_2 = MeshDipDipDirection_2(mesh=right_joint_trimmed_cutter_brep_2, round_to_nearest=True, no_of_decimal_place=0)  # -> dip_deg_2, dip_direction_deg_2, dip_dipdirection_2
dip_dipdirection_to_plane_2 = DipDipDirectionToPlane(
    dip_deg=mesh_dip_dipdirection_2.dip_deg_2,
    dip_direction_deg=mesh_dip_dipdirection_2.dip_direction_deg_2,
    origin=area_2.Centroid)  # -> plane_2, plane_normal_2

# ---- group: Creating Swedge model
line = Line(StartPoint=crest_left_control_point_2, EndPoint=crest_right_control_point_2)
extend_curve = ExtendCurve(Curve=line, Type=0, Start="100", End="100")
end_points = EndPoints(Curve=extend_curve)  # -> Start, End
line_2 = Line(StartPoint=end_points.Start, EndPoint=end_points.End)
line_plane = LinePlane(Line=line_2, Plane=dip_dipdirection_to_plane.plane_2)  # -> Point, ParamL, ParamP
line_plane_2 = LinePlane(Line=line_2, Plane=dip_dipdirection_to_plane_2.plane_2)  # -> Point, ParamL, ParamP

# ---- group: Creating Swedge model / Move point along line of intersection - base on inner bench height
brep_brep = BrepBrep(BrepA=left_joint_trimmed_cutter_brep_2, BrepB=right_joint_trimmed_cutter_brep_2)  # -> Curves, Points
join_curves = JoinCurves(Curves=brep_brep.Curves, Preserve=False)
unit_z = UnitZ(Factor=inner_bench_height_2)

# ----
curve_middle = CurveMiddle(Curve=brep_brep.Curves)

# ---- group: Creating Swedge model / Move point along line of intersection - base on inner bench height (continued)
line_sdl = LineSDL(Start=curve_middle, Direction=Vector(0, 0, 1), Length=1)
flip_curve = FlipCurve(Curve=join_curves, Guide=line_sdl)  # -> Curve, Flag
end_points_2 = EndPoints(Curve=flip_curve.Curve)  # -> Start, End
line_3 = Line(StartPoint=end_points_2.Start, EndPoint=end_points_2.End)

# ---- group: Adjust SWedge bottom point
extend_curve_2 = ExtendCurve(Curve=line_3, Type=0, Start=swedge_bottom_point_adjustment_m_2, End="0")
end_points_3 = EndPoints(Curve=extend_curve_2)  # -> Start, End
swedge_bottom_point = Point(end_points_3.Start)

# ---- group: Creating Swedge model / Move point along line of intersection - base on inner bench height (continued)
xy_plane = XYPlane(Origin=swedge_bottom_point)
move = Move(Geometry=xy_plane, Motion=unit_z)  # -> Geometry, Transform
line_plane_3 = LinePlane(Line=line_3, Plane=move.Geometry)  # -> Point, ParamL, ParamP

# ---- group: Creating Swedge model / Move point along line of intersection - base on inner bench height / Pick Upper Face Width end point
pick_n_choose = PickNChoose(Pattern=fit_top_face_bench_width_to_model_2, Stream0=line_plane_3.Point, Stream1=end_points_2.End)
upper_face_width_end_point = Point(pick_n_choose)

# ---- group: Creating Swedge model (continued)
construct_swedge_model = ConstructSwedgeModel(
    upper_face_width_end_point=upper_face_width_end_point,
    left_slope_crest_point=line_plane.Point,
    right_slope_crest_point=line_plane_2.Point,
    swedge_bottom_point=swedge_bottom_point)  # -> swedge_model_mesh_2, upper_face_mesh_2, slope_face_mesh_2, left_joint_face_mesh_2, right_joint_face_mesh_2
volume = Volume(Geometry=construct_swedge_model.swedge_model_mesh_2)  # -> flatten(Volume), Centroid
panel = Panel(volume.Volume)
simulated_swedge_wedge_mesh = Mesh(construct_swedge_model.swedge_model_mesh_2)

# ---- group: Construct Wedge Height Line
swedge_bottom_point_2 = Point(swedge_bottom_point)
crest_left_point = Point(line_plane.Point)
deconstruct = Deconstruct(Point=crest_left_point)  # -> XComponent, YComponent, ZComponent
deconstruct_2 = Deconstruct(Point=swedge_bottom_point_2)  # -> XComponent, YComponent, ZComponent
construct_point = ConstructPoint(XCoordinate=deconstruct_2.XComponent, YCoordinate=deconstruct_2.YComponent, ZCoordinate=deconstruct.ZComponent)
line_4 = Line(StartPoint=swedge_bottom_point_2, EndPoint=construct_point)

# ---- group: Calculate Wedge Height
deconstruct_3 = Deconstruct(Point=upper_face_width_end_point)  # -> XComponent, YComponent, ZComponent
deconstruct_4 = Deconstruct(Point=swedge_bottom_point)  # -> XComponent, YComponent, ZComponent
subtraction = Subtraction(A=deconstruct_3.ZComponent, B=deconstruct_4.ZComponent)

# ----
length = Length(Curve=line_4)

right_joint_face_mesh = Mesh(construct_swedge_model.right_joint_face_mesh_2)
upper_face_mesh = Mesh(construct_swedge_model.upper_face_mesh_2)
left_joint_face_mesh = Mesh(construct_swedge_model.left_joint_face_mesh_2)
slope_face_mesh = Mesh(construct_swedge_model.slope_face_mesh_2)
swedge_model_mesh = ClusterOutput(construct_swedge_model.swedge_model_mesh_2)
upper_face_mesh_2 = ClusterOutput(upper_face_mesh)
right_joint_face_mesh_2 = ClusterOutput(right_joint_face_mesh)
slope_face_mesh_2 = ClusterOutput(slope_face_mesh)
left_joint_face_mesh_2 = ClusterOutput(left_joint_face_mesh)

wedge_height_line = Line(line_4)
inner_bench_height_m = Number(subtraction)
wedge_height_m = Number(length)
inner_bench_height_m_2 = ClusterOutput(inner_bench_height_m)

wedge_height_line_2 = ClusterOutput(wedge_height_line)
wedge_height_m_2 = ClusterOutput(wedge_height_m)

# ==== cluster FilterBoltsByNumber
available_bolt_lines = ClusterInput()
swedge_slope_face_mesh = ClusterInput()
number_of_bolts_each_length = ClusterInput()

available_bolt_lines_2 = Line(available_bolt_lines)
swedge_slope_face_mesh_2 = Mesh(swedge_slope_face_mesh)
number_of_bolts_each_length_2 = Integer(number_of_bolts_each_length)

# ---- group: Plane parallel to Slope surface
face_normals = FaceNormals(Mesh=swedge_slope_face_mesh_2)  # -> Centers, unitize(Normals)

# ----
split_list = SplitList(List=available_bolt_lines_2, Index=number_of_bolts_each_length_2)  # -> simplify(ListA), ListB
end_points = EndPoints(Curve=split_list.ListA)  # -> Start, End
pipe = Pipe(Curve=split_list.ListA, Radius="0.02", Caps=1)  # -> simplify(Pipe)
circle_cnr = CircleCNR(Center=end_points.Start, Normal=face_normals.Normals, Radius="0.1")  # -> simplify(Circle)
length = Length(Curve=split_list.ListA)
trim_tree = TrimTree(Tree=pipe, Depth=1)
round_to_decimal_place = RoundToDecimalPlace(NumberX=length, DecimalPlace="1", RoundType="0")  # -> Rounded, Difference
brep = Brep(circle_cnr)
brep_2 = Brep(trim_tree)
bolt_shank = Brep(simplify(brep_2))
bolt_plates = Brep(brep)
bolt_lines = Line(split_list.ListA)
bolt_start_points = Point(end_points.Start)
bolt_length_label_text = Text(round_to_decimal_place.Rounded)

bolt_length_label_text_2 = ClusterOutput(bolt_length_label_text)
bolt_plates_2 = ClusterOutput(bolt_plates)
bolt_lines_2 = ClusterOutput(bolt_lines)
bolt_start_points_2 = ClusterOutput(bolt_start_points)
bolt_shank_2 = ClusterOutput(bolt_shank)

# ==== cluster BoltRotation
base = ClusterInput()

# ---- group: Rotating bolt around slope normal
bolt_plunge_rotation_deg = ClusterInput()
bolt_trend_rotation_deg = ClusterInput()
slope_face_dip_direction_deg = ClusterInput()
slope_face_dip_deg = ClusterInput()
slope_face_dip_direction_deg_2 = Integer(slope_face_dip_direction_deg)
slope_face_dip_deg_2 = Integer(slope_face_dip_deg)
base_2 = Point(base)
dip_dipdirection_to_plane = DipDipDirectionToPlane(dip_deg=slope_face_dip_deg_2, dip_direction_deg=slope_face_dip_direction_deg_2, origin=base_2)  # -> plane_2, flatten(plane_normal_2)
reverse = Reverse(Vector=dip_dipdirection_to_plane.plane_normal_2)
deconstruct_plane = DeconstructPlane(Plane=dip_dipdirection_to_plane.plane_2)  # -> Origin, XAxis, YAxis, ZAxis

# ----
bolt_plunge_rotation_deg_2 = Number(bolt_plunge_rotation_deg)
bolt_trend_rotation_deg_2 = Number(bolt_trend_rotation_deg)

# ---- group: Rotating bolt around slope normal / 1. Bolt Plunge
panel = Panel("1")
line_sdl = LineSDL(Start=deconstruct_plane.Origin, Direction=deconstruct_plane.XAxis, Length=panel)
radians = Radians(Degrees=bolt_plunge_rotation_deg_2)
line_sdl_2 = LineSDL(Start=deconstruct_plane.Origin, Direction=reverse, Length=panel)
rotate_axis = RotateAxis(Geometry=line_sdl_2, Angle=radians, Axis=line_sdl)  # -> Geometry, Transform

# ---- group: Rotating bolt around slope normal / 2. Bolt trend
radians_2 = Radians(Degrees=bolt_trend_rotation_deg_2)
line_sdl_3 = LineSDL(Start=deconstruct_plane.Origin, Direction=deconstruct_plane.YAxis, Length=panel)
rotate_axis_2 = RotateAxis(Geometry=rotate_axis.Geometry, Angle=radians_2, Axis=line_sdl_3)  # -> Geometry, Transform

# ---- group: Rotating bolt around slope normal (continued)
entwine = Entwine(Branch00=bolt_plunge_rotation_deg_2, Branch01=bolt_trend_rotation_deg_2, FlattenInputs=True)
cluster = Cluster(vector=rotate_axis_2.Geometry)  # -> trend_2, plunge_2
trend = Panel(cluster.trend_2)
plunge = Panel(cluster.plunge_2)
bolt_direction = Vector(rotate_axis_2.Geometry)
bolt_direction_2 = ClusterOutput(bolt_direction)
plunge_2 = ClusterOutput(cluster.plunge_2)
trend_2 = ClusterOutput(cluster.trend_2)

# ==== cluster FishToCSV
fish = ClusterInput()
fish_2 = Fish(fish)

# ---- group: Constructing CSV Headers / Separating Fish text into items
text_split = TextSplit(Text=fish_2, Separators="\"")
tree_branch = TreeBranch(Tree=simplify(text_split), Path="0", MaintainPaths=True)

# ---- group: Constructing CSV values / Separating each line into items
panel = Panel(""" 
:""")

# ---- group: Constructing CSV values
deconstruct_fish = DeconstructFish(Fishes=fish_2)  # -> NumberVariables, TextVariables, Objectives, Attributes

# ---- group: Constructing CSV values / Separating each line into items (continued)
text_split_2 = TextSplit(Text=deconstruct_fish.Attributes, Separators=panel)

# ---- group: Constructing CSV values / Trial ID
list_item = ListItem(List=deconstruct_fish.NumberVariables, Index=0, Wrap=True)  # -> flatten(Item)
list_indices = ListIndices(List=list_item)

# ---- group: Constructing CSV values / Variable results
flip_matrix = FlipMatrix(Data=deconstruct_fish.NumberVariables)
explode_tree = ExplodeTree(Data=flip_matrix)  # -> Branch0, Branch1, Branch2, Branch3, Branch4, Branch5, Branch6, Branch7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

# ---- group: Constructing CSV Headers / Getting Variable names
tree_statistics = TreeStatistics(Tree=flip_matrix)  # -> Paths, Length, Count
panel_2 = Panel("2")
series = Series(Start="1", Step=panel_2, Count=tree_statistics.Count)
list_item_2 = ListItem(List=tree_branch, Index=series, Wrap=True)
concatenate = Concatenate(FragmentA="Var_", FragmentB=list_item_2)  # -> flatten(Result)

# ---- group: Constructing CSV values / Objective results
flip_matrix_2 = FlipMatrix(Data=deconstruct_fish.Objectives)
explode_tree_2 = ExplodeTree(Data=flip_matrix_2)  # -> Branch0, Branch1, Branch2

# ---- group: Constructing CSV Headers / Getting Objective names
panel_3 = Panel("1")
tree_statistics_2 = TreeStatistics(Tree=flip_matrix_2)  # -> Paths, Length, Count
first_last = FirstLast(List=series)  # -> FirstValue, LastValue
addition = Addition(A=first_last.LastValue, B=panel_2)
series_2 = Series(Start=addition, Step=panel_2, Count=tree_statistics_2.Count)
list_item_3 = ListItem(List=tree_branch, Index=series_2, Wrap=True)
concatenate_2 = Concatenate(FragmentA="Obj_", FragmentB=list_item_3)  # -> flatten(Result)

# ---- group: Constructing CSV values / Getting Attribtue values
tree_branch_2 = TreeBranch(Tree=simplify(text_split_2), Path="0", MaintainPaths=True)
list_indices_2 = ListIndices(List=tree_branch_2)

# ---- group: Constructing CSV values / Getting Attribtue values / Returns True if item is a number
equality = Equality(FirstNumber=tree_branch_2, SecondNumber=tree_branch_2)  # -> Equality, Inequality

# ---- group: Constructing CSV values / Getting Attribtue values (continued)
cull_pattern = CullPattern(List=list_indices_2, CullPattern=equality.Equality)
list_item_4 = ListItem(List=text_split_2, Index=cull_pattern, Wrap=True)
text_trim = TextTrim(Text=list_item_4, Start=True, End=True)

# ---- group: Constructing CSV Headers / Getting Attribute Headers
subtraction = Subtraction(A=cull_pattern, B="2")
list_item_5 = ListItem(List=text_split_2, Index=subtraction, Wrap=True)
replace_text = ReplaceText(Text=list_item_5, Find=":", RecursiveReplace=False)
concatenate_3 = Concatenate(FragmentA=graft("Attr_"), FragmentB=replace_text)
tree_branch_3 = TreeBranch(Tree=simplify(concatenate_3), Path="0", MaintainPaths=True)  # -> flatten(Branch)

# ---- group: Constructing CSV values / Attribute results
flip_matrix_3 = FlipMatrix(Data=text_trim)
explode_tree_3 = ExplodeTree(Data=flip_matrix_3)  # -> Branch0, Branch1, Branch2, Branch3, Branch4, Branch5, Branch6, Branch7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

# ---- group: Constructing CSV values (continued)
entwine = Entwine(
    Branch00=list_indices,
    Branch01=explode_tree_2.Branch0,
    Branch02=explode_tree_2.Branch1,
    Branch03=explode_tree_2.Branch2,
    Branch04=explode_tree.Branch0,
    Branch05=explode_tree.Branch1,
    Branch06=explode_tree.Branch2,
    Branch07=explode_tree.Branch3,
    Branch08=explode_tree.Branch4,
    Branch09=explode_tree.Branch5,
    Branch010=explode_tree.Branch6,
    Branch011=explode_tree.Branch7,
    Branch012=explode_tree.Branch8,
    Branch013=explode_tree.Branch9,
    Branch014=explode_tree.Branch10,
    Branch015=explode_tree_3.Branch0,
    Branch016=explode_tree_3.Branch1,
    Branch017=explode_tree_3.Branch2,
    Branch018=explode_tree_3.Branch3,
    Branch019=explode_tree_3.Branch4,
    Branch020=explode_tree_3.Branch5,
    Branch021=explode_tree_3.Branch6,
    Branch022=explode_tree_3.Branch7,
    Branch023=explode_tree_3.Branch8,
    Branch024=explode_tree_3.Branch9,
    Branch025=explode_tree_3.Branch10,
    Branch026=explode_tree_3.Branch11,
    Branch027=explode_tree_3.Branch12,
    Branch028=explode_tree_3.Branch13,
    Branch029=explode_tree_3.Branch14,
    Branch030=explode_tree_3.Branch15,
    FlattenInputs=True)

# ---- group: Constructing CSV Headers
merge = Merge(Data1="Trial_ID", Data2=concatenate_2, Data3=concatenate, Data4=tree_branch_3)
csv_headers = Panel(merge)

# ----
create_csv = CreateCSV(DataGridHeaders=merge, ValueTree=entwine, Delimiter=",")
csv_string = Data(create_csv)
csv_string_2 = ClusterOutput(csv_string)

# ==== cluster UpdateCSVFieWithParetoBooleans
fish_paretosolutions = ClusterInput()
csv_file_path = ClusterInput()
update_csv_with_pareto_booleans = ClusterInput()
csv_file_path_2 = FilePath(csv_file_path)
fish_paretosolutions_2 = Fish(fish_paretosolutions)
update_csv_with_pareto_booleans_2 = Boolean(update_csv_with_pareto_booleans)
read_file = ReadFile(File=csv_file_path_2, PerLineParse=True)

# ---- group: Getting Pareto Solution Trial ID
text_split = TextSplit(Text=fish_paretosolutions_2, Separators=":")  # -> flatten(Result)
match_text = MatchText(Text=text_split, Pattern="Model Number", Case=True)
list_indices = ListIndices(List=text_split)
mass_addition = MassAddition(Input=match_text)  # -> Result, PartialResults
cull_pattern = CullPattern(List=list_indices, CullPattern=match_text)
addition = Addition(A=cull_pattern, B="1")

# ---- group: New column data
list_length = ListLength(List=read_file)
repeat_data = RepeatData(Data=",0", Length=list_length)

# ---- group: Column Header
replace_items = ReplaceItems(List=repeat_data, Item=",IsParetoSolution", Indices="0", Wrap=False)

# ---- group: Replace column with Pareto Booleans
list_item = ListItem(List=text_split, Index=addition, Wrap=True)
addition_2 = Addition(A=list_item, B="1")
replace_items_2 = ReplaceItems(List=replace_items, Item=",1", Indices=addition_2, Wrap=False)

# ---- group: Update CSV Strings
concatenate = Concatenate(FragmentA=read_file, FragmentB=replace_items_2)
c_write_to_csv = CSharpScript(save=update_csv_with_pareto_booleans_2, path=csv_file_path_2, data=concatenate)  # inputs save: Boolean, path: String, data: list of String
# ---------- c_write_to_csv: C# ----------
    if(save){
      var fileinfo = new System.IO.FileInfo(path);
      if(!fileinfo.Directory.Exists){
        fileinfo.Directory.Create();
      }
      
      var sw = fileinfo.CreateText();
      for(int i = 0; i < data.Count; i++){
        string row = data[i];
        if(i < data.Count - 1){
          sw.WriteLine(row);
        }else{
          sw.Write(row);
        }
      }
      
      sw.Flush();
      sw.Close();
    }
# ---------- end c_write_to_csv ----------

# ==== cluster AvailableBoltPointsAndLines: Find available bolt points bolt lines grouped by bolt lengths based on minimum bolt spacing and bolt direction.

bolting_point_minimum_spacing_m = ClusterInput()
swedge_model_slope_face_mesh = ClusterInput()
edge_clearance_m = ClusterInput()
points_subparallel_with_swedge_slope_fac = ClusterInput()  # "Points Subparallel with SWedge Slope FAce"
block_slope_face = ClusterInput()
swedge_model_centroid = ClusterInput()
edge_clearance_m_2 = Number(edge_clearance_m)
swedge_model_slope_face_mesh_2 = Mesh(swedge_model_slope_face_mesh)
points_subparallel_with_swedge_slope_fac_2 = Point(points_subparallel_with_swedge_slope_fac)  # "Points Subparallel with SWedge Slope FAce"
block_slope_face_2 = Brep(block_slope_face)
bolting_point_minimum_spacing_m_2 = Number(bolting_point_minimum_spacing_m)
swedge_model_centroid_2 = Point(swedge_model_centroid)

# ---- group: Orientation Swedge slope Face plane with XY
# X-direction = horizontal
face_normals = FaceNormals(Mesh=swedge_model_slope_face_mesh_2)  # -> Centers, Normals
plane_normal = PlaneNormal(Origin=face_normals.Centers, ZAxis=face_normals.Normals)
xy_plane = XYPlane(Origin=face_normals.Centers)
plane_plane = PlanePlane(PlaneA=xy_plane, PlaneB=plane_normal)
unit_z = UnitZ(Factor=1)
construct_plane = ConstructPlane(Origin=face_normals.Centers, XAxis=plane_plane, YAxis=unit_z)
swedge_slope_plane_with_xy = Plane(construct_plane)

# ----
bolting_point_minimum_spacing_m_3 = Number(bolting_point_minimum_spacing_m_2)

# ---- group: Construct cloud grid covering the bounding rectangle
bounding_rectangle = BoundingRectangle(Geometry=points_subparallel_with_swedge_slope_fac_2, Plane=swedge_slope_plane_with_xy, Axis=0, Slide=0, Union=True)  # -> Bounding, DimensionX, DimensionY
entwine = Entwine(Branch00=bounding_rectangle.DimensionX, Branch01=bounding_rectangle.DimensionY, FlattenInputs=True)
expression = Expression(Dimension=entwine, spacing=bolting_point_minimum_spacing_m_3, Expression="Dimension/spacing")
parameter_plane_in_rectangle = ParameterPlaneInRectangle(Rectangle=bounding_rectangle.Bounding, ParameterX="0", ParameterY="0")  # -> Plane, Normal
round = Round(Number=expression)  # -> Nearest, Floor, Ceiling
explode_tree = ExplodeTree(Data=round.Ceiling)  # -> Branch0, Branch1
cloud_grid = CloudGrid(
    Plane=parameter_plane_in_rectangle.Plane,
    Size=bolting_point_minimum_spacing_m_3,
    ExtentX=explode_tree.Branch0,
    ExtentY=explode_tree.Branch1,
    ExtentZ="1")

# ---- group: Find SWedge slope face plane pointing inwards
vector_2pt = Vector2Pt(PointA=face_normals.Centers, PointB=swedge_model_centroid_2, Unitize=False)  # -> Vector, Length
plane_normal_2 = PlaneNormal(Origin=face_normals.Centers, ZAxis=vector_2pt.Vector)
flip_plane = FlipPlane(Plane=plane_normal, Guide=plane_normal_2, FlipX=False, FlipY=False, FlipZ=True)  # -> Flipped, ResultBoolean

# ---- group: Filter out edge points with specified clearance
deconstruct_brep = DeconstructBrep(Brep=block_slope_face_2)  # -> Faces, Edges, Vertices
edge_clearance_m_3 = Number(edge_clearance_m_2)
join_curves = JoinCurves(Curves=deconstruct_brep.Edges, Preserve=False)
pull_point = PullPoint(Point=simplify(graft(points_subparallel_with_swedge_slope_fac_2)), Geometry=join_curves, ClosestOnly=False)  # -> ClosestPoint, simplify(Distance)
larger_than = LargerThan(FirstNumber=pull_point.Distance, SecondNumber=edge_clearance_m_3)  # -> LargerThan, OrEqualTo
mass_multiplication = MassMultiplication(Input=larger_than.LargerThan)  # -> flatten(Result), PartialResults
cull_pattern = CullPattern(List=points_subparallel_with_swedge_slope_fac_2, CullPattern=mass_multiplication.Result)
bolteable_points_on_point_cloud = Point(cull_pattern)

# ---- group: Find bolteable points on point cloud
deconstruct_cloud = DeconstructCloud(Cloud=cloud_grid)  # -> Points, Normals, Colors
arbitrary_maximum_distance_from_pointclo = Panel("0.1")  # "Arbitrary maximum distance from pointcloud to bolting options"
line_sdl = LineSDL(Start=deconstruct_cloud.Points, Direction=face_normals.Normals, Length="1")
deconstruct_plane = DeconstructPlane(Plane=flip_plane.Flipped)  # -> Origin, XAxis, YAxis, ZAxis
extend_curve = ExtendCurve(Curve=line_sdl, Type=0, Start="5", End="5")
first_last = FirstLast(List=extend_curve)  # -> FirstValue, LastValue
multiplication = Multiplication(A="5", B="2")
negative = Negative(Value=multiplication)
pull_point_2 = PullPoint(Point=bolteable_points_on_point_cloud, Geometry=extend_curve, ClosestOnly=True)  # -> ClosestPoint, Distance
smaller_than = SmallerThan(FirstNumber=pull_point_2.Distance, SecondNumber=arbitrary_maximum_distance_from_pointclo)  # -> SmallerThan, OrEqualTo
amplitude = Amplitude(Vector=deconstruct_plane.ZAxis, Amplitude=negative)
move = Move(Geometry=flip_plane.Flipped, Motion=amplitude)  # -> Geometry, Transform
cull_pattern_2 = CullPattern(List=pull_point_2.ClosestPoint, CullPattern=smaller_than.OrEqualTo)
sort_along_curve = SortAlongCurve(Points=cull_pattern_2, Curve=first_last.FirstValue)  # -> Points, Indices
addition = Addition(A=multiplication, B="5")
project = Project(Geometry=cull_pattern_2, Plane=move.Geometry)  # -> Geometry, Transform
vector_2pt_2 = Vector2Pt(PointA=cull_pattern_2, PointB=project.Geometry, Unitize=False)  # -> Vector, Length
cull_duplicates = CullDuplicates(Points=project.Geometry, Tolerance="0.25", CullMode=1)  # -> Points, Indices, Valence
line_sdl_2 = LineSDL(Start=cull_duplicates.Points, Direction=deconstruct_plane.ZAxis, Length=addition)
point_groups = PointGroups(Points=project.Geometry, Distance="0.25")  # -> Groups, simplify(Indices)
list_item = ListItem(List=cull_pattern_2, Index=point_groups.Indices, Wrap=True)
sort_along_curve_2 = SortAlongCurve(Points=list_item, Curve=simplify(graft(line_sdl_2)))  # -> Points, Indices
sort_points = SortPoints(Points=cull_duplicates.Points)  # -> Points, Indices
first_last_2 = FirstLast(List=sort_along_curve_2.Points)  # -> FirstValue, LastValue
point = Point(first_last_2.FirstValue)
unsorted_bolting_point_options = Point(flatten(point))

# ---- group: Find closest bolting point option to centroid
unsorted_bolting_point_options_2 = Point(unsorted_bolting_point_options)
list_indices = ListIndices(List=unsorted_bolting_point_options_2)

# ---- group: Find closest bolting point option to centroid / Construct bolt lines
line_sdl_3 = LineSDL(Start=unsorted_bolting_point_options_2, Direction=face_normals.Normals, Length=1)
extend_curve_2 = ExtendCurve(Curve=line_sdl_3, Type=0, Start="100", End="100")
pull_point_3 = PullPoint(Point=swedge_model_centroid_2, Geometry=graft(extend_curve_2), ClosestOnly=True)  # -> ClosestPoint, flatten(Distance)

# ---- group: Find closest bolting point option to centroid (continued)
sort_list = SortList(Keys=pull_point_3.Distance, ValuesValuesA=list_indices)  # -> Keys, ValuesValuesA
first_last_3 = FirstLast(List=sort_list.ValuesValuesA)  # -> FirstValue, LastValue
closest_bolting_point_option_id_to_centr = Integer(first_last_3.FirstValue)  # "Closest bolting point option ID to centroid"

# ---- group: Find the farthest point iteratively from a seed point ID
unsorted_bolting_point_options_3 = Point(unsorted_bolting_point_options)
ghpython_script = GhPythonScript(points=unsorted_bolting_point_options_3, seed_id=closest_bolting_point_option_id_to_centr)  # -> sorted_ids, a; inputs points: list of Point3d, seed_id: Int32
# ---------- ghpython_script: Python ----------
import Rhino.Geometry as rg

# Function to calculate the minimum distance from a point to all points in a list
def get_min_distance_to_selected(point, selected_ids, points):
    min_dist = float('inf')
    for idx in selected_ids:
        dist = point.DistanceTo(points[idx])
        if dist < min_dist:
            min_dist = dist
    return min_dist

# Convert input points to Point3d objects if they aren't already
if isinstance(points[0], tuple):
    points = [rg.Point3d(pt) for pt in points]

# Ensure seed_id is an integer
seed_id = int(seed_id)

# Initialize the list of selected point IDs and remaining points
selected_ids = [seed_id]
remaining_ids = list(range(len(points)))
remaining_ids.remove(seed_id)

# Iteratively find the farthest point from the selected points
for _ in range(len(points) - 1):
    max_min_dist = -1
    farthest_index = -1
    
    for idx in remaining_ids:
        point = points[idx]
        min_dist_to_selected = get_min_distance_to_selected(point, selected_ids, points)
        
        if min_dist_to_selected > max_min_dist:
            max_min_dist = min_dist_to_selected
            farthest_index = idx
            
    selected_ids.append(farthest_index)
    remaining_ids.remove(farthest_index)

# Output
sorted_ids = selected_ids
# ---------- end ghpython_script ----------
bolting_point_option_priority_order = Integer(ghpython_script.sorted_ids)

# ----
list_item_2 = ListItem(List=unsorted_bolting_point_options, Index=bolting_point_option_priority_order, Wrap=True)
list_length = ListLength(List=list_item_2)
list_indices_2 = ListIndices(List=list_item_2)
gradient = Gradient(
    LowerLimit=0,
    UpperLimit=list_length,
    Parameter=list_indices_2,
    stops=[0: RGB(0, 0, 0), 0: RGB(255, 0, 0), 0.5: RGB(255, 255, 255), 1: RGB(0, 0, 255)])
text_tag = TextTag(Location=list_item_2, Text=list_indices_2)
custom_preview = CustomPreview(Geometry=list_item_2, Material=gradient)
sorted_bolting_point_options = Point(list_item_2)
sorted_bolting_point_options_2 = ClusterOutput(sorted_bolting_point_options)

# ==== cluster ApplyMaterialPartialFactor
c_1 = ClusterInput()
phi_1 = ClusterInput()
phi_1_r = ClusterInput()
c_2 = ClusterInput()
phi_2 = ClusterInput()
phi_2_r = ClusterInput()
c_1_2 = Number(c_1)
phi_1_2 = Number(phi_1)
phi_1_r_2 = Number(phi_1_r)
c_2_2 = Number(c_2)
phi_2_2 = Number(phi_2)
phi_2_r_2 = Number(phi_2_r)
entwine = Entwine(Branch00=phi_1_2, Branch01=phi_1_r_2, Branch02=phi_2_2, Branch03=phi_2_r_2, FlattenInputs=True)
radians = Radians(Degrees=phi_2_2)
entwine_2 = Entwine(Branch00=c_1_2, Branch01=c_2_2, FlattenInputs=True)
radians_2 = Radians(Degrees=entwine)
expression = Expression(phi=radians, Expression="Atan(tan(phi)/1.25)")
expression_2 = Expression(c=entwine_2, Expression="c/1.25")
expression_3 = Expression(phi=radians_2, Expression="Atan(tan(phi)/1.25)")
explode_tree = ExplodeTree(Data=expression_2)  # -> Branch0, Branch1
degrees = Degrees(Radians=expression)
degrees_2 = Degrees(Radians=expression_3)
explode_tree_2 = ExplodeTree(Data=degrees_2)  # -> Branch0, Branch1, Branch2, Branch3
c_2_3 = Number(explode_tree.Branch1)
phi_2_3 = Number(explode_tree_2.Branch2)
phi_2_r_3 = Number(explode_tree_2.Branch3)
c_1_3 = Number(explode_tree.Branch0)
phi_1_3 = Number(explode_tree_2.Branch0)
phi_1_r_3 = Number(explode_tree_2.Branch1)
c_1_4 = ClusterOutput(c_1_3)
phi_1_4 = ClusterOutput(phi_1_3)
phi_1_r_4 = ClusterOutput(phi_1_r_3)
c_2_4 = ClusterOutput(c_2_3)
phi_2_4 = ClusterOutput(phi_2_3)
phi_2_r_4 = ClusterOutput(phi_2_r_3)

# ==== cluster PointCloudSubparallelToSWedgeSlopeSurface
pointcloud_with_normals = ClusterInput()
swedge_slope_face_mesh = ClusterInput()
block_slope_surface = ClusterInput()
angle_tolerance_deg = ClusterInput()
angle_tolerance_deg_2 = Number(angle_tolerance_deg)
swedge_slope_face_mesh_2 = Mesh(swedge_slope_face_mesh)
block_slope_surface_2 = Brep(block_slope_surface)
pointcloud_with_normals_2 = PointCloud(pointcloud_with_normals)

# ---- group: Creating cropping mesh by extruding block slope surface and SWedge slope face
mesh_to_polysurface = MeshToPolysurface(Mesh=swedge_slope_face_mesh_2, Triangles=False, FaceMerge=False)

# ---- group: Get pointcloud subparallel to SWedge Slope Surface
face_normals = FaceNormals(Mesh=swedge_slope_face_mesh_2)  # -> Centers, Normals
expression = Expression(x=angle_tolerance_deg_2, Expression="180-x")
construct_domain = ConstructDomain(DomainStart=expression, DomainEnd="180")
construct_domain_2 = ConstructDomain(DomainStart=angle_tolerance_deg_2, DomainEnd=1)

# ----
amplitude = Amplitude(Vector=face_normals.Normals, Amplitude="2")
amplitude_2 = Amplitude(Vector=face_normals.Normals, Amplitude="-6")

# ---- group: Creating cropping mesh by extruding block slope surface and SWedge slope face (continued)
amplitude_3 = Amplitude(Vector=face_normals.Normals, Amplitude="0.5")
move = Move(Geometry=mesh_to_polysurface, Motion=amplitude_3)  # -> Geometry, Transform
move_2 = Move(Geometry=block_slope_surface_2, Motion=amplitude)  # -> Geometry, Transform
amplitude_4 = Amplitude(Vector=face_normals.Normals, Amplitude="-2")
extrude = Extrude(Base=move_2.Geometry, Direction=amplitude_2)
extrude_2 = Extrude(Base=move.Geometry, Direction=amplitude_4)
solid_intersection = SolidIntersection(BrepsA=extrude_2, BrepsB=extrude)
mesh_brep = MeshBrep(
    Brep=solid_intersection,
    Settings={GridMaxCount=0, GridMinCount=16, JaggedSeams=False, MaxEdgeLength=0, MinEdgeLength=0.0001, MinTolerance=0, Refine=True, RefineAngle=0, RelativeTolerance=0.65, SimplePlanes=True, Tolerance=0})
cropping_mesh_for_bolteable_pointcloud = Mesh(mesh_brep)

# ---- group: Trim cloud based on Wedge slope surface, then compute normals
cloudmeshcrop = CloudMeshCrop(PointCloud=pointcloud_with_normals_2, Meshes=cropping_mesh_for_bolteable_pointcloud, Inverse=False)
cloudexplode = CloudExplode(PointCloud=cloudmeshcrop)  # -> Points, Normals, Colors

# ---- group: Get pointcloud subparallel to SWedge Slope Surface (continued)
angle = Angle(VectorA=face_normals.Normals, VectorB=cloudexplode.Normals)  # -> Angle, Reflex
degrees = Degrees(Radians=angle.Angle)
includes = Includes(Value=degrees, Domain=[construct_domain_2, construct_domain])  # -> Includes, Deviation

# ----
cull_pattern = CullPattern(List=cloudexplode.Points, CullPattern=includes.Includes)
points_subparallel_to_swedge_slope_surfa = Point(cull_pattern)  # "Points subparallel to SWedge Slope Surface"
points_subparallel_to_swedge_slope_surfa_2 = ClusterOutput(points_subparallel_to_swedge_slope_surfa)  # "Points subparallel to SWedge Slope Surface"

# ==== cluster AvailableBoltPointsAndLines_2: Find available bolt points bolt lines grouped by bolt lengths based on minimum bolt spacing and bolt direction.
bolting_point_spacing_m = ClusterInput()

library_of_bolt_lengths_m = ClusterInput()
bolt_direction = ClusterInput()
brep_for_bolt_projection = ClusterInput()
minimum_anchoring_length_m = ClusterInput()
sorted_bolting_point_options = ClusterInput()
minimum_anchoring_length_m_2 = Number(minimum_anchoring_length_m)
bolting_point_spacing_m_2 = Number(bolting_point_spacing_m)
library_of_bolt_lengths_m_2 = Number(library_of_bolt_lengths_m)
bolt_direction_2 = Vector(bolt_direction)
brep_for_bolt_projection_2 = Brep(brep_for_bolt_projection)

sorted_bolting_point_options_2 = Point(sorted_bolting_point_options)

# ---- group: Cull bolting points based on bolting spacing
multiplication = Multiplication(A=bolting_point_spacing_m_2, B="0.9")
cull_duplicates = CullDuplicates(Points=sorted_bolting_point_options_2, Tolerance=multiplication, CullMode=1)  # -> Points, Indices, Valence
sorted_bolting_point = Point(sorted_bolting_point_options_2)

# ---- group: Choose first N points with shortest drilling length / Joint brep of sliding planes and tension crack
brep_join = BrepJoin(Breps=flatten(brep_for_bolt_projection_2))  # -> Breps, Closed

# ---- group: Choose first N points with shortest drilling length
project_point = ProjectPoint(Point=sorted_bolting_point, Direction=bolt_direction_2, Geometry=brep_join.Breps)  # -> Point, Index
line = Line(StartPoint=sorted_bolting_point, EndPoint=project_point.Point)
extend_curve = ExtendCurve(Curve=line, Type=0, Start="0", End=minimum_anchoring_length_m_2)
null_item = NullItem(Item=extend_curve)  # -> NullFlags, InvalidFlags, Description
cull_pattern = CullPattern(List=extend_curve, CullPattern=invert(null_item.NullFlags))
length = Length(Curve=cull_pattern)

# ---- group: Remap necessary bolt length to bolt library
library_of_bolt_lengths_m_3 = Number(library_of_bolt_lengths_m_2)
necessary_bolt_length = Number(length)
round_to_nearest = RoundToNearest(NumbersX=necessary_bolt_length, NumbersY=library_of_bolt_lengths_m_3, RemapX=False)  # -> Nearest, Index, Difference, RemappedX
expression = Expression(x=necessary_bolt_length, Nearest=round_to_nearest.Nearest, Expression="If(Nearest<x, 1, 0)")
addition = Addition(A=expression, B=round_to_nearest.Index)
list_item = ListItem(List=library_of_bolt_lengths_m_3, Index=addition, Wrap=invert(True))
standard_bolt_lengths = Number(flatten(list_item))

# ----
panel = Panel(cull_duplicates.Indices)

# ---- group: Sort bolt length, return exact number of required bolts
null_item_2 = NullItem(Item=project_point.Point)  # -> NullFlags, InvalidFlags, Description
cull_pattern_2 = CullPattern(List=sorted_bolting_point, CullPattern=invert(null_item_2.NullFlags))
null_item_3 = NullItem(Item=list_item)  # -> NullFlags, InvalidFlags, Description
round_to_decimal_place = RoundToDecimalPlace(NumberX=library_of_bolt_lengths_m_3, DecimalPlace="1", RoundType=0)  # -> Rounded, Difference

# ---- group: Sort bolt length, return exact number of required bolts / Remove bolt point if standard bolt length not possible
cull_pattern_3 = CullPattern(List=cull_pattern_2, CullPattern=invert(null_item_3.NullFlags))

# ---- group: Sort bolt length, return exact number of required bolts / Remove bolt length if standard bolt length not possible
cull_pattern_4 = CullPattern(List=list_item, CullPattern=invert(null_item_3.NullFlags))

# ---- group: Sort bolt length, return exact number of required bolts (continued)
line_sdl = LineSDL(Start=cull_pattern_3, Direction=bolt_direction_2, Length=cull_pattern_4)
length_2 = Length(Curve=line_sdl)
round_to_decimal_place_2 = RoundToDecimalPlace(NumberX=length_2, DecimalPlace="1", RoundType=0)  # -> Rounded, Difference
equality = Equality(FirstNumber=round_to_decimal_place_2.Rounded, SecondNumber=graft(round_to_decimal_place.Rounded))  # -> Equality, Inequality
mass_addition = MassAddition(Input=equality.Equality)  # -> simplify(Result), PartialResults
available_bolt_points_numbers_grouped_by = Integer(mass_addition.Result)  # "Available bolt points numbers grouped by lengths"

# ----
cull_pattern_5 = CullPattern(List=line_sdl, CullPattern=equality.Equality)  # -> simplify(List)
available_bolt_lines = Line(cull_pattern_5)

available_bolt_points_numbers_grouped_by_2 = ClusterOutput(available_bolt_points_numbers_grouped_by)  # "Available bolt points numbers grouped by lengths"
available_bolt_lines_2 = ClusterOutput(available_bolt_lines)

# ==== cluster WedgeNewFSSystemBasal
volume = ClusterInput()
e_cap_seismic = ClusterInput()
joint = ClusterInput()
c_i = ClusterInput()

gamma_r = ClusterInput()
h_w = ClusterInput()
a_t = ClusterInput()
wedge_upper_face_mesh = ClusterInput()
wedge_slope_face_mesh = ClusterInput()
phi_2_r = ClusterInput()
joint_water_pressure = ClusterInput()
percentage_fill = ClusterInput()
u_1 = ClusterInput()
u_2 = ClusterInput()
slope_dip = ClusterInput()
slope_dip_direction = ClusterInput()
phi_1_r = ClusterInput()
u_t = ClusterInput()
c_1 = ClusterInput()
phi_1 = ClusterInput()
block_brep = ClusterInput()
k = ClusterInput()
e_cap_bolt_passive = ClusterInput()
e_cap_bolt_active = ClusterInput()
c_passive = ClusterInput()
c_active = ClusterInput()
e_cap_bolt_passive_2 = UnitDirectionOfPassiveBolt(e_cap_bolt_passive)
c_passive_2 = CapacityOfPassiveBolt(c_passive)
c_active_2 = CapcaityOfActiveBolt(c_active)
e_cap_bolt_active_2 = UnitDirectionOfActiveBolt(e_cap_bolt_active)
h_w_2 = VerticalHeightOfLineOfIntersection(h_w)
a_t_2 = AreaOfTensionCrack(a_t)
block_brep_2 = Brep(block_brep)
phi_2_r_2 = FrictionAngleOfJoint2(phi_2_r)
k_2 = Number(k)
e_cap_seismic_2 = DirectionOfSeismicForce(e_cap_seismic)
c_i_2 = IndividualExternalForceVectors(c_i)
joint_water_pressure_2 = JointWaterPressure(joint_water_pressure)
percentage_fill_2 = PercentageFill(percentage_fill)
u_1_2 = ConstantPressureOnJoint1(u_1)
u_2_2 = ConstantPressureOnJoint2(u_2)
phi_1_r_2 = FrictionAngleOfJoint1(phi_1_r)
right_joint_dip = Number()
right_joint_dip_direction = Number()
slope_dip_2 = Number(slope_dip)
slope_dip_direction_2 = Number(slope_dip_direction)
c_1_2 = CohesionOfJoint1(c_1)
phi_1_2 = FrictionAngleOfJoint1(phi_1)
u_t_2 = ConstantPressureOnTensionCrack(u_t)
gamma_r_2 = UnitWeightOfRock(gamma_r)
wedge_upper_face_mesh_2 = Mesh(wedge_upper_face_mesh)
wedge_slope_face_mesh_2 = Mesh(wedge_slope_face_mesh)

volume_2 = Number(volume)
joint_2 = Geometry(joint)

# ----
# Active support - Ultimate load
# Active support - FS for shear failure
# Passive support - Ultimate laod
panel = Panel("0")

# ----
# "C:\Users\KYC\OneDrive - NGI\Documents\PhD\OneDrive-Code\GH\Wedge New FS Basal.ghcluster"
cluster = Cluster_2(
    unit_weight_of_rock=gamma_r_2,
    h_w=h_w_2,
    area_of_tension_crack=a_t_2,
    joint=joint_2,
    block_brep=block_brep_2,
    volume=volume_2,
    wedge_slope_face_mesh=wedge_slope_face_mesh_2,
    wedge_upper_face_mesh=wedge_upper_face_mesh_2,
    slope_dip=slope_dip_2,
    slope_dip_direction=slope_dip_direction_2,
    cohesion_of_joint_1=c_1_2,
    friction_angle_of_joint_1=phi_1_2,
    k=k_2,
    direction_of_seismic_force=e_cap_seismic_2,
    individual_external_force_vectors=c_i_2,
    joint_water_pressure=joint_water_pressure_2,
    percentage_fill=percentage_fill_2,
    constant_pressure_on_joint_1=u_1_2,
    constant_pressure_on_joint_2=u_2_2,
    constant_pressure_on_tension_crack=u_t_2,
    capcaity_of_active_bolt=c_active_2,
    unit_direction_of_active_bolt=e_cap_bolt_active_2,
    capacity_of_passive_bolt=panel,
    unit_direction_of_passive_bolt="{0,0,0}",
    trace_length_of_joint_1_on_slope_face=panel,
    trace_length_of_joint_2_on_slope_face=panel,
    shotcrete_thickness=panel,
    shotcrete_shear_strength=panel,
    area_where_slope_face_of_block_and_shotc=panel,
    unit_weight_of_shotcrete=panel,
    active_pressure_magnitude_on_slope_face=panel,
    trend_plunge_of_active_slope_pressure="{0,0,0}",
    active_pressure_magnitude_on_upper_face=panel,
    trend_plunge_of_active_upper_face_pressu="{0,0,0}",
    passive_pressure_magnitude_on_slope_face=panel,
    trend_plunge_of_passive_slope_pressure="{0,0,0}",
    passive_pressure_magnitude_on_upper_face=panel,
    trend_plunge_of_passive_upper_face_press="{0,0,0}")  # -> factor_of_safety, sliding_direction_number_4, sliding_joint_index_5, driving_force_4, resisting_force_4, sliding_direction_unit_vector_3, normal_force_on_joints_mn_3, shear_resistance_on_joints_mn_4
cluster_2 = Cluster_2(
    unit_weight_of_rock=gamma_r_2,
    h_w=h_w_2,
    area_of_tension_crack=a_t_2,
    joint=joint_2,
    block_brep=block_brep_2,
    volume=volume_2,
    wedge_slope_face_mesh=wedge_slope_face_mesh_2,
    wedge_upper_face_mesh=wedge_upper_face_mesh_2,
    slope_dip=slope_dip_2,
    slope_dip_direction=slope_dip_direction_2,
    cohesion_of_joint_1=c_1_2,
    friction_angle_of_joint_1=phi_1_2,
    k=k_2,
    direction_of_seismic_force=e_cap_seismic_2,
    individual_external_force_vectors=c_i_2,
    joint_water_pressure=joint_water_pressure_2,
    percentage_fill=percentage_fill_2,
    constant_pressure_on_joint_1=u_1_2,
    constant_pressure_on_joint_2=u_2_2,
    constant_pressure_on_tension_crack=u_t_2,
    capcaity_of_active_bolt=c_passive_2,
    unit_direction_of_active_bolt=e_cap_bolt_active_2,
    capacity_of_passive_bolt=panel,
    unit_direction_of_passive_bolt="{0,0,0}",
    trace_length_of_joint_1_on_slope_face=panel,
    trace_length_of_joint_2_on_slope_face=panel,
    shotcrete_thickness=panel,
    shotcrete_shear_strength=panel,
    area_where_slope_face_of_block_and_shotc=panel,
    unit_weight_of_shotcrete=panel,
    active_pressure_magnitude_on_slope_face=panel,
    trend_plunge_of_active_slope_pressure="{0,0,0}",
    active_pressure_magnitude_on_upper_face=panel,
    trend_plunge_of_active_upper_face_pressu="{0,0,0}",
    passive_pressure_magnitude_on_slope_face=panel,
    trend_plunge_of_passive_slope_pressure="{0,0,0}",
    passive_pressure_magnitude_on_upper_face=panel,
    trend_plunge_of_passive_upper_face_press="{0,0,0}")  # -> factor_of_safety, sliding_direction_number_4, sliding_joint_index_5, driving_force_4, resisting_force_4, sliding_direction_unit_vector_3, normal_force_on_joints_mn_3, shear_resistance_on_joints_mn_4
cluster_3 = Cluster_2(
    unit_weight_of_rock=gamma_r_2,
    h_w=h_w_2,
    area_of_tension_crack=a_t_2,
    joint=joint_2,
    block_brep=block_brep_2,
    volume=volume_2,
    wedge_slope_face_mesh=wedge_slope_face_mesh_2,
    wedge_upper_face_mesh=wedge_upper_face_mesh_2,
    slope_dip=slope_dip_2,
    slope_dip_direction=slope_dip_direction_2,
    cohesion_of_joint_1=panel,
    friction_angle_of_joint_1=phi_1_r_2,
    k=k_2,
    direction_of_seismic_force=e_cap_seismic_2,
    individual_external_force_vectors=c_i_2,
    joint_water_pressure=joint_water_pressure_2,
    percentage_fill=percentage_fill_2,
    constant_pressure_on_joint_1=u_1_2,
    constant_pressure_on_joint_2=u_2_2,
    constant_pressure_on_tension_crack=u_t_2,
    capcaity_of_active_bolt=panel,
    unit_direction_of_active_bolt=e_cap_bolt_active_2,
    capacity_of_passive_bolt=c_passive_2,
    unit_direction_of_passive_bolt="{0,0,0}",
    trace_length_of_joint_1_on_slope_face=panel,
    trace_length_of_joint_2_on_slope_face=panel,
    shotcrete_thickness=panel,
    shotcrete_shear_strength=panel,
    area_where_slope_face_of_block_and_shotc=panel,
    unit_weight_of_shotcrete=panel,
    active_pressure_magnitude_on_slope_face=panel,
    trend_plunge_of_active_slope_pressure="{0,0,0}",
    active_pressure_magnitude_on_upper_face=panel,
    trend_plunge_of_active_upper_face_pressu="{0,0,0}",
    passive_pressure_magnitude_on_slope_face=panel,
    trend_plunge_of_passive_slope_pressure="{0,0,0}",
    passive_pressure_magnitude_on_upper_face=panel,
    trend_plunge_of_passive_upper_face_press="{0,0,0}")  # -> factor_of_safety, sliding_direction_number_4, sliding_joint_index_5, driving_force_4, resisting_force_4, sliding_direction_unit_vector_3, normal_force_on_joints_mn_3, shear_resistance_on_joints_mn_4

panel_2 = Panel(cluster.sliding_direction_number_4)
larger_than = LargerThan(FirstNumber=cluster.factor_of_safety, SecondNumber="1")  # -> LargerThan, OrEqualTo
fs_c_active = Number(cluster_2.factor_of_safety)
panel_3 = Panel(cluster_2.sliding_direction_number_4)
fs_c_passive = Number(cluster_3.factor_of_safety)
pick_n_choose = PickNChoose(Pattern=larger_than.OrEqualTo, Stream0=fs_c_passive, Stream1=fs_c_active)

panel_4 = Panel(cluster.resisting_force_4)
panel_5 = Panel(cluster.driving_force_4)

sliding_direction_number = Integer(cluster.sliding_direction_number_4)
sliding_direction_unit_vector = Vector(cluster.sliding_direction_unit_vector_3)
fs_s = Number(cluster.factor_of_safety)
fs_system = Number(fs_s)
sliding_joint_index = Text(cluster.sliding_joint_index_5)
fs_c = Number(pick_n_choose)
shear_resistance_on_joints_mn = Text(cluster.shear_resistance_on_joints_mn_4)
normal_force_on_joints_mn = Text(cluster.normal_force_on_joints_mn_3)
resisting_force = Number(cluster.resisting_force_4)
driving_force = Number(cluster.driving_force_4)
fs_system_2 = ClusterOutput(fs_system)
fs_s_2 = ClusterOutput(fs_s)
sliding_direction_number_2 = ClusterOutput(sliding_direction_number)  # Sliding direction number: 0 = Unconditionally stable; 1 = Falling or lifting; 2 = Sliding on more than two joints; 3 = Sliding on single joint; 4 = Sliding on joint intersection
fs_c_2 = ClusterOutput(fs_c)
sliding_joint_index_2 = ClusterOutput(sliding_joint_index)
driving_force_2 = ClusterOutput(driving_force)
resisting_force_2 = ClusterOutput(resisting_force)
shear_resistance_on_joints_mn_2 = ClusterOutput(shear_resistance_on_joints_mn)
normal_force_on_joints_mn_2 = ClusterOutput(normal_force_on_joints_mn)
sliding_direction_unit_vector_2 = ClusterOutput(sliding_direction_unit_vector)

# ==== cluster WedgeVolume_Cloud_CutterSurface2Brep
othertrimmingsurface_s = ClusterInput()
lower_bounding_xy_plane = ClusterInput()
patch_surface = ClusterInput()
cloud = ClusterInput()
point_in_wedge = ClusterInput()
leftjointsurface = ClusterInput()
rightjointsurface = ClusterInput()
tensioncracksurface = ClusterInput()
top_trim_domain_start = ClusterInput()
clip_lower_boundary = ClusterInput()
top_trim_domain_end = ClusterInput()
top_trim_domain_start_2 = Number(top_trim_domain_start)

# ---- group: Inputs
othertrimmingsurface_s_2 = Surface(othertrimmingsurface_s)
point_in_wedge_2 = Point(point_in_wedge)
leftjointsurface_2 = Surface(leftjointsurface)
rightjointsurface_2 = Surface(rightjointsurface)
tensioncracksurface_2 = Surface(tensioncracksurface)
cloud_2 = Cloud(cloud)

# ----
top_trim_domain_end_2 = Number(top_trim_domain_end)
patch_surface_2 = Brep(patch_surface)
clip_lower_boundary_2 = Boolean(clip_lower_boundary)

# ----
# 1. Trim PointCloud with cutter Planes
# Left joint
is_planar = IsPlanar(Surface=leftjointsurface_2, Interior=True)  # -> Planar, Plane
is_planar_2 = IsPlanar(Surface=tensioncracksurface_2, Interior=True)  # -> Planar, Plane
is_planar_3 = IsPlanar(Surface=rightjointsurface_2, Interior=True)  # -> Planar, Plane
is_planar_4 = IsPlanar(Surface=othertrimmingsurface_s_2, Interior=True)  # -> Planar, Plane
re_orient_cutter_plane = ReOrientCutterPlane(point_in_wedge=point_in_wedge_2, cutter_plane=is_planar.Plane)
# Right joint
re_orient_cutter_plane_2 = ReOrientCutterPlane(point_in_wedge=point_in_wedge_2, cutter_plane=is_planar_3.Plane)
# Tension crack
re_orient_cutter_plane_3 = ReOrientCutterPlane(point_in_wedge=point_in_wedge_2, cutter_plane=is_planar_2.Plane)
# Other trimming surface(s)
re_orient_cutter_plane_4 = ReOrientCutterPlane(point_in_wedge=point_in_wedge_2, cutter_plane=simplify(graft(is_planar_4.Plane)))
merge = Merge(
    Data1=re_orient_cutter_plane,
    Data2=re_orient_cutter_plane_2,
    Data3=re_orient_cutter_plane_3,
    Data4=re_orient_cutter_plane_4)  # -> flatten(Result)

# ----
# 0. Unit vector pointing inwards from line of intersection along XY plane
brep_brep = BrepBrep(BrepA=leftjointsurface_2, BrepB=rightjointsurface_2)  # -> Curves, Points
end_points = EndPoints(Curve=brep_brep.Curves)  # -> Start, End
deconstruct = Deconstruct(Point=end_points.Start)  # -> XComponent, YComponent, ZComponent
deconstruct_2 = Deconstruct(Point=end_points.End)  # -> XComponent, YComponent, ZComponent
smaller_than = SmallerThan(FirstNumber=deconstruct.ZComponent, SecondNumber=deconstruct_2.ZComponent)  # -> SmallerThan, OrEqualTo
line = Line(StartPoint=end_points.End, EndPoint=end_points.Start)
pick_n_choose = PickNChoose(Pattern=smaller_than.OrEqualTo, Stream0=line, Stream1=brep_brep.Curves)
project = Project(Geometry=pick_n_choose, Plane=PlaneXY(0, 0, 0))  # -> Geometry, Transform
unit_vector = UnitVector(Vector=project.Geometry)

entwine = Entwine(
    Branch00=re_orient_cutter_plane,
    Branch01=re_orient_cutter_plane_2,
    Branch02=re_orient_cutter_plane_3,
    Branch03=re_orient_cutter_plane_4,
    FlattenInputs=True)  # -> simplify(Result)
tree_statistics = TreeStatistics(Tree=entwine)  # -> Paths, Length, Count
duplicate_data = DuplicateData(Data=simplify(graft(tree_statistics.Paths)), Number=simplify(graft(tree_statistics.Length)), Order=True)  # -> flatten(Data)

# ---- group: Determine best-fit plane and Z-axis of patch surface outline
brep = Brep(patch_surface_2)
# 3. Create solid from patch surface and ruled surface
brep_edges = BrepEdges(Brep=brep)  # -> Naked, Interior, NonManifold
join_curves = JoinCurves(Curves=brep_edges.Naked, Preserve=False)
explode = Explode(Curve=join_curves, Recursive=True)  # -> Segments, Vertices
plane_normal = PlaneNormal(Origin=Point(0, 0, 0), ZAxis=unit_vector)
plane_fit = PlaneFit(Points=explode.Vertices)  # -> Plane, Deviation
flip_plane = FlipPlane(Plane=plane_fit.Plane, Guide=plane_normal, FlipX=False, FlipY=False, FlipZ=True)  # -> Flipped, ResultBoolean
deconstruct_plane = DeconstructPlane(Plane=flip_plane.Flipped)  # -> Origin, XAxis, YAxis, ZAxis

# ----
# 2. Create bounding box of point cloud, then split with cutting planes
cloud_3 = Cloud(cloud_2)

# ---- group: Find highest point of wedge
bounding_rectangle = BoundingRectangle(Geometry=cloud_3, Plane=PlaneXY(0, 0, 0), Axis=0, Slide="1", Union=True)  # -> Bounding, DimensionX, DimensionY
line_plane = LinePlane(Line=brep_brep.Curves, Plane=bounding_rectangle.Bounding)  # -> Point, ParamL, ParamP

# ---- group: Determine daylighting point (maybe empty)
brep_line = BrepLine(Brep=patch_surface_2, Line=brep_brep.Curves, LimitToFirst=False)  # -> Curves, flatten(Points)
deconstruct_3 = Deconstruct(Point=brep_line.Points)  # -> XComponent, YComponent, ZComponent
sort_list = SortList(Keys=deconstruct_3.ZComponent, ValuesValuesA=brep_line.Points)  # -> Keys, ValuesValuesA
daylighting_point = Point(sort_list.ValuesValuesA)

# ----
lower_bounding_xy_plane_2 = Plane(lower_bounding_xy_plane)

# ---- group: Create bounding box with highest and lowest possible points
plane_normal_2 = PlaneNormal(Origin=Point(0, 0, 0), ZAxis=unit_vector)
bounding_box = BoundingBox(Content=flatten([cloud_3, line_plane.Point, daylighting_point]), Plane=plane_normal_2, UnionBox=True)  # -> Box, Box_2

# ---- group: Clip bounding box with lower boundary
brep_plane = BrepPlane(Brep=bounding_box.Box, Plane=lower_bounding_xy_plane_2)  # -> Curves, Points
split_brep = SplitBrep(Brep=bounding_box.Box, Cutter=brep_plane.Curves)
cap_holes = CapHoles(Brep=split_brep)
point_in_brep = PointInBrep(Brep=cap_holes, Point=point_in_wedge_2, Strict=False)
cull_pattern = CullPattern(List=cap_holes, CullPattern=point_in_brep)

# ---- group: Pick lower bounding plane if yes
pick_n_choose_2 = PickNChoose(Pattern=clip_lower_boundary_2, Stream0=bounding_box.Box, Stream1=cull_pattern)
relevant_bounding_box = Brep(pick_n_choose_2)

# ---- group: Create solid with patch surface
bounding_rectangle_2 = BoundingRectangle(Geometry=relevant_bounding_box, Plane=flip_plane.Flipped, Axis=0, Slide="1", Union=True)  # -> Bounding, DimensionX, DimensionY
project_along = ProjectAlong(Geometry=join_curves, Plane=bounding_rectangle_2.Bounding, Direction=deconstruct_plane.ZAxis)  # -> Geometry, Transform
ruled_surface = RuledSurface(CurveA=join_curves, CurveB=project_along.Geometry)
brep_2 = Brep(project_along.Geometry)
brep_join = BrepJoin(Breps=flatten([brep_2, ruled_surface, brep]))  # -> Breps, Closed
closed_brep_from_patch_surface = Brep(brep_join.Breps)

# ---- group: Trim point cloud with cutter planes and get 3D convex hull polygon
plane_clip = PlaneClip(Plane=merge)
cloud_engine = CloudEngine(Cloud=cloud_2, Instruction0=plane_clip)
deconstruct_cloud = DeconstructCloud(Cloud=cloud_engine)  # -> Points, Normals, Colors
convex_hull = ConvexHull(Points=deconstruct_cloud.Points, Plane=PlaneXY(0, 0, 0))  # -> Hull, HullZ, Indices

# ---- group: trim away lower half of 3D convex hull polygon
patch = Patch(Curves=convex_hull.HullZ, Spans="2", Flexibility=1, Trim=True)
area = Area(Geometry=patch)  # -> Area, Centroid
xy_plane = XYPlane(Origin=area.Centroid)
plane_trim_curve = PlaneTrimCurve(Curve=convex_hull.HullZ, Plane=xy_plane, Flip=False)  # -> Trimmed, Parameters, Intersected

# ---- group: Manually trim curve
top_trim_domain_start_3 = Number(top_trim_domain_start_2)
reparameterize_curve = ReparameterizeCurve(Curve=plane_trim_curve.Trimmed)  # -> Reparameterized, Original
top_trim_domain_end_3 = Number(top_trim_domain_end_2)
merge_2 = Merge(Data1=top_trim_domain_start_3, Data2=top_trim_domain_end_3)
points_trim_curve = PointsTrimCurve(Curve=reparameterize_curve.Reparameterized, Parameters=merge_2, Flip=invert(False))  # -> Trimmed, SubDomains, Intersected

# ---- group: Extrude the curve with an arbitrary length
amplitude = Amplitude(Vector=unit_vector, Amplitude="25")
amplitude_2 = Amplitude(Vector=unit_vector, Amplitude="-50")
move = Move(Geometry=points_trim_curve.Trimmed, Motion=amplitude)  # -> Geometry, Transform
extrude = Extrude(Base=move.Geometry, Direction=amplitude_2)

# ----
# 5. Get wedge as solid, then trim the top.
extruded_brep = Brep(extrude)
curve = Curve(points_trim_curve.Trimmed)
vector = Vector(unit_vector)

# ---- group: Get top trimming curve (ensure curve is not folding below)
unit_z = UnitZ(Factor=1)
unit_z_2 = UnitZ(Factor=1)
construct_plane = ConstructPlane(Origin=Point(0, 0, 0), XAxis=vector, YAxis=Vector(0, 1, 0))
flip_plane_2 = FlipPlane(Plane=construct_plane, Guide=unit_z_2, FlipX=False, FlipY=False, FlipZ=True)  # -> Flipped, ResultBoolean
bounding_box_2 = BoundingBox(Content=extruded_brep, Plane=flip_plane_2.Flipped, UnionBox=True)  # -> Box, Box_2
evaluate_box = EvaluateBox(Box=bounding_box_2.Box, UParameter=0.5, VParameter=0.5, WParameter="1.2")  # -> Plane, Point, Include
bounding_rectangle_3 = BoundingRectangle(Geometry=extruded_brep, Plane=evaluate_box.Plane, Axis=0, Slide="1.2", Union=True)  # -> Bounding, DimensionX, DimensionY
brep_3 = Brep(bounding_rectangle_3.Bounding)
explode_2 = Explode(Curve=curve, Recursive=True)  # -> Segments, Vertices
curve_middle = CurveMiddle(Curve=explode_2.Segments)
project_point = ProjectPoint(Point=curve_middle, Direction=unit_z, Geometry=brep_3)  # -> Point, Index
line_2 = Line(StartPoint=curve_middle, EndPoint=project_point.Point)
brep_line_2 = BrepLine(Brep=extruded_brep, Line=line_2, LimitToFirst=False)  # -> Curves, Points
list_length = ListLength(List=brep_line_2.Points)  # -> flatten(Length)
larger_than = LargerThan(FirstNumber=list_length, SecondNumber="1")  # -> LargerThan, OrEqualTo
cull_pattern_2 = CullPattern(List=explode_2.Segments, CullPattern=invert(larger_than.LargerThan))
join_curves_2 = JoinCurves(Curves=cull_pattern_2, Preserve=False)
extend_curve = ExtendCurve(Curve=join_curves_2, Type=0, Start="50", End="50")

# ---- group: Extrude the curve with an arbitrary length to both side, then extrude upwards to form a closed brep
move_2 = Move(Geometry=extend_curve, Motion=amplitude)  # -> Geometry, Transform
extrude_2 = Extrude(Base=move_2.Geometry, Direction=amplitude_2)
unit_z_3 = UnitZ(Factor=Slider(100, range=0..100))
extrude_3 = Extrude(Base=extrude_2, Direction=unit_z_3)
top_trimming_solid = Brep(extrude_3)

# ---- group: Splitting bounding box by solid difference
deconstruct_plane_2 = DeconstructPlane(Plane=merge)  # -> Origin, XAxis, YAxis, ZAxis
brep_plane_2 = BrepPlane(Brep=relevant_bounding_box, Plane=merge)  # -> simplify(Curves), Points
brep_4 = Brep(brep_plane_2.Curves)
amplitude_3 = Amplitude(Vector=deconstruct_plane_2.ZAxis, Amplitude="-50")
area_2 = Area(Geometry=brep_4)  # -> Area, Centroid
scale = Scale(Geometry=brep_4, Center=area_2.Centroid, Factor="3")  # -> Geometry, Transform
extrude_4 = Extrude(Base=scale.Geometry, Direction=simplify(graft(amplitude_3)))
solid_union = SolidUnion(Breps=flatten(extrude_4))

# ---- group: Splitting bounding box by solid difference / Solid bounding wedge
solid_difference = SolidDifference(BrepsA=relevant_bounding_box, BrepsB=solid_union)

# ---- group: Splitting bounding box by solid difference (continued)
closed_brep_from_splitted_bounding_box = Brep(solid_difference)

# ---- group: Solid intersection
solid_intersection = SolidIntersection(BrepsA=flatten(closed_brep_from_splitted_bounding_box), BrepsB=flatten(closed_brep_from_patch_surface))  # -> flatten(Result)
brep_closest_point = BrepClosestPoint(Point=point_in_wedge_2, Brep=solid_intersection)  # -> Point, Normal, Distance
sort_list_2 = SortList(Keys=brep_closest_point.Distance, ValuesValuesA=solid_intersection)  # -> Keys, ValuesValuesA
first_last = FirstLast(List=sort_list_2.ValuesValuesA)  # -> FirstValue, LastValue
top_untrimmed_wedge_brep = Brep(first_last.LastValue)

# ---- group: Split brep and determine the final wedge
solid_difference_2 = SolidDifference(BrepsA=top_untrimmed_wedge_brep, BrepsB=extrude_3)
wedge_brep = Brep(solid_difference_2)

# ----
# 6. Get the trimmed cutter breps on the wedge
deconstruct_brep = DeconstructBrep(Brep=wedge_brep)  # -> Faces, Edges, Vertices
area_3 = Area(Geometry=deconstruct_brep.Faces)  # -> Area, Centroid
point_plane_side = PointPlaneSide(Point=area_3.Centroid, Plane=graft(merge))  # -> Side, Front, Back, Distance
invert_boolean = InvertBoolean(Boolean=point_plane_side.Side)  # -> Inverted, Number

# ----
# 7. Get the trimmed slope surface of the wedge
brep_closest_point_2 = BrepClosestPoint(Point=point_in_wedge_2, Brep=deconstruct_brep.Faces)  # -> Point, Normal, Distance
sort_list_3 = SortList(Keys=brep_closest_point_2.Distance, ValuesValuesA=deconstruct_brep.Faces)  # -> Keys, ValuesValuesA
first_last_2 = FirstLast(List=sort_list_3.ValuesValuesA)  # -> FirstValue, LastValue
block_slope_surface = Brep(first_last_2.FirstValue)

# ---- group: If the cutter plane is null, the Point Plane Side results will just be zeros
mass_addition = MassAddition(Input=point_plane_side.Side)  # -> flatten(Result), PartialResults
equality = Equality(FirstNumber=mass_addition.Result, SecondNumber="0")  # -> Equality, Inequality
invert_boolean_2 = InvertBoolean(Boolean=equality.Equality)  # -> Inverted, Number

# ----
area_4 = Area(Geometry=block_slope_surface)  # -> Area, Centroid
square_root = SquareRoot(Value=area_4.Area)
multiplication = Multiplication(A=square_root, B="10")

multiplication_2 = Multiplication(A=invert_boolean.Inverted, B=graft(invert_boolean_2.Inverted))
cull_pattern_3 = CullPattern(List=deconstruct_brep.Faces, CullPattern=simplify(multiplication_2))  # -> simplify(List)

brep_join_2 = BrepJoin(Breps=cull_pattern_3)  # -> Breps, Closed

panel = Panel(brep_join_2.Breps)
trimmed_cutter_breps_on_wedge = Brep(brep_join_2.Breps)

create_tree = CreateTree(Data=trimmed_cutter_breps_on_wedge, Path=duplicate_data, Ensure=tree_statistics.Paths)
explode_tree = ExplodeTree(Data=create_tree)  # -> Branch0, Branch1, Branch2, Branch3

# ---- group: Output
wedge_brep_2 = Brep(wedge_brep)
left_joint_trimmed_cutter_brep = Brep(explode_tree.Branch0)
right_joint_trimmed_cutter_brep = Brep(explode_tree.Branch1)
tension_crack_trimmed_cutter_brep = Brep(explode_tree.Branch2)
block_slope_surface_2 = Surface(block_slope_surface)
other_joints_trimmed_cutter_brep = Brep(explode_tree.Branch3)

# ----
wedge_brep_3 = ClusterOutput(wedge_brep_2)
left_joint_trimmed_cutter_brep_2 = ClusterOutput(left_joint_trimmed_cutter_brep)
right_joint_trimmed_cutter_brep_2 = ClusterOutput(right_joint_trimmed_cutter_brep)
tension_crack_trimmed_cutter_brep_2 = ClusterOutput(tension_crack_trimmed_cutter_brep)
other_joints_trimmed_cutter_brep_2 = ClusterOutput(other_joints_trimmed_cutter_brep)
block_slope_surface_3 = ClusterOutput(block_slope_surface_2)

# ==== cluster MeshDipDipDirection
mesh = ClusterInput()
surface = Surface([<surface referenced from the Rhino model> x2])
mesh_2 = Mesh(mesh)
mesh_brep = MeshBrep(
    Brep=surface,
    Settings={GridMaxCount=0, GridMinCount=16, JaggedSeams=False, MaxEdgeLength=0, MinEdgeLength=0.0001, MinTolerance=0, Refine=True, RefineAngle=0, RelativeTolerance=0.65, SimplePlanes=True, Tolerance=0})

# ----
# Get dip and dip direction of mesh
face_normals = FaceNormals(Mesh=mesh_2)  # -> Centers, Normals
average = Average(Input=face_normals.Normals)  # -> flatten(ArithmeticMean)
null_item = NullItem(Item=average)  # -> NullFlags, InvalidFlags, Description
list_indices = ListIndices(List=average)
cull_pattern = CullPattern(List=list_indices, CullPattern=null_item.NullFlags)
replace_items = ReplaceItems(List=average, Item="{0,0,0}", Indices=cull_pattern, Wrap=False)
deconstruct_vector = DeconstructVector(Vector=replace_items)  # -> XComponent, YComponent, ZComponent
larger_than = LargerThan(FirstNumber=deconstruct_vector.ZComponent, SecondNumber="0")  # -> LargerThan, OrEqualTo
vector_xyz = VectorXYZ(XComponent=deconstruct_vector.XComponent, YComponent=deconstruct_vector.YComponent, ZComponent=0)  # -> Vector, Length
reverse = Reverse(Vector=vector_xyz.Vector)
pick_n_choose = PickNChoose(Pattern=larger_than.LargerThan, Stream0=reverse, Stream1=vector_xyz.Vector)
deconstruct_vector_2 = DeconstructVector(Vector=pick_n_choose)  # -> XComponent, YComponent, ZComponent
unit_y = UnitY(Factor=1)
larger_than_2 = LargerThan(FirstNumber=deconstruct_vector_2.XComponent, SecondNumber="0")  # -> LargerThan, OrEqualTo
angle = Angle(VectorA=vector_xyz.Vector, VectorB=average)  # -> Angle, Reflex
angle_2 = Angle(VectorA=unit_y, VectorB=pick_n_choose)  # -> Angle, Reflex
degrees = Degrees(Radians=angle.Angle)
pick_n_choose_2 = PickNChoose(Pattern=larger_than_2.LargerThan, Stream0=angle_2.Reflex, Stream1=angle_2.Angle)
subtraction = Subtraction(A="90", B=degrees)
degrees_2 = Degrees(Radians=pick_n_choose_2)
absolute = Absolute(Value=subtraction)

# ----
# Return to "null" if input is "null"
null_item_2 = NullItem(Item=degrees)  # -> NullFlags, InvalidFlags, Description
list_indices_2 = ListIndices(List=null_item_2.NullFlags)
cull_pattern_2 = CullPattern(List=list_indices_2, CullPattern=null_item_2.NullFlags)
replace_items_2 = ReplaceItems(List=absolute, Indices=cull_pattern_2, Wrap=False)

dip_deg = Panel(replace_items_2)

dip_deg_2 = Integer(replace_items_2)
dip_direction_deg = Integer(degrees_2)
concatenate = Concatenate(Fragment_A=dip_deg_2, A="/", Fragment_B=dip_direction_deg)
panel = Panel(dip_direction_deg)
panel_2 = Panel(dip_deg_2)
dip_dipdirection = Text(concatenate)
dip_direction_deg_2 = ClusterOutput(dip_direction_deg)
dip_dipdirection_2 = ClusterOutput(dip_dipdirection)
dip_deg_3 = ClusterOutput(dip_deg_2)

# ==== cluster ConstructSwedgeModel

upper_face_width_end_point = ClusterInput()
swedge_bottom_point = ClusterInput()
right_slope_crest_point = ClusterInput()
left_slope_crest_point = ClusterInput()
upper_face_width_end_point_2 = Point(upper_face_width_end_point)
left_slope_crest_point_2 = Point(left_slope_crest_point)
right_slope_crest_point_2 = Point(right_slope_crest_point)
swedge_bottom_point_2 = Point(swedge_bottom_point)
entwine = Entwine(
    Branch00=upper_face_width_end_point_2,
    Branch01=left_slope_crest_point_2,
    Branch02=right_slope_crest_point_2,
    Branch03=swedge_bottom_point_2,
    FlattenInputs=True)  # -> flatten(Result)
list_indices = ListIndices(List=entwine)  # -> graft(Indices)
explode_tree = ExplodeTree(Data=list_indices)  # -> Branch0, Branch1, Branch2, Branch3

# ---- group: Upper face
mesh_triangle = MeshTriangle(CornerA=explode_tree.Branch0, CornerB=explode_tree.Branch1, CornerC=explode_tree.Branch2)

# ---- group: Left face
mesh_triangle_2 = MeshTriangle(CornerA=explode_tree.Branch0, CornerB=explode_tree.Branch1, CornerC=explode_tree.Branch3)

# ---- group: Right face
mesh_triangle_3 = MeshTriangle(CornerA=explode_tree.Branch0, CornerB=explode_tree.Branch2, CornerC=explode_tree.Branch3)

# ---- group: Slope face
mesh_triangle_4 = MeshTriangle(CornerA=explode_tree.Branch1, CornerB=explode_tree.Branch2, CornerC=explode_tree.Branch3)

# ----
entwine_2 = Entwine(Branch00=mesh_triangle, Branch01=mesh_triangle_2, Branch02=mesh_triangle_4, Branch03=mesh_triangle_3, FlattenInputs=True)  # -> flatten(Result)

construct_mesh = ConstructMesh(Vertices=flatten(entwine), Faces=flatten(entwine_2))
close_mesh = CloseMesh(Mesh=construct_mesh, Quadrangulate=True)  # -> Closed, Amount, Openings, ResultBoolean
swedge_model_mesh = Mesh(close_mesh.Closed)

mesh_explode = MeshExplode(M=construct_mesh, N=True)  # -> out, graft(A); inputs M: Mesh
# ---------- mesh_explode: VB ----------
    Component.Params.Input(0).Name = "Mesh"
    Component.Params.Input(0).Description = "Open or closed mesh"
    Component.Params.Input(1).Name = "Modify Normals"
    Component.Params.Input(1).Description = "An optional boolean that specifies whether vertex normals will be maintained if false or recalculated with the new face"

    Component.Params.Output(1).Name = "Mesh"
    Component.Params.Output(1).Description = "If successful, a list of valid meshes"

    If m IsNot Nothing Then
      Dim i As Integer

      Dim clrB As Boolean
      Dim mshs As New list(Of mesh)
      Dim mf As Rhino.Geometry.Collections.MeshFaceList = Nothing
      Dim mv As Rhino.Geometry.Collections.MeshVertexList = Nothing
      Dim mn As Rhino.Geometry.Collections.MeshVertexNormalList = Nothing
      Dim mc As Rhino.Geometry.Collections.MeshVertexColorList = Nothing

      If m.VertexColors.count() > 0 Then clrB = True Else m.VertexColors.CreateMonotoneMesh(color.White)
      If m.Normals.Count() < 1 Then m.Normals.ComputeNormals()
      mf = m.Faces
      mv = m.Vertices
      mn = m.Normals
      mc = m.VertexColors

      For i = 0 To mf.Count() - 1 Step 1
        Dim pts As New list(Of point3d)
        Dim fc As New meshFace
        Dim clr As New list(Of Color)
        Dim vec As New list(Of Vector3f)
        Dim msh As New mesh

        pts.add(New point3d(mv(mf(i).A)))
        pts.add(New point3d(mv(mf(i).B)))
        pts.add(New point3d(mv(mf(i).C)))
        If mf(i).IsQuad Then pts.add(New point3d(mv(mf(i).D)))

        clr.add(mc(mf(i).A))
        clr.add(mc(mf(i).B))
        clr.add(mc(mf(i).C))
        If mf(i).IsQuad Then clr.add(mc(mf(i).D))

        If N Then
          vec.add(mn(mf(i).A))
          vec.add(mn(mf(i).B))
          vec.add(mn(mf(i).C))
          If mf(i).IsQuad Then vec.add(mn(mf(i).D))
        End If

        If mf(i).IsQuad Then fc = New meshFace(0, 1, 2, 3) Else fc = New meshface(0, 1, 2)

        msh.Vertices.AddVertices(pts.toarray())
        msh.Faces.AddFace(fc)
        If clrB Then msh.VertexColors.AppendColors(clr.toarray())
        If N Then msh.Normals.AddRange(vec.toarray()) Else msh.Normals.ComputeNormals()
        mshs.add(msh)
      Next

      A = mshs
    End If
# ---------- end mesh_explode ----------
explode_tree_2 = ExplodeTree(Data=mesh_explode.A)  # -> Branch0, Branch1, Branch2, Branch3
left_joint_face_mesh = Mesh(explode_tree_2.Branch1)
right_joint_face_mesh = Mesh(explode_tree_2.Branch3)
upper_face_mesh = Mesh(explode_tree_2.Branch0)
slope_face_mesh = Mesh(explode_tree_2.Branch2)
slope_face_mesh_2 = ClusterOutput(slope_face_mesh)
upper_face_mesh_2 = ClusterOutput(upper_face_mesh)
swedge_model_mesh_2 = ClusterOutput(swedge_model_mesh)
left_joint_face_mesh_2 = ClusterOutput(left_joint_face_mesh)
right_joint_face_mesh_2 = ClusterOutput(right_joint_face_mesh)

# ==== cluster DipDipDirectionToPlane

dip_deg = ClusterInput()
dip_direction_deg = ClusterInput()
origin = ClusterInput()
dip_direction_deg_2 = Number(dip_direction_deg)
dip_deg_2 = Number(dip_deg)
origin_2 = Point(origin)

# ---- group: Rotate plane to specific dip
xy_plane = XYPlane(Origin=origin_2)
radians = Radians(Degrees=dip_deg_2)
negative = Negative(Value=radians)
yz_plane = YZPlane(Origin=origin_2)
rotate = Rotate(Geometry=xy_plane, Angle=negative, Plane=yz_plane)  # -> Geometry, Transform

# ---- group: Rotate plane to specific dip direction (y-axis of plane)
radians_2 = Radians(Degrees=dip_direction_deg_2)
negative_2 = Negative(Value=radians_2)
rotate_2 = Rotate(Geometry=rotate.Geometry, Angle=negative_2, Plane=xy_plane)  # -> Geometry, Transform
face_normals = FaceNormals(Mesh=rotate_2.Geometry)  # -> Centers, Normals

# ----
plane = Plane(rotate_2.Geometry)
plane_2 = ClusterOutput(plane)

plane_normal = Vector(face_normals.Normals)
plane_normal_2 = ClusterOutput(plane_normal)

# ==== cluster Cluster

vector = ClusterInput()
vector_2 = Vector(vector)
deconstruct_vector = DeconstructVector(Vector=unitize(vector_2))  # -> XComponent, YComponent, ZComponent
unit_y = UnitY(Factor=1)
arctangent = ArcTangent(Value=deconstruct_vector.ZComponent)
negative = Negative(Value=arctangent)
xy_plane = XYPlane(Origin=Point(0, 0, 0))
angle = Angle(VectorA=vector_2, VectorB=unit_y, Plane=xy_plane)  # -> Angle, Reflex
degrees = Degrees(Radians=negative)  # -> flatten(Degrees)
degrees_2 = Degrees(Radians=angle.Angle)  # -> flatten(Degrees)
plunge = Number(degrees)
trend = Number(degrees_2)
trend_2 = ClusterOutput(trend)  # Degree
plunge_2 = ClusterOutput(plunge)  # Degree (upwards = -ve)

# ==== cluster Cluster_2

# ---- group: Geometry
wedge_upper_face_mesh = ClusterInput()
wedge_slope_face_mesh = ClusterInput()
joint = ClusterInput()
block_brep = ClusterInput()
slope_dip = ClusterInput()
slope_dip_direction = ClusterInput()
joint_2 = Geometry(joint)
wedge_slope_face_mesh_2 = Mesh(wedge_slope_face_mesh)
wedge_upper_face_mesh_2 = Mesh(wedge_upper_face_mesh)
block_brep_2 = Brep(block_brep)
tension_crack_dip_direction = Number("0")
tension_crack_dip = Number("0")
slope_dip_2 = Number(slope_dip)
slope_dip_direction_2 = Number(slope_dip_direction)
list_item = ListItem(List=joint_2, Index=0, Wrap=True)  # -> flatten(Item)
mesh_dip_dipdirection = MeshDipDipDirection_2(mesh=list_item, round_to_nearest=False)  # -> dip_deg_2, dip_direction_deg_2, dip_dipdirection_2
joint_dip = Number(mesh_dip_dipdirection.dip_deg_2)
joint_dip_direction = Number(mesh_dip_dipdirection.dip_direction_deg_2)
area = Area(Geometry=wedge_slope_face_mesh_2)  # -> Area, Centroid
area_2 = Area(Geometry=wedge_upper_face_mesh_2)  # -> Area, Centroid
dip_dipdirection_to_plane = DipDipDirectionToPlane(dip_deg=joint_dip, dip_direction_deg=joint_dip_direction, origin=Point(353.9549866, 506.8420105, 44.99300003))  # -> plane_2, plane_normal_2
dip_dipdirection_to_plane_2 = DipDipDirectionToPlane(dip_deg=slope_dip_2, dip_direction_deg=slope_dip_direction_2, origin=Point(353.9549866, 506.8420105, 44.99300003))  # -> plane_2, plane_normal_2
dip_dipdirection_to_plane_3 = DipDipDirectionToPlane(
    dip_deg=tension_crack_dip,
    dip_direction_deg=tension_crack_dip_direction,
    origin=Point(353.9549866, 506.8420105, 44.99300003))  # -> plane_2, plane_normal_2
list_length = ListLength(List=list_item)
number_of_joints = Integer(list_length)
deconstruct_plane = DeconstructPlane(Plane=dip_dipdirection_to_plane.plane_2)  # -> Origin, XAxis, YAxis, ZAxis

# ---- group: Block rock properties
# INPUT
unit_weight_of_rock = ClusterInput()  # MN/m3
area_of_tension_crack = ClusterInput()  # m2
h_w = ClusterInput()

# ---- group: Joint properties
cohesion_of_joint_1 = ClusterInput()  # MPa
friction_angle_of_joint_1 = ClusterInput()  # degree

# ---- group: Seismic
k = ClusterInput()
direction_of_seismic_force = ClusterInput()

# ---- group: External Forces
individual_external_force_vectors = ClusterInput()

# ---- group: Shotcrete
trace_length_of_joint_1_on_slope_face = ClusterInput()  # m
trace_length_of_joint_2_on_slope_face = ClusterInput()  # m
shotcrete_thickness = ClusterInput()  # m
shotcrete_shear_strength = ClusterInput()  # MPa
area_where_slope_face_of_block_and_shotc = ClusterInput()  # m2
unit_weight_of_shotcrete = ClusterInput()  # MN/m3

# ---- group: Active support pressure
active_pressure_magnitude_on_slope_face = ClusterInput()  # MPa
trend_plunge_of_active_slope_pressure = ClusterInput()
active_pressure_magnitude_on_upper_face = ClusterInput()  # MPa
trend_plunge_of_active_upper_face_pressu = ClusterInput()

# ---- group: Water
joint_water_pressure = ClusterInput()  # No water pressure = 0 Constant water pressure = 1 Filled pressure (No Tension Crack) = 2 Filled pressure (With Tension Crack) = 3
percentage_fill = ClusterInput()  # 0 to 100.
constant_pressure_on_joint_1 = ClusterInput()  # MPa
constant_pressure_on_joint_2 = ClusterInput()  # MPa
constant_pressure_on_tension_crack = ClusterInput()  # MPa
joint_water_pressure_2 = Integer(joint_water_pressure)
percentage_fill_2 = Number(percentage_fill)

# ---- group: Bolt
capcaity_of_active_bolt = ClusterInput()  # MN
unit_direction_of_active_bolt = ClusterInput()
capacity_of_passive_bolt = ClusterInput()  # MN
unit_direction_of_passive_bolt = ClusterInput()

# ---- group: Passive support pressure
passive_pressure_magnitude_on_slope_face = ClusterInput()  # MPa
trend_plunge_of_passive_slope_pressure = ClusterInput()
passive_pressure_magnitude_on_upper_face = ClusterInput()  # MPa
trend_plunge_of_passive_upper_face_press = ClusterInput()

# ----
volume = ClusterInput()

# ---- group: In case block joint can be splitted into separated surfaces
area_3 = Area(Geometry=joint_2)  # -> Area, Centroid
first_last = FirstLast(List=area_3.Centroid)  # -> flatten(FirstValue), LastValue
mass_addition = MassAddition(Input=area_3.Area)  # -> flatten(Result), PartialResults

# ---- group: Geometry / Ensure normal vector points inwards
multiplication = Multiplication(A=dip_dipdirection_to_plane.plane_normal_2, B="0.02")
move = Move(Geometry=first_last.FirstValue, Motion=multiplication)  # -> Geometry, Transform
point_in_brep = PointInBrep(Brep=block_brep_2, Point=move.Geometry, Strict=invert("True"))
reverse = Reverse(Vector=dip_dipdirection_to_plane.plane_normal_2)
pick_n_choose = PickNChoose(Pattern=point_in_brep, Stream0=reverse, Stream1=dip_dipdirection_to_plane.plane_normal_2)

# ----
h_w_2 = Number(h_w)
volume_2 = Number(volume)

# ---- group: 2.5 & 2.6 - Pressure Force (Active) Vector
p_s_active = Number(active_pressure_magnitude_on_slope_face)
a_s = Number(area.Area)
n_cap_s_active = Vector(unitize(trend_plunge_of_active_slope_pressure))
a_u = Number(area_2.Area)
n_cap_u_active = Vector(unitize(trend_plunge_of_active_upper_face_pressu))
p_u_active = Number(active_pressure_magnitude_on_upper_face)
_3_1d_pressure_force_active_vector = Expression(
    p_s_active=p_s_active,
    a_s=a_s,
    n_cap_s_active=n_cap_s_active,
    p_u_active=p_u_active,
    a_u=a_u,
    n_cap_u_active=n_cap_u_active,
    Expression="p_s_active*a_s*n_cap_s_active+p_u_active*a_u*n_cap_u_active")
X = Vector(_3_1d_pressure_force_active_vector)

# ---- group: 2.2 - Block Weight Vector
gamma_r = Number(unit_weight_of_rock)
V = Number(volume_2)
g_cap = Vector("{0,0,-1}")
expression = Expression(gamma_r=gamma_r, V=V, g_cap=g_cap, Expression="(gamma_r*V)•g_cap")
W = Vector(expression)

# ---- group: 2.15 - Seismic Force Vector
e_cap_seismic = Vector(unitize(direction_of_seismic_force))
W_2 = Number(W)
# Pond Water Pressure not included.
k_2 = Number(k)
expression_2 = Expression(k=k_2, W=W_2, e_cap_seismic=e_cap_seismic, Expression="(k*W)•e_cap_seismic")
E = Vector(expression_2)

# ---- group: 2.16 - Active Bolt Force Vector
e_cap_bolt_active = Vector(unitize(unit_direction_of_active_bolt))
c_active = Number(capcaity_of_active_bolt)
multiplication_2 = Multiplication(A=c_active, B=e_cap_bolt_active)
mass_addition_2 = MassAddition(Input=multiplication_2)  # -> Result, PartialResults
b_a = Vector(mass_addition_2.Result)

# ---- group: 2.17 Shotcrete Weight Vector
a_s_2 = Number(area_where_slope_face_of_block_and_shotc)
gamma_s = Number(unit_weight_of_shotcrete)
expression_3 = Expression(A_s=a_s_2, gamma_s=gamma_s, t=shotcrete_thickness, g_cap=g_cap, Expression="A_s*gamma_s*t*g_cap")
w_s = Vector(expression_3)

# ---- group: 2.3 - External Force Vector
c_i = Vector(individual_external_force_vectors)
mass_addition_3 = MassAddition(Input=flatten(c_i))  # -> Result, PartialResults
C = Vector(mass_addition_3.Result)

# ---- group: 3.1e - Constant Pressure on Each Joint / Left joint
n_cap_i = Vector(unitize(pick_n_choose))
u_1 = Number(constant_pressure_on_joint_1)
a_i = Number(mass_addition.Result)

# ---- group: 3.1e - Constant Pressure on Each Joint / Right joint
n_cap_2 = Vector()
u_2 = Number(constant_pressure_on_joint_2)
a_2 = Number()

# ---- group: 3.1e - Constant Pressure on Each Joint / Tension crack
n_cap_t = Vector(unitize(dip_dipdirection_to_plane_3.plane_normal_2))
u_t = Number(constant_pressure_on_tension_crack)
a_t = Number(area_of_tension_crack)

# ---- group: 2.19 & 2.20 Shotcrete Shear Resistance
n_cap_s = Vector(unitize(dip_dipdirection_to_plane_2.plane_normal_2))
l_1 = Number(trace_length_of_joint_1_on_slope_face)
tau_s = Number(shotcrete_shear_strength)
l_2 = Number(trace_length_of_joint_2_on_slope_face)
t = Number(shotcrete_thickness)
expression_4 = Expression(L_1=l_1, L_2=l_2, t=t, tau_s=tau_s, n_cap_s=n_cap_s, Expression="(L_1+L_2)*t*tau_s*n_cap_s")
Y = Vector(expression_4)

# ---- group: 2.21 & 2.22 - Pressure Force (Passive) Vector
n_cap_s_passive = Vector(unitize(trend_plunge_of_passive_slope_pressure))
n_cap_u_passive = Vector(unitize(trend_plunge_of_passive_upper_face_press))
p_s_passive = Number(passive_pressure_magnitude_on_slope_face)
p_u_passive = Number(passive_pressure_magnitude_on_upper_face)
_3_1d_pressure_force_active_vector_2 = Expression(
    p_s_passive=p_s_passive,
    a_s=a_s,
    n_cap_s_passive=n_cap_s_passive,
    p_u_passive=p_u_passive,
    a_u=a_u,
    n_cap_u_passive=n_cap_u_passive,
    Expression="p_s_passive*a_s*n_cap_s_passive+p_u_passive*a_u*n_cap_u_passive")
H = Vector(_3_1d_pressure_force_active_vector_2)

# ---- group: 2.23 - Passive Bolt Force Vector
e_cap_bolt_passive = Vector(unitize(unit_direction_of_passive_bolt))
c_passive = Number(capacity_of_passive_bolt)
multiplication_3 = Multiplication(A=c_passive, B=e_cap_bolt_passive)
mass_addition_4 = MassAddition(Input=multiplication_3)  # -> Result, PartialResults
b_p = Vector(mass_addition_4.Result)

# ---- group: 3.1a - Active Force Vector / 2.18 - Passive Force Vector
# PASSIVE FORCE VECTOR
H_2 = Vector(H)
Y_2 = Vector(Y)
b_p_2 = Vector(b_p)
expression_5 = Expression(H=H_2, Y=Y_2, B_p=b_p_2, Expression="H+Y+B_p")
P = Vector(expression_5)

# ---- group: 4.4 & 4.6 / 4.1 & 4.3 & 4.6 & 4.7
number_of_joints_2 = Integer(number_of_joints)
duplicate_data = DuplicateData(Data="0", Number=number_of_joints_2, Order=True)
stable_normalforce = Number(duplicate_data)
falling_lifting_normalforce = Number(duplicate_data)

# ---- group: 2.1 - Active Force Vector
C_2 = Vector(C)
b_a_2 = Vector(b_a)
w_s_2 = Vector(w_s)
# ACTIVE FORCE VECTOR
W_3 = Vector(W)
X_2 = Vector(X)
E_2 = Vector(E)

# ----
a_i_2 = Number(a_i)
p = Number(percentage_fill_2)
h_w_3 = Number(h_w_2)
n_cap_i_2 = Vector(n_cap_i)
gamma_w = Number("0.00981")
expression_6 = Expression(u_2=u_2, a_2=a_2, n_cap_2=n_cap_2, Expression="u_2*a_2*n_cap_2")
expression_7 = Expression(u_1=u_1, a_1=a_i, n_cap_1=n_cap_i, Expression="u_1*a_1*n_cap_1")
expression_8 = Expression(u_t=u_t, a_t=a_t, n_cap_t=n_cap_t, Expression="u_t*a_t*n_cap_t")

# ---- group: 3.1f - Gravitational Pressure (No Tension Crack)
expression_9 = Expression(p=p, gamma_w=gamma_w, H_w=h_w_3, a_i=a_i_2, n_cap_i=n_cap_i_2, Expression="(1/6)*(p/100)³*gamma_w*H_w*a_i*n_cap_i")
mass_addition_5 = MassAddition(Input=flatten(expression_9))  # -> Result, PartialResults
U = Vector(mass_addition_5.Result)

# ---- group: 3.1g - Gravitational Pressure (With Tension Crack)
expression_10 = Expression(p=p, gamma_w=gamma_w, H_w=h_w_3, a_i=a_i_2, n_cap_i=n_cap_i_2, Expression="(1/3)*(p/100)³*gamma_w*H_w*a_i*n_cap_i")
mass_addition_6 = MassAddition(Input=flatten(expression_10))  # -> Result, PartialResults
U_2 = Vector(mass_addition_6.Result)

# ---- group: 3.1e - Constant Pressure on Each Joint
mass_addition_7 = MassAddition(Input=flatten([expression_7, expression_6, expression_8]))  # -> Result, PartialResults
U_3 = Vector(mass_addition_7.Result)

# ----
pick_n_choose_2 = PickNChoose(Pattern=joint_water_pressure_2, Stream0="{0,0,0}", Stream1=U_3, Stream2=U, Stream3=U_2)
U_4 = Vector(pick_n_choose_2)

# ---- group: 2.1 - Active Force Vector (continued)
U_5 = Vector(U_4)
expression_11 = Expression(W=W_3, C=C_2, X=X_2, U=U_5, E=E_2, B_a=b_a_2, W_s=w_s_2, Expression="W+C+X+U+E+B_a+W_s")
A = Vector(expression_11)

# ---- group: 3.2 - Sliding on a Single Face i
expression_12 = Expression(n_cap_i=n_cap_i, A=A, Expression="(n_cap_i┴A)┴n_cap_i")
s_cap_i = Vector(unitize(expression_12))

# ----
# Getting s_cap and n_cap og joint-pairs and other joints (Tree path = xref index)
n_cap_i_3 = Vector(unitize(n_cap_i))
s_cap_i_2 = Vector(unitize(s_cap_i))
list_indices = ListIndices(List=n_cap_i_3)
list_length_2 = ListLength(List=n_cap_i_3)
cross_reference = CrossReference(ListListA=list_indices, ListListB=list_indices, CrossMode=2)  # -> ListListA, ListListB
merge = Merge(Data1=graft(cross_reference.ListListA), Data2=graft(cross_reference.ListListB))  # -> simplify(Result)
subtraction = Subtraction(A=list_length_2, B="2")
expression_13 = Expression(number_k=subtraction, Expression="if(number_k=0,1,number_k)")
duplicate_data_2 = DuplicateData(Data=simplify(graft(cross_reference.ListListB)), Number=expression_13, Order=True)  # -> simplify(Data)
duplicate_data_3 = DuplicateData(Data=simplify(graft(cross_reference.ListListA)), Number=expression_13, Order=True)  # -> simplify(Data)
duplicate_data_4 = DuplicateData(Data=simplify(graft(cross_reference.ListListB)), Number=subtraction, Order=True)  # -> simplify(Data)
cull_index = CullIndex(List=list_indices, Indices=merge, Wrap=True)  # -> simplify(List)
i_xref = Integer(duplicate_data_2)
list_item_2 = ListItem(List=s_cap_i_2, Index=i_xref, Wrap=True)
list_item_3 = ListItem(List=n_cap_i_3, Index=i_xref, Wrap=True)
j_xref = Integer(duplicate_data_3)
list_item_4 = ListItem(List=s_cap_i_2, Index=j_xref, Wrap=True)
list_item_5 = ListItem(List=n_cap_i_3, Index=j_xref, Wrap=True)
k_xref = Integer(cull_index)
list_item_6 = ListItem(List=n_cap_i_3, Index=k_xref, Wrap=True)  # -> simplify(Item)
n_cap_j_xref = Vector(unitize(list_item_5))
n_cap_i_xref = Vector(unitize(list_item_3))
s_cap_j_xref = Vector(unitize(list_item_4))
n_cap_k = Vector(unitize(list_item_6))
s_cap_i_xref = Vector(unitize(list_item_2))

# ---- group: 3.10
expression_14 = Expression(s_cap_j_xref=s_cap_j_xref, n_cap_i_xref=n_cap_i_xref, Expression="s_cap_j_xref•n_cap_i_xref")  # -> simplify(case5)
case5 = Number(expression_14)

# ---- group: 3.4 & 3.7
expression_15 = Expression(A=A, n_cap_i=n_cap_i_3, Expression="A•n_cap_i")  # -> simplify(case1)
case1 = Number(expression_15)

# ---- group: 3.3 - Sliding on a Two Faces
expression_16 = Expression(n_cap_i_xref=n_cap_i_xref, n_cap_j_xref=n_cap_j_xref, A=A, Expression="(n_cap_i_xref┴n_cap_j_xref)•A")
expression_17 = Expression(x=expression_16, Expression="if(x≥0,1,-1)")
expression_18 = Expression(n_cap_i_xref=n_cap_i_xref, n_cap_j_xref=n_cap_j_xref, sign=expression_17, Expression="(n_cap_i_xref┴n_cap_j_xref)*sign")  # -> simplify(results)
s_cap_ij = Vector(unitize(expression_18))

# ---- group: Check if joint pairs are parallel
expression_19 = Expression(n_cap_i_xref=n_cap_i_xref, n_cap_j_xref=n_cap_j_xref, Expression="abs(n_cap_i_xref•n_cap_j_xref)")
panel = Panel("0.001")
equality_within_tolerance = EqualityWithinTolerance(FirstNumber=expression_19, SecondNumber="1", Tolerance=panel)  # -> Equality, Inequality
case0 = Integer(equality_within_tolerance.Inequality)

# ---- group: 3.6
expression_20 = Expression(A=A, n_cap_k=n_cap_k, Expression="A•n_cap_k")  # -> simplify(case3)
case3 = Number(expression_20)

# ---- group: 3.1 - Falling (or Lifting)
# POSSIBLE SLIDING DIRECTIONS
A_2 = Vector(A)
s_cap_0 = Vector(unitize(A_2))

# ----
# VALID SLIDING DIRECTION
expression_21 = Expression(case1=case1, Expression="if(case1>0, 1, 0)")
mass_multiplication = MassMultiplication(Input=flatten(expression_21))  # -> Result, PartialResults
falling_lifting_sliding_direction = Vector(s_cap_0)
falling_lifting_boolean = Integer(mass_multiplication.Result)

# ----
# NORMAL FORCE
# Force Factor F
expression_22 = Expression(A=A, P=P, Expression="A+P")
F = Vector(expression_22)

# ---- group: 6.3 - Lifting Factor of Safety
s_cap_0_2 = Vector(s_cap_0)
expression_23 = Expression(P=P, A=A, s_cap_0=s_cap_0_2, Expression="(-P•s_cap_0)/(A•s_cap_0)")
fs_f = Number(expression_23)

# ---- group: 3.5
expression_24 = Expression(s_cap_ij=s_cap_ij, n_cap_k=n_cap_k, Expression="s_cap_ij•n_cap_k")  # -> simplify(case2)

# ---- group: 3.5 / ensure case2 to be positive if 1 or 2 input joints
includes = Includes(Value=number_of_joints, Domain="1 to 2")  # -> Includes, Deviation
replace_nulls = ReplaceNulls(Items=expression_24, Replacements="1")  # -> Items, Count
stream_filter = StreamFilter(Gate=includes.Includes, Stream0=expression_24, Stream1=replace_nulls.Items)

# ---- group: 3.5 (continued)
case2 = Number(stream_filter)

# ----
equality_within_tolerance_2 = EqualityWithinTolerance(FirstNumber=case2, SecondNumber="0", Tolerance=panel)  # -> simplify(Equality), Inequality
expression_25 = Expression(
    case0=simplify(case0),
    if_case2_zero=equality_within_tolerance_2.Equality,
    case3=case3,
    Expression="case0*if_case2_zero*if(case3≤0, 1, 0)*2")
cull_pattern = CullPattern(List=flatten(i_xref), CullPattern=flatten(expression_25))
cull_pattern_2 = CullPattern(List=flatten(j_xref), CullPattern=flatten(expression_25))
min_max = MinMax(Number=flatten(expression_25))  # -> Minimum, Maximum
cull_pattern_3 = CullPattern(List=flatten(k_xref), CullPattern=flatten(expression_25))
cull_pattern_4 = CullPattern(List=flatten(s_cap_ij), CullPattern=flatten(expression_25))
merge_2 = Merge(Data1=cull_pattern, Data2=cull_pattern_2, Data3=cull_pattern_3)
count_unique = CountUnique(Key=flatten(merge_2), SortIfPossible=False, LastSaveLocalization="neutral,N")  # -> flatten(KeyList), Count
first_last_2 = FirstLast(List=cull_pattern_4)  # -> FirstValue, LastValue
morethantwojoints_boolean = Integer(min_max.Maximum)
morethantwojoints_index = Integer(count_unique.KeyList)

morethantwojoints_sliding_direction = Vector(first_last_2.FirstValue)

# ---- group: 3.8 & 3.9
expression_26 = Expression(s_cap_i_xref=s_cap_i_xref, n_cap_j_xref=n_cap_j_xref, Expression="s_cap_i_xref•n_cap_j_xref")  # -> simplify(case4)
case4 = Number(expression_26)
equality = Equality(FirstNumber=number_of_joints, SecondNumber="1")  # -> Equality, Inequality

# ---- group: 3.8 & 3.9 / ensure case4 to be positive if only 1 joint
replace_nulls_2 = ReplaceNulls(Items=case4, Replacements="1")  # -> Items, Count
stream_filter_2 = StreamFilter(Gate=equality.Equality, Stream0=case4, Stream1=replace_nulls_2.Items)

# ---- group: 3.8 & 3.9 (continued)
case4_2 = Number(stream_filter_2)

# ----
# For Bug Fixing
case1_2 = Panel(case1)
i_xref_2 = Panel(i_xref)
j_xref_2 = Panel(j_xref)
k_xref_2 = Panel(k_xref)
case2_2 = Panel(case2)
case3_2 = Panel(case3)
case4_3 = Panel(case4_2)
case5_2 = Panel(case5)

larger_than = LargerThan(FirstNumber=case2, SecondNumber="0")  # -> LargerThan, OrEqualTo
multiplication_4 = Multiplication(If_case2_not_zero=equality_within_tolerance_2.Inequality, B=larger_than.LargerThan)
mass_addition_8 = MassAddition(Input=multiplication_4)  # -> Result, PartialResults
duplicate_data_5 = DuplicateData(Data=simplify(graft(mass_addition_8.Result)), Number=expression_13, Order=True)  # -> simplify(Data)
number_case2_greater_zero = Integer(duplicate_data_5)
expression_27 = Expression(
    number_case2_greater_zero=number_case2_greater_zero,
    number_k=expression_13,
    case4=case4_2,
    case5=case5,
    Expression="if(number_case2_greater_zero=number_k, 1, 0)*if(case4≤0, 1, 0)*if(case5≤0, 1, 0)*4")
cull_pattern_5 = CullPattern(List=flatten(i_xref), CullPattern=flatten(expression_27))
cull_pattern_6 = CullPattern(List=flatten(j_xref), CullPattern=flatten(expression_27))
min_max_2 = MinMax(Number=flatten(expression_27))  # -> Minimum, Maximum
merge_3 = Merge(Data1=cull_pattern_5, Data2=cull_pattern_6)  # -> flatten(Result)
cull_pattern_7 = CullPattern(List=flatten(s_cap_ij), CullPattern=flatten(expression_27))
count_unique_2 = CountUnique(Key=merge_3, SortIfPossible=False, LastSaveLocalization="neutral,N")  # -> KeyList, Count
first_last_3 = FirstLast(List=cull_pattern_7)  # -> FirstValue, LastValue
jointintersection_sliding_direction = Vector(first_last_3.FirstValue)
jointintersection_index = Integer(count_unique_2.KeyList)
jointintersection_boolean = Integer(min_max_2.Maximum)

create_tree = CreateTree(Data=flatten(case4_2), Path=flatten(i_xref))
larger_than_2 = LargerThan(FirstNumber=create_tree, SecondNumber="0")  # -> LargerThan, OrEqualTo
tree_statistics = TreeStatistics(Tree=create_tree)  # -> Paths, Length, Count
mass_addition_9 = MassAddition(Input=larger_than_2.LargerThan)  # -> flatten(Result), PartialResults
first_last_4 = FirstLast(List=tree_statistics.Length)  # -> FirstValue, LastValue
equality_2 = Equality(FirstNumber=mass_addition_9.Result, SecondNumber=first_last_4.FirstValue)  # -> Equality, Inequality

# ---- group: Ensure case4GreaterThanZero = 1 if only one joint
stream_filter_3 = StreamFilter(Gate=equality.Equality, Stream0=equality_2.Equality, Stream1="1")

# ----
case4greaterthanzero = Number(stream_filter_3)
expression_28 = Expression(case1=case1, case4GreaterThanZero=case4greaterthanzero, Expression="if(case1≤0, 1, 0)*case4GreaterThanZero*3")
min_max_3 = MinMax(Number=flatten(expression_28))  # -> Minimum, Maximum
cull_pattern_8 = CullPattern(List=flatten(list_indices), CullPattern=flatten(expression_28))
singlejoint_boolean = Integer(min_max_3.Maximum)
singlejoint_index = Integer(cull_pattern_8)
list_item_7 = ListItem(List=s_cap_i, Index=singlejoint_index, Wrap=True)
singlejoint_sliding_direction = Vector(list_item_7)

# ----
# Sliding direction number, vector, and joint indices
null_values = NullValues(LastSaveLocalization="neutral,N")  # -> Null, NaN, Infinity, Infinity_2
mass_addition_10 = MassAddition(Input=flatten([falling_lifting_boolean, morethantwojoints_boolean, singlejoint_boolean, jointintersection_boolean]))  # -> Result, PartialResults
sliding_direction_number = Integer(mass_addition_10.Result)
stream_filter_4 = StreamFilter(
    Gate=sliding_direction_number,
    Stream2=morethantwojoints_index,
    Stream3=singlejoint_index,
    Stream4=jointintersection_index)
cull_index_2 = CullIndex(List=list_indices, Indices=stream_filter_4, Wrap=False)
sliding_joint_index = Integer(stream_filter_4)
non_sliding_joint_index = Integer(cull_index_2)

# ---- group: 4.4 & 4.6
# Normal Force
sliding_joint_index_2 = Integer(sliding_joint_index)
n_cap_i_4 = Vector(unitize(n_cap_i))
sliding_direction = Integer(sliding_direction_number)

# ---- group: Sliding direction VECTOR
stream_filter_5 = StreamFilter(
    Gate=sliding_direction,
    Stream0="{0,0,0}",
    Stream1=falling_lifting_sliding_direction,
    Stream2=morethantwojoints_sliding_direction,
    Stream3=singlejoint_sliding_direction,
    Stream4=jointintersection_sliding_direction)
s_cap = Vector(unitize(stream_filter_5))

# ---- group: 4.4 & 4.6 / 4.2
list_item_8 = ListItem(List=n_cap_i_4, Index=sliding_joint_index_2, Wrap=True)
expression_29 = Expression(F=F, n_cap_i=list_item_8, Expression="-F•n_cap_i")
replace_items = ReplaceItems(List=duplicate_data, Item=expression_29, Indices=sliding_joint_index_2, Wrap=False)
singlejoint_normalforce = Number(replace_items)

# ---- group: 4.4 & 4.6 / 4.7 / Ensure normal vectors pointing downwards
deconstruct_vector = DeconstructVector(Vector=list_item_8)  # -> XComponent, YComponent, ZComponent
smaller_than = SmallerThan(FirstNumber=deconstruct_vector.ZComponent, SecondNumber="0")  # -> SmallerThan, OrEqualTo
reverse_2 = Reverse(Vector=list_item_8)
pick_n_choose_3 = PickNChoose(Pattern=smaller_than.SmallerThan, Stream0=reverse_2, Stream1=list_item_8)
normal_force_vector_downwards = Vector(pick_n_choose_3)

# ---- group: 4.4 & 4.6 / 4.7
# Plunge
sliding_direction_vector = Vector(s_cap)
xy_plane = XYPlane(Origin=Point(0, 0, 0))
project = Project(Geometry=sliding_direction_vector, Plane=xy_plane)  # -> Geometry, Transform
angle = Angle(VectorA=project.Geometry, VectorB=sliding_direction_vector)  # -> Angle, Reflex
degrees = Degrees(Radians=angle.Angle)
plunge = Panel(degrees)

# Construction XY and YZ Planes
# X along sliding direction
# Y horizontal
sliding_direction_vector_2 = Vector(s_cap)
plane_normal = PlaneNormal(Origin=Point(0, 0, 0), ZAxis=sliding_direction_vector_2)
xy_plane_2 = XYPlane(Origin=Point(0, 0, 0))
plane_plane = PlanePlane(PlaneA=plane_normal, PlaneB=xy_plane_2)
construct_plane = ConstructPlane(Origin=Point(0, 0, 0), XAxis=sliding_direction_vector_2, YAxis=plane_plane)
case_xy_plane = Plane(construct_plane)
deconstruct_plane_2 = DeconstructPlane(Plane=case_xy_plane)  # -> Origin, XAxis, YAxis, ZAxis
construct_plane_2 = ConstructPlane(Origin=deconstruct_plane_2.Origin, XAxis=deconstruct_plane_2.YAxis, YAxis=deconstruct_plane_2.ZAxis)
case_yz_plane = Plane(construct_plane_2)

# theta_l
normal_force_vector_downwards_2 = Vector(normal_force_vector_downwards)
angle_2 = Angle(VectorA=normal_force_vector_downwards_2, VectorB=deconstruct_plane_2.YAxis, Plane=construct_plane_2)  # -> Angle, Reflex
degrees_2 = Degrees(Radians=angle_2.Angle)

# L
plane_normal_2 = PlaneNormal(Origin=Point(0, 0, 0), ZAxis=normal_force_vector_downwards)
joint_plane_facing_downwards = Plane(plane_normal_2)
case_yz_plane_2 = Plane(construct_plane_2)
plane_plane_2 = PlanePlane(PlaneA=case_yz_plane_2, PlaneB=joint_plane_facing_downwards)
length = Length(Curve=plane_plane_2)

# ---- group: Driving force
# FACTOR OF SAFETY
A_3 = Expression(A=A, s_cap=s_cap, Expression="A•s_cap")

# ---- group: 4.4 & 4.6
first_last_5 = FirstLast(List=list_item_8)  # -> FirstValue, LastValue

# ---- group: 4.4 & 4.6 / 4.4
expression_30 = Expression(
    F=F,
    n_cap_1=first_last_5.FirstValue,
    n_cap_2=first_last_5.LastValue,
    Expression="-((F┴n_cap_2)•(n_cap_1┴n_cap_2))/((n_cap_1┴n_cap_2)•(n_cap_1┴n_cap_2))")

# ---- group: 4.4 & 4.6 / 4.5
expression_31 = Expression(
    F=F,
    n_cap_1=first_last_5.FirstValue,
    n_cap_2=first_last_5.LastValue,
    Expression="-((F┴n_cap_1)•(n_cap_2┴n_cap_1))/((n_cap_2┴n_cap_1)•(n_cap_2┴n_cap_1))")

# ---- group: 4.4 & 4.6 (continued)
n_i_xref = Number(expression_30)
n_j_xref = Number(expression_31)
merge_4 = Merge(Data1=n_i_xref, Data2=n_j_xref)
replace_items_2 = ReplaceItems(List=duplicate_data, Item=merge_4, Indices=sliding_joint_index_2, Wrap=False)
jointintersection_normalforce = Number(replace_items_2)

# ---- group: 4.4 & 4.6 / 4.7
# Normal force calculation by Mauldon & Ureta 1996
theta_l_deg_wedge_x = Panel(degrees_2)
theta_r_wedge_x = Panel("90")
l_m_wedge_x = Panel(length)
plunge_wedge_x = Panel(degrees)
deconstruct_vector_2 = DeconstructVector(Vector=F)  # -> XComponent, YComponent, ZComponent
absolute = Absolute(Value=deconstruct_vector_2.ZComponent)
w_wedge_x = Panel(absolute)
radians = Radians(Degrees=plunge_wedge_x)
expression_32 = Expression(plunge=radians, W=w_wedge_x, Expression="W*cos(plunge)")

# ---- group: Numerical analysis takes time. Only enabled when needed.
equality_3 = Equality(FirstNumber=sliding_direction_number, SecondNumber="2")  # -> Equality, Inequality
enable_disable_object = EnableDisableObject(Enabled=equality_3.Equality)
multiple_sliding_surface_normal_force_di = MultipleSlidingSurfaceNormalForceDistribution(l_m=l_m_wedge_x, theta_l_deg=theta_l_deg_wedge_x, theta_r_deg=theta_r_wedge_x, r_n_mn=expression_32)  # -> n_l_2, num_theta_s_2; "Multiple sliding surface normal Force Distribution"; disabled

# ---- group: 4.4 & 4.6 / 4.7 (continued)
panel_2 = Panel(multiple_sliding_surface_normal_force_di.n_l_2)
panel_3 = Panel(multiple_sliding_surface_normal_force_di.num_theta_s_2)
replace_items_3 = ReplaceItems(List=duplicate_data, Item=multiple_sliding_surface_normal_force_di.n_l_2, Indices=sliding_joint_index_2, Wrap=False)
multiplejoint_normalforce = Number(replace_items_3)

# ---- group: 4.4 & 4.6 (continued)
stream_filter_6 = StreamFilter(
    Gate=sliding_direction,
    Stream0=stable_normalforce,
    Stream1=falling_lifting_normalforce,
    Stream2=multiplejoint_normalforce,
    Stream3=singlejoint_normalforce,
    Stream4=jointintersection_normalforce)
n_i = Number(stream_filter_6)

# ---- group: 5.1- Normal stress on Each Joint
# SHEAR STRENGTH
expression_33 = Expression(N_i=n_i, a_i=mass_addition.Result, Expression="N_i/a_i")
sigma_n_i = Number(expression_33)

# ---- group: 5.2 -Shear Strength of Each Joint (Mohr-Coulomb)
c_i_2 = Number(cohesion_of_joint_1)
phi_i = Number(friction_angle_of_joint_1)
radians_2 = Radians(Degrees=phi_i)
expression_34 = Expression(c_i=c_i_2, sigma_n_i=sigma_n_i, Phi_i=radians_2, Expression="c_i+sigma_n_i*tan(Phi_i)")
larger_than_3 = LargerThan(FirstNumber=sigma_n_i, SecondNumber="0")  # -> LargerThan, OrEqualTo
multiplication_5 = Multiplication(A=expression_34, B=larger_than_3.LargerThan)
tau_i = Number(multiplication_5)

# ---- group: 5.16 - Resisting Force due to Shear Strength
angle_3 = Angle(VectorA=s_cap, VectorB=deconstruct_plane.YAxis)  # -> Angle, Reflex
theta_i = Number(angle_3.Angle)
expression_35 = Expression(tau_i=tau_i, a_i=a_i, theta_i=theta_i, Expression="tau_i*a_i")
mass_addition_11 = MassAddition(Input=expression_35)  # -> Result, PartialResults
j_i = Number(mass_addition_11.Result)

# ---- group: 6.4 - Unsupported Factor of Safety
resisting_force = Number(j_i)
driving_force = Number(A_3)
division = Division(A=resisting_force, B=driving_force)
fs_u = Number(division)

# ----
# New definition of FS (Li & Høien 2023)
expression_36 = Expression(
    H=H,
    Y=Y,
    B_p=b_p,
    B_a=b_a,
    X=X,
    W=W,
    C=C,
    U=U_4,
    E=E,
    W_s=w_s,
    s_cap=s_cap,
    J_i=j_i,
    Expression="(J_i-((H+Y+C+B_p+B_a+X)•s_cap))/((W+U+E+W_s)•s_cap)")
fs_s = Number(expression_36)

# ---- group: 6.1 - Factor of Safety
fs_u_2 = Number(fs_u)
fs_s_2 = Number(fs_s)
fs_f_2 = Number(fs_f)

# ----
# Unconditionally stable: returns FS = 9999 if s_cap is {0,0,0}
vector_length = VectorLength(Vector=s_cap)
equality_4 = Equality(FirstNumber=vector_length, SecondNumber="0")  # -> Equality, Inequality

multiplication_6 = Multiplication(A=equality_4.Equality, B="9999")

_0_or_9999 = Integer(multiplication_6)

# ---- group: 6.1 - Factor of Safety (continued)
entwine = Entwine(Branch00=fs_f_2, Branch01=fs_u_2, Branch02=fs_s_2, Branch03=_0_or_9999, FlattenInputs=True)  # -> flatten(Result)
min_max_4 = MinMax(Number=entwine)  # -> Minimum, Maximum
fs = Number(min_max_4.Maximum)

# ----
# Sliding direction number:
# 0 = Unconditionally stable
# 1 = Falling or lifting
# 2 = Sliding on more than two joints
# 3 = Sliding on single joint
# 4 = Sliding on joint intersection
sliding_joint_index_3 = Integer(stream_filter_4)
driving_force_2 = Number(A_3)
# OUTPUT
fs_2 = Number(fs)
sliding_direction_number_2 = Integer(mass_addition_10.Result)
resisting_force_2 = Number(j_i)
sliding_direction_unit_vector = Vector(s_cap)
shear_resistance_on_joints_mn = Number(expression_35)
normal_force_joints_mn = Number(n_i)
text_join = TextJoin(Text=sliding_joint_index_3, Join=",")
first_last_6 = FirstLast(List=sliding_joint_index_3)  # -> FirstValue, LastValue
null_item = NullItem(Item=first_last_6.FirstValue)  # -> NullFlags, InvalidFlags, Description
sliding_direction_number_3 = Panel(sliding_direction_number_2)
driving_force_3 = Panel(driving_force_2)
resisting_force_3 = Panel(resisting_force_2)
fs_3 = Panel(fs_2)
sliding_direction_unit_vector_2 = Panel(sliding_direction_unit_vector)
text_join_2 = TextJoin(Text=shear_resistance_on_joints_mn, Join=",")
text_join_3 = TextJoin(Text=normal_force_joints_mn, Join=",")
pick_n_choose_4 = PickNChoose(Pattern=null_item.NullFlags, Stream0=text_join, Stream1="Null")
sliding_joint_index_4 = Text(pick_n_choose_4)
sliding_direction_number_4 = ClusterOutput(sliding_direction_number_2)  # Sliding direction number: 0 = Unconditionally stable; 1 = Falling or lifting; 2 = Sliding on more than two joints; 3 = Sliding on single joint; 4 = Sliding on joint intersection
sliding_direction_unit_vector_3 = ClusterOutput(sliding_direction_unit_vector)
normal_force_on_joints_mn = Panel(text_join_3)
shear_resistance_on_joints_mn_2 = Panel(text_join_2)
resisting_force_4 = ClusterOutput(resisting_force_2)
factor_of_safety = ClusterOutput(fs_2)
driving_force_4 = ClusterOutput(driving_force_2)
sliding_joint_index_5 = ClusterOutput(sliding_joint_index_4)
sliding_joint_index_6 = Panel(pick_n_choose_4)
normal_force_on_joints_mn_2 = Text(text_join_3)
shear_resistance_on_joints_mn_3 = Text(text_join_2)
normal_force_on_joints_mn_3 = ClusterOutput(normal_force_on_joints_mn_2)
shear_resistance_on_joints_mn_4 = ClusterOutput(shear_resistance_on_joints_mn_3)

# ==== cluster ReOrientCutterPlane
point_in_wedge = ClusterInput()
cutter_plane = ClusterInput()
cutter_plane_2 = Plane(cutter_plane)
point_in_wedge_2 = Point(point_in_wedge)
move_to_plane = MoveToPlane(Geometry=point_in_wedge_2, Plane=cutter_plane_2, Above="True", Below="False")  # -> Geometry, Transform
list_length = ListLength(List=cutter_plane_2)
text = Text(simplify(move_to_plane.Transform))
duplicate_data = DuplicateData(Data="Identity", Number=list_length, Order=True)
flip_plane = FlipPlane(Plane=cutter_plane_2, FlipX=False, FlipY=False, FlipZ=True)  # -> Flipped, ResultBoolean
match_tree_structure = MatchTreeStructure(DataList=flatten(duplicate_data), TreeMask=text)
merge = Merge(Data1=match_tree_structure, Data2=text)
stringduplicates = StringDuplicates(String=merge)  # -> String, Integer, String_2
first_last = FirstLast(List=stringduplicates.String_2)  # -> FirstValue, LastValue
pick_n_choose = PickNChoose(Pattern=first_last.LastValue, Stream0=flip_plane.Flipped, Stream1=cutter_plane_2)
panel = Panel(merge)
plane_below_point_in_wedge = Plane(flatten(pick_n_choose))
plane_below_point_in_wedge_2 = ClusterOutput(plane_below_point_in_wedge)

# ==== cluster MultipleSlidingSurfaceNormalForceDistribution
l_m = ClusterInput()  # Length of each contact plane in the YZ plane.
theta_l_deg = ClusterInput()  # Angle of each plane measured from the positive X axis.
r_n_mn = ClusterInput()  # Resultant active force acting on the rock block perpendicular to the sliding direction.
theta_r_deg = ClusterInput()  # Angle defining the direction of the resultant force.
theta_r_deg_2 = Number(theta_r_deg)
theta_l_deg_2 = EleFrontDataDescription(theta_l_deg, ShiftDepth=0, isNameSet=False)
# Mauldon & Ureta 1996
l_m_2 = Number(l_m)
r_n_mn_2 = Number(r_n_mn)
series = Series(Start=0, Step="0.1", Count="3600")
theta_s = Number(series)
expression = Expression(theta_s=graft(theta_s), theta_l=theta_l_deg_2, Expression="(theta_s-theta_l)*π/180")
expression_2 = Expression(theta_s=graft(theta_s), theta_r=theta_r_deg_2, Expression="tan((theta_s-theta_r)*π/180)")
x = Number(expression)
expression_3 = Expression(L=l_m_2, x=x, Expression="L*sin(x)*cos(x)")
expression_4 = Expression(L=l_m_2, x=x, Expression="L*(cos(x))²")
mass_addition = MassAddition(Input=expression_3)  # -> Result, PartialResults
mass_addition_2 = MassAddition(Input=expression_4)  # -> Result, PartialResults
division = Division(A=mass_addition.Result, B=mass_addition_2.Result)
subtraction = Subtraction(A=division, B=expression_2)  # -> flatten(Result)
absolute = Absolute(Value=subtraction)
sort_list = SortList(Keys=absolute, ValuesValuesA=theta_s)  # -> Keys, ValuesValuesA
first_last = FirstLast(List=sort_list.ValuesValuesA)  # -> FirstValue, LastValue
num_theta_s = Number(first_last.FirstValue)
expression_5 = Expression(num_theta_s=num_theta_s, theta_l=theta_l_deg_2, L=l_m_2, Expression="L*cos((num_theta_s-theta_l)*π/180)²")
mass_addition_3 = MassAddition(Input=expression_5)  # -> Result, PartialResults
expression_6 = Expression(
    num_theta_s=num_theta_s,
    theta_r=theta_r_deg_2,
    R_N=r_n_mn_2,
    eq_16=mass_addition_3.Result,
    Expression="R_N*(cos((num_theta_s-theta_r)*π/180)/eq_16)")
expression_7 = Expression(
    s=expression_6,
    L=l_m_2,
    num_theta_s=num_theta_s,
    theta_l=theta_l_deg_2,
    Expression="s*L*cos((num_theta_s-theta_l)*π/180)")
n_l = Number(expression_7)
n_l_2 = ClusterOutput(n_l)  # Normal force on sliding surface
num_theta_s_2 = ClusterOutput(num_theta_s)
